# Grasshopper definition create_3dbuildings_trees_streets.gh (Grasshopper 0.9.76)
# plug-ins: Python Interpreter

gismo = Gismo_Gismo(gismoFolder="c:\gismo")  # -> readMe
# ---------- gismo: Python ----------
# this is Gismo's main component
#
# Gismo is a plugin for GIS Environmental Analysis (GPL) started by Djordje Spasic.
# 
# This file is part of Gismo.
# 
# Copyright (c) 2017, Djordje Spasic <djordjedspasic@gmail.com>
# Gismo is free software: you can redistribute it and/or modify it under the terms of the GNU General Public License as published by the Free Software Foundation, either version 3 of the License, or (at your option) any later version.
#
# Gismo is distributed in the hope that it will be useful, but WITHOUT ANY WARRANTY; without even the implied warranty of MERCHANTABILITY or FITNESS FOR A PARTICULAR PURPOSE. See the GNU General Public License for more details.
# 
# You should have received a copy of the GNU General Public License along with this program. If not, see http://www.gnu.org/licenses/.
#
# The GPL-3.0+ license <http://spdx.org/licenses/GPL-3.0+>

"""
This component contains all Gismo classes. Other Gismo components are being run by referencing these classes.
So in order for any other Gismo component to work, you need to run this component first. If this component is ran successfully you will hear the Gismo penquin peeping!!
-
Provided by Gismo 0.0.1
    input:
        mapFolder_: Optional folder path for MapWinGIS installation folder.
                    -
                    Most of Gismo's components require MapWinGIS application being installed.
                    If you did that, Gismo Gismo component will automatically find your MapWinGIS installation folder.
                    However sometimes Gismo Gismo component will fail to find your MapWinGIS installation folder. In that case you need to input it manually by adding it to the mapFolder_ input.
        gismoFolder_: Optional folder path for Gismo working folder.
                      -
                      If nothing is supplied to this input, then gismoFolder_ will be set to: "c:\gismo" by default.
    output:
        readMe!: This output will inform whether the component has been successfully ran or not.
"""

ghenv.Component.Name = "Gismo_Gismo"
ghenv.Component.NickName = "Gismo"
ghenv.Component.Message = "VER 0.0.1\nFEB_14_2017"
ghenv.Component.IconDisplayMode = ghenv.Component.IconDisplayMode.icon
ghenv.Component.Category = "Gismo"
ghenv.Component.SubCategory = "0 | Gismo"
try: ghenv.Component.AdditionalHelpFromDocStrings = "1"
except: pass

import rhinoscriptsyntax as rs
import scriptcontext as sc
import Grasshopper
import datetime
import System
import shutil
import urllib
import Rhino
import time
import math
import sys
import clr
import os


class Check(object):
    """
    check component's version and date
    """
    def deconstructComponents_versionDate(self, componentMessage):
        """
        deconstruct the "ghenv.Component.Message" string to a version and date
        """
        versionIncomplete, dateIncomplete = componentMessage.split("\n")
        
        # version
        VERstring, version = versionIncomplete.split(" ")
        
        # date
        date = dateIncomplete.replace("_","/")  # example: JUN/09/2020
        date_timeStruct = time.strptime(date, "%b/%d/%Y")
        
        return version, date_timeStruct
    
    
    def normalizeVersion(self, v):
        """
        normalize gismo version string
        """
        # from: http://stackoverflow.com/a/1714132/3137724
        parts = [int(x) for x in v.split(".")]
        while parts[-1] == 0:
            parts.pop()
        return parts
    
    
    def versionDate(self, component):
        """
        compare GismoGismo component and other component's versions and that component's "#compatibleLBVersion" version and date
        """
        gismoGismo_ComponentMessage = ghenv.Component.Message
        components_ComponentMessage = component.Message
        gismoGismo_version, gismoGismo_date_timeStruct = self.deconstructComponents_versionDate(gismoGismo_ComponentMessage)
        component_version, component_date_timeStruct_dummy = self.deconstructComponents_versionDate(components_ComponentMessage)
        
        # a) compare the Gismo_Gismo and components version (date is irrelevant)
        versionCompareResult = cmp(self.normalizeVersion(gismoGismo_version), self.normalizeVersion(component_version))  # returns: -1 (smaller than), 0 (equal), 1 (larger than)
        if versionCompareResult == -1:
            validVersionDate = False
            printMsg = "You are using an older version of Gismo_Gismo component.\nDownload the newest one from:\n\n" + \
                       "https://github.com/stgeorges/gismo/blob/master/userObjects/Gismo_Gismo.ghuser\n\n" + \
                       "Once you download the Gismo_Gismo.ghuser file, follow these four simple steps:\n\n" + \
                       "1) Check if Gismo_Gismo.ghuser file has been blocked: right click on it, and choose \"Properties\". If there is an \"Unblock\" button click on it, and then click on \"OK\". If there is no \"Unblock\" button, just click on \"OK\".\n\n" + \
                       "2) Put this file into your Grasshopper's: \"File->Special Folders->User Object Folder\" folder.\n\n" + \
                       "3) In your Grasshopper definition, delete the old \"Gismo_Gismo\" component and drag and drop the new one from the \"0 | Gismo\" menu.\n\n" + \
                       "4) In Grasshopper's top menu, choose: \"Solution->Recompute\". That's it!"
            del component
            return validVersionDate, printMsg
        else:
            # Gismo_Gismo component and component's version are equal(versionCompareResult = 0) or GismoGismo is newer(versionCompareResult = 1)
            # b) compare the component's "#compatibleLBVersion" version AND date with Gismo_Gismo version AND date
            componentsCodeString = component.Code
            codePerLine = componentsCodeString.split("\n")
            for line in codePerLine:
                if "#compatibleGismoVersion" in line:
                    #dateIncomplete = line.split("\\n")[-1].strip()  # example: JUN_09_2020
                    versionIncomplete, dateIncomplete = line.split("\\n")
                    
                    # "#compatibleGismoVersion" version
                    compatibleGismoVersion_version = versionIncomplete.split("VER")[-1].strip()
                    
                    # "#compatibleGismoVersion" date
                    dateIncomplete2 = dateIncomplete.strip()
                    date = dateIncomplete2.replace("_","/")  # example: JUN/09/2020
                    component_date_timeStruct = time.strptime(date, "%m/%d/%Y")
                    break
            else:
                # "#compatibleGismoVersion" is not found in the components code
                validVersionDate = False
                printMsg = "This component does not contain the Gismo_Gismo compatibility tag (\"#compatibleGismoVersion\").\nReport this issue at:" + \
                           "http://www.grasshopper3d.com/group/gismo" + \
                           "\n\nby opening a new topic there."
                del component
                del componentsCodeString
                return validVersionDate, printMsg
           
            versionCompareResult2 = cmp(self.normalizeVersion(gismoGismo_version), self.normalizeVersion(compatibleGismoVersion_version))  # returns: -1 (smaller than), 0 (equal), 1 (larger than)
            if versionCompareResult2 == -1:
                # the "#compatibleGismoVersion" version is newer than Gismo_Gismo version
                validVersionDate = False
                printMsg = "You are using an older version of Gismo_Gismo component ,\nDownload the newest one from:\n\n" + \
                           "https://github.com/stgeorges/gismo/blob/master/userObjects/Gismo_Gismo.ghuser\n\n" + \
                           "Once you download the Gismo_Gismo.ghuser file, follow these four simple steps:\n\n" + \
                           "1) Check if Gismo_Gismo.ghuser file has been blocked: right click on it, and choose \"Properties\". If there is an \"Unblock\" button click on it, and then click on \"OK\". If there is no \"Unblock\" button, just click on \"OK\".\n\n" + \
                           "2) Put this file into your Grasshopper's: \"File->Special Folders->User Object Folder\" folder.\n\n" + \
                           "3) In your Grasshopper definition, delete the old \"Gismo_Gismo\" component and drag and drop the new one from the \"0 | Gismo\" menu.\n\n" + \
                           "4) In Grasshopper's top menu, choose: \"Solution->Recompute\". That's it!"
                del component
                del componentsCodeString
                return validVersionDate, printMsg
            else:
                if gismoGismo_date_timeStruct < component_date_timeStruct:
                    # the "#compatibleGismoVersion" date is newer than Gismo_Gismo date
                    validVersionDate = False
                    printMsg = "You are using an older version of Gismo_Gismo component ;\nDownload the newest one from:\n\n" + \
                               "https://github.com/stgeorges/gismo/blob/master/userObjects/Gismo_Gismo.ghuser\n\n" + \
                               "Once you download the Gismo_Gismo.ghuser file, follow these four simple steps:\n\n" + \
                               "1) Check if Gismo_Gismo.ghuser file has been blocked: right click on it, and choose \"Properties\". If there is an \"Unblock\" button click on it, and then click on \"OK\". If there is no \"Unblock\" button, just click on \"OK\".\n\n" + \
                               "2) Put this file into your Grasshopper's: \"File->Special Folders->User Object Folder\" folder.\n\n" + \
                               "3) In your Grasshopper definition, delete the old \"Gismo_Gismo\" component and drag and drop the new one from the \"0 | Gismo\" menu.\n\n" + \
                               "4) In Grasshopper's top menu, choose: \"Solution->Recompute\". That's it!"
                    del component
                    del componentsCodeString
                    return validVersionDate, printMsg
                else:
                    validVersionDate = True
                    printMsg = "ok"
                    del component
                    del componentsCodeString
                    return validVersionDate, printMsg


class mainComponent(object):
    """
    check gismoFolder_ and mapFolder_ inputs of "Gismo Gismo" component
    """
    def gismoWorkingFolder(self, gismoFolder):
        """
        check gismoFolder_ of Gismo Gismo component
        """
        if (gismoFolder == None):
            gismoFolder = "c:\gismo"
        
        myPreparation = Preparation()
        folderCreated = myPreparation.createFolder(gismoFolder)
        if folderCreated:
            # gismoFolder successfully created or it already exists
            printMsg = "ok"
            return gismoFolder, printMsg
        else:
            # "gismoFolder_" inputted to Gismo Gismo component can not be created
            printMsg = "gismoFolder_ is invalid"
            return False, printMsg
    
    
    def mapWinGIS(self, mapFolder=None):
        """
        check if mapWinGIS is installed
        """
        # identify if Rhino 5 is 32 or 64 bit version
        if System.Environment.Is64BitProcess == False:
            bitVersion = "Win32"
        elif System.Environment.Is64BitProcess == True:
            bitVersion = "x64"
        
        if mapFolder == None:
            # check if there is a "MapWinGIS" folder present in some well known places
            iteropMapWinGIS_dll_folderPathLL = [
            "C:\\MapWindow",
            "C:\\ProgramData\\MapWindow", 
            "C:\\Program Files\\MapWindow", 
            "C:\\Program Files (x86)\\MapWindow", 
            "D:\\MapWindow", 
            "D:\\ProgramData\\MapWindow", 
            "D:\\Program Files\\MapWindow", 
            "D:\\Program Files (x86)\\MapWindow", 
            "C:\\MapWinGIS", 
            "C:\\ProgramData\\MapWinGIS", 
            "C:\\Program Files\\MapWinGIS", 
            "C:\\Program Files (x86)\\MapWinGIS", 
            "D:\\MapWinGIS", 
            "D:\\ProgramData\\MapWinGIS", 
            "D:\\Program Files\\MapWinGIS", 
            "D:\\Program Files (x86)\\MapWinGIS"]
        else:
            iteropMapWinGIS_dll_folderPathLL = [mapFolder]
        
        iteropMapWinGIS_dll_fileName = "Interop.MapWinGIS.dll"
        
        InteropMapWinGISDll_present = False
        for iteropMapWinGIS_dll_folderPath in iteropMapWinGIS_dll_folderPathLL:
            iteropMapWinGIS_dll_filePath = os.path.join(iteropMapWinGIS_dll_folderPath, iteropMapWinGIS_dll_fileName)
            InteropMapWinGISDll_present = os.path.isfile(iteropMapWinGIS_dll_filePath)
            if InteropMapWinGISDll_present != False:
                # "Interop.MapWinGIS.dll" file found in the "MapWinGIS" folder
                break
        else:
            # "Interop.MapWinGIS.dll" file was found in the "iteropMapWinGIS_dll_folderPathLL" folders
            #InteropMapWinGISDll_present = False
            if mapFolder == None:
                # nothing inputted into the "mapFolder_"
                printMsg = "This component requires the \"MapWinGIS\" application to be installed in order for it to work.\n" + \
                           "The component could not find the installation folder of the \"MapWinGIS\" application.\n" + \
                           "-\n" + \
                           "If you haven't installed the \"MapWinGIS\" application, download its %s version from the link below, and install it:\n" % bitVersion + \
                           "https://github.com/MapWindow/MapWinGIS/releases\n" + \
                           "-\n" + \
                           "If you already downloaded and installed the \"MapWinGIS\" application, then supply its installation folder path to the \"mapFolder_\" input."
            else:
                # some folder path inputted into the "mapFolder_"
                printMsg = "The folder path you added to Gismo_Gismo component's \"mapFolder_\" input is invalid: meaning this is not the MapWinGIS application install folder.\n" + \
                           "-\n" + \
                           "You can find the valid \"mapFolder_\" path by using the Start Menu -> Search function (and search for \"MapWinGIS\").\n" + \
                           "If you do not input the correct folder path to \"mapWindow\" some Gismo components might not be able to work."
            iteropMapWinGIS_dll_folderPath = gdalDataPath_folderPath = None
            validInputData = False
            return iteropMapWinGIS_dll_folderPath, gdalDataPath_folderPath, validInputData, printMsg
        
        
        try:
            clr.AddReferenceToFileAndPath(iteropMapWinGIS_dll_filePath)
        except:
            pass
        
        iteropMapWinGIS_dll_loaded_Success = "Interop.MapWinGIS" in [assembly.GetName().Name for assembly in clr.References]
        
        if iteropMapWinGIS_dll_loaded_Success:
            # import GDAL libraries and register GDAL drivers
            global MapWinGIS  # so that other methods in this Gismo Gismo component could use the MapWinGIS module
            import MapWinGIS
            
            # testing if the "Retrieving the COM class factory for component with CLSID" error will appear
            try:
                dummyShape = MapWinGIS.ShapeClass()
                sc.sticky["MapWinGIS"] = ""  # "" is dummy value. Only the key name "MapWinGIS" is important
            except Exception, e:
                # the "Retrieving the COM class factory for component with CLSID" error appeared
                iteropMapWinGIS_dll_folderPath = gdalDataPath_folderPath = None
                validInputData = False
                printMsg = "The following error has been raised:\n" + \
                           " \n" + \
                           "%s\n" % e + \
                           " \n \n" + \
                           "If upper error is:\n" + \
                           "1) \"Retrieving the COM class factory for component with CLSID...\" then try the following fix:\n" + \
                           " a) Close Rhino. Restart your PC. Once the PC boots up, double click on the \"regMapWinGIS.cmd\" file in \"MapWinGIS\" installation folder. When it closes the Command Prompt window it opened, try running Rhino, Grasshopper and the component again.\n" + \
                           " b) If the upper COM class error appears again, then close Rhino, and uninstall the MapWinGIS application. It is advisable to do that with an application which does that by removing not only the installation files but also the leftover files (like those from registry). For example, use the: Revo Uninstaller Pro. A free 30 days full working version can be downloaded from: http://www.revouninstaller.com.\n" + \
                           " After the Revo Uninstaller Pro uninstalls MapWinGIS, install it again, but this time by running the installation file by right clicking on it, and choosing: Run as -> Administrator. After the installation is complete double click on \"regMapWinGIS.cmd\" file in \"MapWinGIS\" installation folder. When it closes the Command Prompt window it opened, try running Rhino, Grasshopper and the component again.\n" + \
                           " If after this the COM class error appears again, then post a question about this issue at:\n" + \
                           " http://www.grasshopper3d.com/group/gismo/forum.\n" + \
                           " \n \n" + \
                           "2) If the upper error is not \"Retrieving the COM class factory for component with CLSID...\", please post a question about this issue at:\n" + \
                           "http://www.grasshopper3d.com/group/gismo/forum."
                return iteropMapWinGIS_dll_folderPath, gdalDataPath_folderPath, validInputData, printMsg
            
            # set the folderpath for "gdal_data" folder
            gdalDataPath_folderPath = os.path.join(iteropMapWinGIS_dll_folderPath, "gdal-data")
            MapWinGIS.GlobalSettingsClass().GdalDataPath = gdalDataPath_folderPath  # added in 4.9.3 version
            
            validInputData = True
            printMsg = "ok"
            return iteropMapWinGIS_dll_folderPath, gdalDataPath_folderPath, validInputData, printMsg
        
        else:
            # the "MapWinGIS" install folder contains the "Interop.MapWinGIS.dll" file but some other ones are missing
            gdalDataPath_folderPath = None
            validInputData = False
            printMsg = "This component requires the \"MapWinGIS\" application to be installed in order for it to work.\n" + \
                       " \n" + \
                       "For some reason it seems that \"MapWinGIS\" is installed but its install folder (\"%s\") does not contain all the necessary files.\n" % iteropMapWinGIS_dll_folderPath + \
                       "Close Rhino. Uninstall the MapWinGIS application. Then install it again.\n" + \
                       " \n" + \
                       "If after this, you still get this same message please post a question about this issue at:\n" + \
                       "http://www.grasshopper3d.com/group/gismo/forum."
            iteropMapWinGIS_dll_folderPath = None  # set in here, to prevent the "iteropMapWinGIS_dll_folderPath" being equal to "None" when printed in upper "printMsg"
            return iteropMapWinGIS_dll_folderPath, gdalDataPath_folderPath, validInputData, printMsg


class Preparation(object):
    """
    methods used to prepare components before performing analysis/running results
    """
    def cleanString(self, string):
        """
        for a given string, replace "/" and "\" with "-". replace " " with "_"
        """
        stringCorrected = System.String.Replace(  System.String.strip(System.String.Replace(System.String.Replace(string,"\\","-"), "/", "-") )  ," ", "_")  # removing "/", "\", " "
        return stringCorrected
    
    
    def checkUnits(self):
        """
        calculate unitConversionFactor for appropriate Rhino document Model unit. And check Rhino Model units
        """
        unitSystem_id = int(Rhino.RhinoDoc.ActiveDoc.ModelUnitSystem)
        
        if (unitSystem_id == 2):
            fromUnitSystem =  Rhino.UnitSystem.Millimeters
            unitSystem = "Millimeters"
        elif (unitSystem_id == 3):
            fromUnitSystem = Rhino.UnitSystem.Centimeters
            unitSystem = "Centimeters"
        elif (unitSystem_id == 4):
            fromUnitSystem = Rhino.UnitSystem.Meters
            unitSystem = "Meters"
        elif (unitSystem_id == 8):
            fromUnitSystem = Rhino.UnitSystem.Inches
            unitSystem = "Inches"
        elif (unitSystem_id == 9):
            fromUnitSystem = Rhino.UnitSystem.Feet
            unitSystem = "Feet"
        elif (unitSystem_id == 10):
            fromUnitSystem = Rhino.UnitSystem.Miles
            unitSystem = "Miles"
        else:
            # chosen unit system is not one of the above supported ones
            return None, "unknown unit system"
        
        toMeters = Rhino.UnitSystem.Meters
        unitConversionFactor = Rhino.RhinoMath.UnitScale(fromUnitSystem, toMeters)
        return unitConversionFactor, unitSystem
    
    
    def createFolder(self, folderPath):
        """
        creates a folder for a given folderPath.
        Returns "True" if folder is created or it it already exists. And "False" if folderPath is invalid
        """
        if os.path.isdir(folderPath):
            # "folderPath" exists
            folderCreated = True
            return folderCreated
        else:
            # "folderPath" does not exist
            try:
                # try creating the folder according to "folderPath"
                os.mkdir(folderPath)
                folderCreated = True
                return folderCreated
            except Exception, e:
                # invalid folderPath
                folderCreated = False
                return folderCreated
    
    
    def downloadFile(self, downloadLink, downloadedFilePath):
        """
        downloading a file for the given link and filepath location.
        Returns "True" is file is successfully downloaded and "False" if download fails
        """
        try:
            # try "secure http" download
            client = System.Net.WebClient()
            client.DownloadFile(downloadLink, downloadedFilePath)
        except Exception, e:
            print "downloadFile_e1: ", e
            try:
                # "secure http" failed, try "http" download:
                filePathDummy, infoHeader = urllib.urlretrieve(downloadLink, downloadedFilePath)
            except Exception, e:
                print "downloadFile_e2: ", e
                # downloading of file failed
                fileDownloaded_success = False
                return fileDownloaded_success
        
        fileDownloaded_success = True
        return fileDownloaded_success
    
    
    def constructLocation(self, locationName, latitude, longitude, timeZone = 0, elevation = 0):
        """
        construct .epw file location
        """
        locationString = "Site:Location,\n" + \
                   "%s,\n" % locationName + \
                   "%s,      !Latitude\n" % latitude + \
                   "%s,     !Longitude\n" % longitude + \
                   "%s,     !Time Zone\n" % timeZone + \
                   "%s;       !Elevation" % elevation
        
        return locationString
    
    
    def deconstructLocation(self, location):
        """
        deconstruct a location string from .epw file
        """
        deconstructedLocationStrings = []
        splittedStrings = location.split("\n")
        for index,item in enumerate(splittedStrings):
            splittedStrings2 = item.split(",")
            firstItem = splittedStrings2[0].strip()
            if index == len(splittedStrings)-1:
                firstItem = firstItem.split(";")[0]
            deconstructedLocationStrings.append(firstItem)
        
        locationLabel, locationName, latitude, longitude, timeZone, elevation = deconstructedLocationStrings
        return locationName, latitude, longitude, timeZone, elevation
    
    
    def checkLocationData(self, location):
        """
        extended version of upper "deconstructLocation" method. Also fixes the locationName
        """
        if location:
            try:
                # location data
                locationName, latitude, longitude, timeZone, elevation = self.deconstructLocation(location)  # latitude positive towards north, longitude positive towards east
                locationNameCorrected = System.String.Replace(  System.String.strip(System.String.Replace(System.String.Replace(locationName,"\\","-"), "/", "-") )  ," ", "_")  # removing "/", "\", " " from locationName
                
                latitude = float(latitude)
                longitude = float(longitude)
                timeZone = float(timeZone)
                elevation = float(elevation)
                
                validLocationData = True
                printMsg = "ok"
            
            except Exception, e:
                # something is wrong with "_location" input (the input is not from Ladybug "Import epw" component "location" ouput)
                locationNameCorrected = latitude = longitude = timeZone = elevation = None
                validLocationData = False
                printMsg = "Something is wrong with \"_location\" input."
        else:
            locationNameCorrected = latitude = longitude = timeZone = elevation = None
            validLocationData = False
            printMsg = "Please add location from Gismo's \"Create Location\" component, to this component's \"_location\" input."
        
        return locationNameCorrected, latitude, longitude, timeZone, elevation, validLocationData, printMsg
    
    
    def angle2northClockwise(self, north):
        """
        retuns north angle in radians and north vector for given either of these two
        this method is entirely copied from Ladybug_Ladybug "angle2northClockwise" method.
        """
        try:
            northVec = Rhino.Geometry.Vector3d.YAxis
            northVec.Rotate(-math.radians(float(north)),Rhino.Geometry.Vector3d.ZAxis)
            northVec.Unitize()
            return 2*math.pi-math.radians(float(north)), northVec
        except Exception, e:
            try:
                northVec = Rhino.Geometry.Vector3d(north)
                northVec.Unitize()
                return Rhino.Geometry.Vector3d.VectorAngle(Rhino.Geometry.Vector3d.YAxis, northVec, Rhino.Geometry.Plane.WorldXY), northVec
            except Exception, e:
                return 0, Rhino.Geometry.Vector3d.YAxis
    
    
    def checkShapeType(self, shapesLL):
        """
        determine which shapeType_ input has been used for "OSM Shapes" component based on its "shapes" output
        """
        numOfShapes = 0
        numOfShapesClosed = 0
        for shapesL in shapesLL:
            if (len(shapesL) != 0):
                # if branch is not empty
                numOfShapes += 1
                for shape in shapesL:
                    if isinstance(shape, Rhino.Geometry.Point):
                        # shapes_ are points
                        shapeType = 2
                        del shapesLL
                        return shapeType
                    else:
                        # check if shapeType = 0 (closed polygon) or 1 (polyline)
                        if shape.IsClosed:
                            numOfShapesClosed += 1
        
        if numOfShapes == numOfShapesClosed:
            # shapeType = 0 will always have closed polygons!
            shapeType = 0
        elif numOfShapes != numOfShapesClosed:
            # it may happen that shapeType = 1 will sometimes have a couple of closed polygons (those that are not added to "closed_ways_are_polygons=" line in osmconf.ini)
            shapeType = 1
        
        del shapesLL
        return shapeType
    
    
    def modify_dataTree(self, oldDataTree, newBranchIndex, newBranchList):
        """
        modify the datatree list on a certain branch index
        """
        newDataTree = Grasshopper.DataTree[object]()
        
        oldDataTree_Paths = oldDataTree.Paths
        for branchIndex, oldBranchList in enumerate(oldDataTree.Branches):
            if (branchIndex == newBranchIndex):
                newDataTree.AddRange(newBranchList, oldDataTree_Paths[branchIndex])
            else:
                newDataTree.AddRange(oldBranchList, oldDataTree_Paths[branchIndex])
        del oldDataTree
        return newDataTree
    
    
    def datatree_shiftPaths(self, dataTree):
        """
        shifting data tree paths by -1
        """
        
        branches = dataTree.Branches
        paths = dataTree.Paths
        
        newPaths = [p.CullElement() for p in paths]
        
        shiftedPathsTree = Grasshopper.DataTree[object]()
        for i in xrange(dataTree.BranchCount):
            shiftedPathsTree.AddRange(branches[i], newPaths[i])
        
        del dataTree
        return shiftedPathsTree
    
    
    def boundingBox_properties(self, geometryL, accurate=True):
        """
        getting volume, centroid, corner pts and dimensions of a bounding box created around a "geometry"
        """
        ####unionBB = geometry.GetBoundingBox(accurate)
        #mesh = Rhino.Geometry.Mesh.CreateFromBrep(geometry)[0]
        #unionBB = Rhino.Geometry.Mesh.GetBoundingBox(mesh, accurate)
        
        bbL = []
        for geo in geometryL:
            bbL.append(geo.GetBoundingBox(accurate))
        
        unionBB = bbL[0]  # initial value
        for i in range(len(bbL)-1):
            unionBB = Rhino.Geometry.BoundingBox.Union(unionBB, bbL[i+1])
        
        
        bb_centroid = unionBB.Center
        
        bb_edges = unionBB.GetEdges()
        bb_length = bb_edges[0].Length
        bb_depth = bb_edges[1].Length
        bb_height = bb_edges[8].Length
        
        bb_corners = unionBB.GetCorners()
        bb_bottomLeftCorner = bb_corners[0]
        bb_bottomRightCorner = bb_corners[1]
        bb_topRightCorner = bb_corners[2]
        bb_topLeftCorner = bb_corners[3]
        
        try:
            bb_volume = Rhino.Geometry.VolumeMassProperties.Compute(unionBB.ToBrep()).Volume
        except:
            bb_volume = None
        
        return bb_volume, bb_centroid, bb_length, bb_depth, bb_height, bb_bottomLeftCorner, bb_bottomRightCorner, bb_topRightCorner, bb_topLeftCorner
    
    
    def textJustificationEnumeration(self, justificationIndex):
        """
        get TextJustification type based on justificationIndex
        """
        # justificationIndices:
        # 0 - bottom left (default)
        # 1 - bottom center
        # 2 - bottom right
        # 3 - middle left
        # 4 - center
        # 5 - middle right
        # 6 - top left
        # 7 - top middle
        # 8 - top right
        
        constantsList  = [0, 2, 4, 131072, 131074, 131076, 262144, 262146, 262148]
        try:
            justificationConstant = constantsList[justificationIndex]
        except:
            # if 0 < justificationIndex > 8
            justificationConstant = 0
        textJustification = System.Enum.ToObject(Rhino.Geometry.TextJustification, justificationConstant)
        return textJustification
    
    
    def text2srfOrMesh(self, returnSrfOrMesh, textL, textStartPt, textSize, fontName="Verdana", bold=True, italic=False, justificationIndex=0):
        """
        convert text to surface or mesh
        this method is based on "text2srf" method from Ladybug plugin
        """
        textObjectIdsL = []
        textSrfsL = []
        textMeshesL = []
        plane = Rhino.Geometry.Plane(textStartPt, Rhino.Geometry.Vector3d(0,0,1))
        joinedTextGeometry = Rhino.Geometry.Mesh()  # joined final text mesh
        textJustification = self.textJustificationEnumeration(justificationIndex)
        
        for text in textL:
            #textString = str(text)
            textString = unicode(text)
            textObjectId = Rhino.RhinoDoc.ActiveDoc.Objects.AddText(textString, plane, textSize, fontName, bold, italic, textJustification)
            textObjectIdsL.append(textObjectId)
            textObject = Rhino.RhinoDoc.ActiveDoc.Objects.Find(textObjectId)
            textCrvs = textObject.Geometry.Explode()
            joinedTextCrvs = Rhino.Geometry.Curve.JoinCurves(textCrvs)
            textSrfs = Rhino.Geometry.Brep.CreatePlanarBreps(joinedTextCrvs)
            if returnSrfOrMesh == "srf":
                textSrfsL.extend(textSrfs)
            elif returnSrfOrMesh == "mesh":
                textSrfsL.extend(textSrfs)
        
        tol = Rhino.RhinoDoc.ActiveDoc.ModelAbsoluteTolerance
        if returnSrfOrMesh == "srf":
            joinedTextGeometry = Rhino.Geometry.Brep.MergeBreps(textSrfsL, tol)
        elif returnSrfOrMesh == "mesh":
            for brep in textSrfsL:
                brepMeshes = Rhino.Geometry.Mesh.CreateFromBrep(brep)
                for brepMesh in brepMeshes:
                    brepMesh.VertexColors.CreateMonotoneMesh(System.Drawing.Color.Black)
                    joinedTextGeometry.Append(brepMesh)
            del textSrfsL
        
        # deleting
        quiet = True
        for textObjectId in textObjectIdsL:
            Rhino.RhinoDoc.ActiveDoc.Objects.Delete(textObjectId, quiet)
        
        return joinedTextGeometry
    
    
    def defaultCustomColors(self):
        """
        a list of Gismo's default customColors_ (gradient blue-green-red)
        """
        defaultCustomColors = [
        System.Drawing.Color.FromArgb(2,83,250),
        System.Drawing.Color.FromArgb(68,219,226),
        System.Drawing.Color.FromArgb(155,253,126),
        System.Drawing.Color.FromArgb(173,255,25),
        System.Drawing.Color.FromArgb(253,255,16),
        System.Drawing.Color.FromArgb(251,192,31),
        System.Drawing.Color.FromArgb(248,64,74)]
        
        return defaultCustomColors
    
    
    def read_legendBakePar(self, legendBakePar):
        """
        deconstruct "legendBakePar_" input to its parts
        """
        legendBakePar_LL = legendBakePar.Branches
        
        if (len(legendBakePar_LL) == 0)  or  ((len(legendBakePar_LL) == 1) and (legendBakePar_LL[0][0] == None)):
            # a) "legendBakePar_" input is empty, or
            # b) "Legend Bake Parameters" component is not ran for some reason (its legendBakePar output returns "None").
            legendStyle = 0  # rectangle cells
            legendPlane = None  # pick bounding box bottom right corner point
            maxValue = None  # pick the largest value
            minValue = None  # pick the smallest value
            
            customColors = []
            
            numLegendCells = 12
            fontName = "Verdana"
            fontSize = None  # calculate it according to the bounding box length
            numDecimals = 2
            legendUnit = None  # use the legendUnit defined by the component
            customTitle = None  # use the title defined by the component
            scale = 1
            
            layerName = None  # use layerName defined by the component
            layerColor = None  # use layerColor defined by the component
            layerCategoryName = None  # no layer category will be created
            
            return legendStyle, legendPlane, maxValue, minValue, customColors, numLegendCells, fontName, fontSize, numDecimals, legendUnit, customTitle, scale, layerName, layerColor, layerCategoryName
        
        else:
            # something inputted to "legendBakePar_"
            legendStyle, legendPlane, maxValue, minValue, customColors, numLegendCells, fontName, fontSize, numDecimals, legendUnit, customTitle, scale, layerName, layerColor, layerCategoryName = legendBakePar_LL  # all parts are lists now
            
            return legendStyle[0], legendPlane[0], maxValue[0], minValue[0], list(customColors), numLegendCells[0], fontName[0], fontSize[0], numDecimals[0], legendUnit[0], customTitle[0], scale[0], layerName[0], layerColor[0], layerCategoryName[0]
    
    
    def createTitle(self, returnSrfOrMesh, geometryL, textL, customTitle=None, textStartPt=None, textSize=None, fontName=None, bold=None, italic=None, textJustification=None):
        """
        create title below a certain geometryL
        """
        accurate = True
        bb_volume, bb_centroid, bb_length, bb_depth, bb_height, bb_bottomLeftCorner, bb_bottomRightCorner, bb_topRightCorner, bb_topLeftCorner = self.boundingBox_properties(geometryL, accurate)
        
        if (textSize == None):
            textSize = bb_depth / 25
        if (fontName == None):
            fontName = "Verdana"
        if (bold == None):
            bold = False
        if (italic == None):
            italic = False
        if (textStartPt == None):
            textStartPt = bb_bottomLeftCorner
        if (textJustification == None):
            textJustification = 6  # top left
        if (customTitle == None):
            # nothing inputted into "customTitle_" input of "Legend Bake Parameters" component. Use the upper "textL" as a string for the title text
            pass
        else:
            # something inputted into "customTitle_" input of "Legend Bake Parameters" component. Use the "customTitle_" input as a string for the title text
            
            # fixing the issue with "customTitle_" input not registring the "\n" for a new line
            customTitle2 = customTitle.replace("\\n", "\\\n")
            customTitle3 = customTitle2.replace("\\", "")
            textL = [customTitle3]
        
        
        textStartPt.Y = textStartPt.Y - textSize
        joinedTitleTextGeometry = self.text2srfOrMesh(returnSrfOrMesh, textL, textStartPt, textSize, fontName, bold, italic, textJustification)
        
        return joinedTitleTextGeometry, textStartPt, textSize
    
    
    def numberToColor(self, values, customColors, minB=None, maxB=None):
        """
        interpolate numbers to a gradient between a list of colors
        """
        if (len(customColors) == 0):
            customColors = self.defaultCustomColors()
        
        if sum(values) == (len(values)*values[0]):
            # all items in "values" are the same. Return the bottom most color
            return [customColors[0]] * len(values)
        
        # checking for "minB" and "maxB"
        minValue = min(values)
        maxValue = max(values)
        if minB != None:
            minValue = minB
        if maxB != None:
            maxValue = maxB
        
        # edit all "values" so that they are not smaller than "minValue", and larger than "maxValue"
        valuesChangedFor_minB_maxB = []
        for value in values:
            if value < minValue:
                valuesChangedFor_minB_maxB.append(minValue)
            elif value > maxValue:
                valuesChangedFor_minB_maxB.append(maxValue)
            else:
                valuesChangedFor_minB_maxB.append(value)
        
        # normalize the "values" to range(0,1)
        normalizedValues = [(valueChanged - minValue) / (maxValue - minValue)  for valueChanged in valuesChangedFor_minB_maxB]
        
        # divide range(0,1) according to the number of customColors items
        stepValueLimit = 1/(len(customColors)-1)
        valueLimit = 0
        valuesLimits_perEachCustomColor = []
        for i in range(len(customColors)-1):
            valuesLimits_perEachCustomColor.append(valueLimit)
            valueLimit += stepValueLimit
        valuesLimits_perEachCustomColor.append(1.0)  # this is done to avoid bugs with last value in "valuesLimits_perEachCustomColor" sometimes being 0.999..
        
        # generate legendColors
        legendColors = []
        for i in range(len(normalizedValues)):
            color = None  # initial value
            normalizedValue = normalizedValues[i]
            
            for index, valueLimit in enumerate(valuesLimits_perEachCustomColor):
                if valueLimit >= normalizedValue:
                    if index == 0:
                        # if value is between 0 and next valueLimit
                        color1 = customColors[index]
                        color2 = customColors[index+1]
                        minValue = valuesLimits_perEachCustomColor[index]
                        maxValue = valuesLimits_perEachCustomColor[index+1]
                    else:
                        color1 = customColors[index-1]
                        color2 = customColors[index]
                        minValue = valuesLimits_perEachCustomColor[index-1]
                        maxValue = valuesLimits_perEachCustomColor[index]
                    
                    normalizedValue2 = (normalizedValue - minValue) / (maxValue - minValue)  # normalized for a range between two "valuesLimits_perEachCustomColor" numbers
                    
                    # based on: http://stackoverflow.com/a/22649247/3137724
                    resultRed = color1.R + normalizedValue2 * (color2.R - color1.R)
                    resultGreen = color1.G + normalizedValue2 * (color2.G - color1.G)
                    resultBlue = color1.B + normalizedValue2 * (color2.B - color1.B)
                    
                    color = System.Drawing.Color.FromArgb(resultRed, resultGreen, resultBlue)
                    
                    legendColors.append(color)
                    break
        
        return legendColors
    
    
    def createLayer(self, layParentName, laySubName, projectName, newLayer, category, laySubName_color=None, category_color=None, legendBakePar=Grasshopper.DataTree[object]() ):
        """
        create a layers tree
        """
        # read the "legendBakePar_"
        legendStyle, legendPlane, maxValue, minValue, customColors, numLegendCells, fontName, fontSize, numDecimals, customLegendUnit, customTitle, scale, customLayerName, customLayerColor, customLayerCategoryName = self.read_legendBakePar(legendBakePar)
        
        if (customLayerName == None):
            # nothing added to "layerName_" input of "Legend Bake Parameters" component
            #category = category
            pass
        else:
            # something added to "layerName_" input of "Legend Bake Parameters" component
            category = customLayerName
        
        if (customLayerColor == None) and (category_color != None):
            # nothing added to "layerColor_" input of "Legend Bake Parameters" component, AND "category_color" has been defined through inputs
            #category_color = category_color
            pass
        elif (customLayerColor != None):
            # something added to "layerColor_" input of "Legend Bake Parameters" component
            category_color = customLayerColor
        elif (customLayerColor == None) and (category_color == None):
            # nothing added to "layerColor_" input of "Legend Bake Parameters" component, AND "category_color" has NOT been defined through inputs
            category_color = System.Drawing.Color.FromArgb(0,0,0)  # default, black
        
        if (customLayerCategoryName == None):
            # nothing added to "layerCategoryName_" input of "Legend Bake Parameters" component
            #layerCategoryName = layerCategoryName
            pass
        else:
            # something added to "layerCategoryName_" input of "Legend Bake Parameters" component
            projectName = customLayerCategoryName
        
        
        # add "newLayerCategory_ (boolean)" input to "Legend Bake Parameters" component
        newLayerCategory = False  # default, until "newLayerCategory_ (boolean)" input gets added to the "Legend Bake Parameters" component
        
        
        if (laySubName_color == None):
            laySubName_color = System.Drawing.Color.FromArgb(100,191,70)  # green
        
        
        
        #  setup parent and sublayers
        layerT = Rhino.RhinoDoc.ActiveDoc.Layers
        layParent = Rhino.DocObjects.Layer.GetDefaultLayerProperties()
        laySub = Rhino.DocObjects.Layer.GetDefaultLayerProperties()
        laySubPath = layParentName + "::" + laySubName
        layParent.Name = layParentName
        laySub.Name = laySubName
        layParent.Color = System.Drawing.Color.FromArgb(29,42,85)
        laySub.Color = laySubName_color
        
        # adding parent/sublayers
        layParentIndex = layerT.Find(layParentName, True)
        if layParentIndex >= 0:
            parent = layerT[layParentIndex]
            laySub.ParentLayerId = parent.Id
            index = layerT.Add(laySub)
        else:
            layerT.Add(layParent)
        laySubIndex = Rhino.DocObjects.Tables.LayerTable.FindByFullPath(layerT, laySubPath, True)
        if laySubIndex < 0:
            layParentIndex = layerT.Find(layParentName, True)
            parent = layerT[layParentIndex]
            laySub.ParentLayerId = parent.Id
            index = layerT.Add(laySub)
        
        # check projectName
        if projectName:
            projectName = str(projectName)
        else:
            projectName = "Project"
        if Rhino.DocObjects.Layer.IsValidName(projectName) == False: 
            print "Layer name: '" +  projectName + "' is not a valid layer name"
            return None, None
        
        # setting up and adding projectname_n layers
        layerPCAIndex = layerT.Find(laySubName, True)
        layerPCA = layerT[layerPCAIndex]
        project_n = Rhino.DocObjects.Layer.GetDefaultLayerProperties()
        project_n.IsVisible = False
        project_n.ParentLayerId = layerPCA.Id
        projectNameLayers = layerPCA.GetChildren()
        if not projectNameLayers:
            projectName_n = projectName + "_0"
            project_n.Name = projectName_n
            project_nIndex = layerT.Add(project_n)
        elif projectNameLayers:
            integers = []
            try:
                for l in projectNameLayers:
                    if projectName in l.Name:
                        integers.append(int(l.Name.split(projectName + "_")[-1]))
                        lastLayer = l.Name
                integers.sort()
                maxInt = integers[-1]
                if newLayer == True:
                    projectName_n = projectName + "_" + str(maxInt + 1)
                    project_n.Name = projectName_n
                    project_nIndex = layerT.Add(project_n)
                else: 
                    project_nIndex = layerT.Find(lastLayer, True)
            except:
                project_n.Name = projectName + "_0"
                project_nIndex = layerT.Add(project_n)
        
        # setting up and adding category layers
        project_n = layerT[project_nIndex]
        categoryL = Rhino.DocObjects.Layer.GetDefaultLayerProperties()
        if (category_color == None):
            category_color = System.Drawing.Color.FromArgb(0,0,0)  # default, black color of the final layer
        categoryL.Color = category_color
        categoryL.ParentLayerId = project_n.Id
        projectNameLayers = project_n.GetChildren()
        integers = []
        if projectNameLayers:
            for l in projectNameLayers:
                if category in l.Name:
                    integers.append(int(l.Name.split(category + "_")[-1]))
            try:
                integers.sort()
                maxInt = integers[-1]
                categoryName_n = category + "_" +str(int(maxInt)+1)
                categoryL.Name = categoryName_n
                categoryIndex = layerT.Add(categoryL)
            except:
                categoryL.Name = category  + "_0"
                categoryIndex = layerT.Add(categoryL)
                maxInt = -1
        else:
            categoryL.Name = category + "_0"
            categoryIndex = layerT.Add(categoryL)
            maxInt = -1
        
        return categoryIndex, categoryL.Name
    
    
    def bakeGeometry(self, geometryToBakeL, layerIndex):
        """
        add the geometry to the Rhino scene
        """
        # attributes
        attr = Rhino.DocObjects.ObjectAttributes()
        attr.LayerIndex = layerIndex
        attr.ColorSource = Rhino.DocObjects.ObjectColorSource.ColorFromObject
        attr.PlotColorSource = Rhino.DocObjects.ObjectPlotColorSource.PlotColorFromObject
        
        # bake
        geometryBaseTypes = [Rhino.Geometry.AnnotationBase, Rhino.Geometry.Brep, Rhino.Geometry.BrepLoop, Rhino.Geometry.Curve, Rhino.Geometry.PolyCurve, Rhino.Geometry.NurbsCurve, Rhino.Geometry.DetailView, Rhino.Geometry.Hatch, Rhino.Geometry.Light, Rhino.Geometry.Mesh, Rhino.Geometry.Point, Rhino.Geometry.Point3dGrid, Rhino.Geometry.PointCloud, Rhino.Geometry.Surface, Rhino.Geometry.NurbsSurface, Rhino.Geometry.TextDot]
        geometryIds = []
        for obj in geometryToBakeL:
            if type(obj) in geometryBaseTypes:
                id = Rhino.RhinoDoc.ActiveDoc.Objects.Add(obj, attr)
            elif type(obj) == Rhino.Geometry.Circle:
                id = Rhino.RhinoDoc.ActiveDoc.Objects.AddCircle(obj, attr)
            elif type(obj) == Rhino.Geometry.Extrusion:
                id = Rhino.RhinoDoc.ActiveDoc.Objects.AddExtrusion(obj, attr)
            elif type(obj) == Rhino.Geometry.Line:
                id = Rhino.RhinoDoc.ActiveDoc.Objects.AddLine(obj, attr)
            elif type(obj) == Rhino.Geometry.Plane:
                id = Rhino.RhinoDoc.ActiveDoc.Objects.AddPoint(obj.Origin, attr)
            elif type(obj) == Rhino.Geometry.Point3d:
                id = Rhino.RhinoDoc.ActiveDoc.Objects.AddPoint(obj, attr)
            elif type(obj) == Rhino.Geometry.Polyline:
                id = Rhino.RhinoDoc.ActiveDoc.Objects.AddPolyline(obj, attr)
            elif type(obj) == Rhino.Geometry.Sphere:
                id = Rhino.RhinoDoc.ActiveDoc.Objects.AddSphere(obj, attr)
            elif type(obj) == Rhino.Geometry.TextEntity:
                id = Rhino.RhinoDoc.ActiveDoc.Objects.AddText(obj, attr)
            else:
                #del geometryToBakeL
                print "######## no valid type has been found for particular item in \"geometryToBakeL\""
                print "type(obj): ", type(obj)
                return None  # no valid type has been found for particular item in "geometryToBakeL"
            geometryIds.append(id)
        
        del geometryToBakeL
        return geometryIds
    
    
    def groupGeometry(self, groupName, geometryIds):
        """
        group the rhino geometry based on rhino ids
        """
        groupIndex = Rhino.RhinoDoc.ActiveDoc.Groups.Add(groupName + "_" + str(time.time()))
        Rhino.RhinoDoc.ActiveDoc.Groups.AddToGroup(groupIndex, geometryIds)
        del geometryIds
        return groupIndex


class CreateGeometry():
    """
    methods which create some sort of geometry
    """
    def calculateMeshFaceAreas(self, mesh):
        """
        calculate each mesh face area
        """
        def triangleMeshFaceArea(A,B,C):
            # Heron's formula
            a = A.DistanceTo(B)
            b = B.DistanceTo(C)
            c = A.DistanceTo(C)
            s = (a+b+c)/2  # triangle semiperimeter
            triangleMeshFaceArea = math.sqrt(s * (s - a) * (s - b) * (s - c))
            
            return triangleMeshFaceArea
        
        meshFaces = mesh.Faces
        meshVertices = mesh.Vertices
        meshFaceAreas = []
        for mFace in meshFaces:
            if mFace.IsTriangle:
                triangleMeshFaceArea1 = triangleMeshFaceArea(meshVertices[mFace.A], meshVertices[mFace.B], meshVertices[mFace.C])
                triangleMeshFaceArea2 = 0 
            elif mFace.IsQuad:
                d1 = meshVertices[mFace.A].DistanceTo(meshVertices[mFace.C])
                d2 = meshVertices[mFace.B].DistanceTo(meshVertices[mFace.D])
                if d1 > d2:
                    triangleMeshFaceArea1 = triangleMeshFaceArea(meshVertices[mFace.D], meshVertices[mFace.A], meshVertices[mFace.B])
                    triangleMeshFaceArea2 = triangleMeshFaceArea(meshVertices[mFace.D], meshVertices[mFace.B], meshVertices[mFace.C])
                else:
                    triangleMeshFaceArea1 = triangleMeshFaceArea(meshVertices[mFace.A], meshVertices[mFace.B], meshVertices[mFace.C])
                    triangleMeshFaceArea2 = triangleMeshFaceArea(meshVertices[mFace.A], meshVertices[mFace.C], meshVertices[mFace.D])
            meshFaceAreas.append(triangleMeshFaceArea1+triangleMeshFaceArea2)
        
        return meshFaceAreas
    
    
    def meshFromPoints(self, u, v, pts, meshColors=None):
        """
        create a mesh from a grid of points
        """
        mesh = Rhino.Geometry.Mesh()
        if (meshColors == None) or (len(meshColors) == 0):
            for pt in pts:
                mesh.Vertices.Add(pt)
        else:
            for i,pt in enumerate(pts):
                mesh.Vertices.Add(pt)
                mesh.VertexColors.Add(meshColors[i])
        for i in xrange(1,u):
            for k in xrange(1,v):
                mesh.Faces.AddFace(k-1+(i-1)*v, k-1+i*v, k-1+i*v+1, k-1+(i-1)*v+1)
        
        return mesh
    
    
    def colorMeshVertices(self, mesh, colors):
        """
        color the vertices of a mesh in-place!
        """
        mesh_numOfVertices = mesh.Vertices.Count
        mesh.VertexColors.Clear()
        #for i in range(len(mesh_numOfVertices)):
        for i in range(mesh_numOfVertices):
            mesh.VertexColors.Add(colors[i])
        
        del colors
        return mesh  # colored mesh
    
    
    def createLegend(self, geometryL, values, legendBakePar, legendUnit=None):
        """
        create a legend for the given "values"
        """
        # read the "legendBakePar_"
        myGismo_preparation = Preparation()
        legendStyle, legendPlane, maxValue, minValue, customColors, numLegendCells, fontName, fontSize, numDecimals, customLegendUnit, customTitle, scale, layerName, layerColor, layerCategoryName = myGismo_preparation.read_legendBakePar(legendBakePar)
        
        if (len(customColors) == 0):
            customColors = myGismo_preparation.defaultCustomColors()
        
        if (customLegendUnit == None) and (legendUnit == None):
            # nothing inputted into "legendUnit_" input of "Legend Bake Parameter" component. And no "legendUnit" has been supplied to this method
            legendUnit = "unknown unit"
        elif (customLegendUnit != None):
            # something inputted into "legendUnit_" input of "Legend Bake Parameter" component
            legendUnit = customLegendUnit
        
        if sum(values) == (len(values)*values[0]):
            # # all items in "values" are the same: meaning all colors will be the same. Set the "numLegendCells" to 1
            numLegendCells = 1
        
        
        # calculate bounding box properties from the "geometryL"
        bb_volume, bb_centroid, bb_length, bb_depth, bb_height, bb_bottomLeftCorner, bb_bottomRightCorner, bb_topRightCorner, bb_topLeftCorner = myGismo_preparation.boundingBox_properties(geometryL, accurate=True)
        
        # cell size, text size
        legendCellWidth = bb_length/10 * scale
        legendCellHeight = legendCellWidth * 0.75
        if (fontSize == None):
            cellNumber_textSize = legendCellWidth/3.5
        else:
            # something inputted to "fontSize_"
            cellNumber_textSize = fontSize
        
        # cellNumbers, cellColors
        valuesMin = min(values)
        valuesMax = max(values)
        if numLegendCells == 1:
            # fix for "Attempted to divide by zero" error
            step = (valuesMax-valuesMin)/1
        else:
            step = (valuesMax-valuesMin)/(numLegendCells-1)
        cellNumbers = []
        for i in range(numLegendCells):
            cellNumber = valuesMin + i*step
            cellNumbers.append(cellNumber)
        
        cellColors = myGismo_preparation.numberToColor(cellNumbers, customColors, minValue, maxValue)
        
        # create the bottom cell
        legendStartPt = Rhino.Geometry.Point3d(bb_bottomRightCorner)
        legendStartPlane = Rhino.Geometry.Plane(legendStartPt, Rhino.Geometry.Vector3d(0,0,1))
        
        bottomCellStartPt = Rhino.Geometry.Point3d(legendStartPt.X + (bb_depth * 0.1), legendStartPt.Y, legendStartPt.Z)
        bottomCellStartPlane = Rhino.Geometry.Plane(bottomCellStartPt, Rhino.Geometry.Vector3d(0,0,1))
        
        bottomCell = Rhino.Geometry.Rectangle3d(bottomCellStartPlane, legendCellWidth, legendCellHeight).ToNurbsCurve()
        if (legendStyle == 0):
            # rectangular cells
            degree = 3
        elif (legendStyle == 1) or (legendStyle == 2) or (legendStyle == 3):
            bottomCell.Domain = Rhino.Geometry.Interval(0,1)
            if (legendStyle == 1):
                # filleted cells
                tL = [0, 0.05, 0.20, 0.25, 0.35, 0.40, 0.5, 0.55, 0.7, 0.75, 0.85, 0.90, 1.0]
                degree = 3
            elif(legendStyle == 2):
                # elliptical cells
                tL = [0.125, 0.375, 0.625, 0.875, 0.125]
                degree = 3
                curveKnotStyle = Rhino.Geometry.CurveKnotStyle.UniformPeriodic
            elif(legendStyle == 3):
                # rhombus cells
                tL = [0.125, 0.375, 0.625, 0.875, 0.125]
            
            interpolateCrv_pts = []
            for t in tL:
                pt = bottomCell.PointAt(t)
                interpolateCrv_pts.append(pt)
            
            if(legendStyle == 2):
                bottomCell = Rhino.Geometry.Curve.CreateInterpolatedCurve(interpolateCrv_pts, degree, curveKnotStyle)
            elif(legendStyle == 3):
                bottomCell = Rhino.Geometry.Polyline(interpolateCrv_pts).ToNurbsCurve()
            else:
                bottomCell = Rhino.Geometry.Curve.CreateControlPointCurve(interpolateCrv_pts, degree)
        
        
        # create the legend
        myGismo_geometry = CreateGeometry()
        meshParam = Rhino.Geometry.MeshingParameters()
        meshParam.SimplePlanes = True
        legendCells_joinedMesh = Rhino.Geometry.Mesh()
        cellNumber_joinedMesh = Rhino.Geometry.Mesh()
        
        cellNumber_startPts = []
        for i in range(numLegendCells):
            transformMatrix = Rhino.Geometry.Transform.Translation(0,legendCellHeight,0)
            copied_bottomCell = bottomCell.Duplicate()
            moveSuccess = copied_bottomCell.Translate(0,i*legendCellHeight,0)
            
            # create the mesh cell
            copied_bottomCell_srf = Rhino.Geometry.Brep.CreatePlanarBreps([copied_bottomCell])[0]
            copied_bottomCell_mesh = Rhino.Geometry.Mesh.CreateFromBrep(copied_bottomCell_srf, meshParam)[0]
            legendCells_mesh_colors = [cellColors[i]] * copied_bottomCell_mesh.Vertices.Count
            copied_bottomCell_mesh_colored = myGismo_geometry.colorMeshVertices(copied_bottomCell_mesh, legendCells_mesh_colors)
            legendCells_joinedMesh.Append(copied_bottomCell_mesh_colored)
            
            # create the cell number start point
            cellNumber_startPt = Rhino.Geometry.Point3d(bottomCellStartPt.X + legendCellWidth*1.2, bottomCellStartPt.Y + i*legendCellHeight, bottomCellStartPt.Z)
            cellNumber_startPts.append(cellNumber_startPt)
            
            # create cellNumber_joinedMesh
            cellNumber_string = cellNumbers[i]
            if (numDecimals == 0):
                cellNumber_string = "%0.0f" % cellNumber_string
            elif (numDecimals == 1):
                cellNumber_string = "%0.1f" % cellNumber_string
            elif (numDecimals == 2):
                cellNumber_string = "%0.2f" % cellNumber_string
            elif (numDecimals == 3):
                cellNumber_string = "%0.3f" % cellNumber_string
            elif (numDecimals == 4):
                cellNumber_string = "%0.4f" % cellNumber_string
            elif (numDecimals == 5):
                cellNumber_string = "%0.5f" % cellNumber_string
            elif (numDecimals == 6):
                cellNumber_string = "%0.6f" % cellNumber_string
            cellNumber_mesh = myGismo_preparation.text2srfOrMesh("mesh", [cellNumber_string], cellNumber_startPt, cellNumber_textSize, fontName, bold=False, italic=False, justificationIndex=0)
            cellNumber_joinedMesh.Append(cellNumber_mesh)
        
        legendUnits_startPt = Rhino.Geometry.Point3d(cellNumber_startPts[-1].X, cellNumber_startPts[-1].Y + legendCellHeight, cellNumber_startPts[-1].Z)
        legendUnits_mesh = myGismo_preparation.text2srfOrMesh("mesh", [legendUnit], legendUnits_startPt, cellNumber_textSize, fontName, bold=False, italic=False, justificationIndex=0)
        
        # join cells and text into a single mesh
        legend_allMeshes_joined = Rhino.Geometry.Mesh()
        legend_allMeshes_joined.Append(legendCells_joinedMesh)
        legend_allMeshes_joined.Append(cellNumber_joinedMesh)
        legend_allMeshes_joined.Append(legendUnits_mesh)
        
        
        # orient the whole legend in case "legendPlane_" has been defined
        if (legendPlane != None):
            transformMatrix = Rhino.Geometry.Transform.PlaneToPlane(legendStartPlane, legendPlane)
            transformSuccess = legend_allMeshes_joined.Transform(transformMatrix)
            return legend_allMeshes_joined, legendPlane
        else:
            return legend_allMeshes_joined, legendStartPlane
    
    
    def compassDirections(self, originPt, radius, scale, northVec, textSize=None):
        """
        create compass directions curves and labels for 30 degrees increment
        """
        # create circles
        myPreparation = Preparation()
        unitConversionFactor, unitSystem = myPreparation.checkUnits()
        
        circleRadius = scale * (radius/unitConversionFactor)  # 200 meters is fixed radius
        originPt_plane = Rhino.Geometry.Plane(originPt, Rhino.Geometry.Vector3d(0,1,0), Rhino.Geometry.Vector3d(1,0,0))
        
        # rotate originPt_plane for northVec
        angleR = Rhino.Geometry.Vector3d.VectorAngle( Rhino.Geometry.Vector3d(0,1,0), northVec, Rhino.Geometry.Plane(originPt, Rhino.Geometry.Vector3d(0,0,-1)) )
        rotateSuccess = originPt_plane.Rotate(angleR, Rhino.Geometry.Vector3d(0,0,-1))
        
        circle = Rhino.Geometry.Circle(originPt_plane, circleRadius).ToNurbsCurve()
        circle2 = Rhino.Geometry.Circle(originPt, 1.05*circleRadius).ToNurbsCurve()
        circle3 = Rhino.Geometry.Circle(originPt, 1.07*circleRadius).ToNurbsCurve()
        
        # divide circle
        numOfDiv = 12  # divide 360 by 30 degrees increments
        includeEnds = True
        divisionParameters = circle.DivideByCount(numOfDiv, includeEnds)
        
        divisionPts = []
        moveVectors = []  # vectors for moving the 0,30,60... labels
        justificationIndexL = []
        for t in divisionParameters:
            pt = circle.PointAt(t)
            divisionPts.append(pt)
            moveVec = pt - originPt
            moveVectors.append(moveVec)
            
            angleR2 = Rhino.Geometry.Vector3d.VectorAngle( Rhino.Geometry.Vector3d(0,1,0), moveVec, Rhino.Geometry.Plane(originPt, Rhino.Geometry.Vector3d(0,0,-1)) )
            # determine justificationIndex
            if (math.degrees(angleR2) == 0) or (math.degrees(angleR2) == 360):
                justificationIndex = 1
            elif (math.degrees(angleR2) > 0) and (math.degrees(angleR2) < 90):
                justificationIndex = 0
            elif (math.degrees(angleR2) == 90):
                justificationIndex = 3
            elif (math.degrees(angleR2) > 90) and (math.degrees(angleR2) < 180):
                justificationIndex = 6
            elif (math.degrees(angleR2) == 180):
                justificationIndex = 7
            elif (math.degrees(angleR2) > 180) and (math.degrees(angleR2) < 270):
                justificationIndex = 8
            elif (math.degrees(angleR2) == 270):
                justificationIndex = 5
            elif (math.degrees(angleR2) > 270) and (math.degrees(angleR2) < 360):
                justificationIndex = 2
            
            justificationIndexL.append(justificationIndex)
        
        # create lines, textLabels
        textL = ["N", 30, 60, "E", 120, 150, "S", 210, 240, "W", 300, 330]
        
        if (textSize == None):
            # no textSize defined
            textSizeL = [circleRadius/20, circleRadius/24, circleRadius/24, circleRadius/20, circleRadius/24, circleRadius/24, circleRadius/20, circleRadius/24, circleRadius/24, circleRadius/20, circleRadius/24, circleRadius/24]
        else:
            # textSize defined
            textSizeL = [textSize, textSize/1.2, textSize/1.2, textSize, textSize/1.2, textSize/1.2, textSize, textSize/1.2, textSize/1.2, textSize, textSize/1.2, textSize/1.2]
        
        fontName = "Verdana"
        bold = True
        italic = False
        
        lines = []
        textLabels = []
        for i,pt in enumerate(divisionPts):
            line = Rhino.Geometry.Line(pt, pt + 0.1*moveVectors[i]).ToNurbsCurve()
            lines.append(line)
            textLabel = myPreparation.text2srfOrMesh("mesh", [textL[i]], pt + 0.11*moveVectors[i], textSizeL[i], fontName, bold, italic, justificationIndexL[i])
            textLabels.append(textLabel)
        
        compassCrvs = [circle, circle2, circle3] + lines
        
        return divisionPts, compassCrvs, textLabels
    
    
    def liftingOSMshapes_from_groundTerrain(self, shapesL, groundBrep_singleBrepFace, height, minHeight=None, bottomCrvControlPt_highestZcoord=None):
        """
        projecting OSM shapes to groundTerrain_ and then lifting them to a plane for height or minHeight above the highest shape point
        """
        topCrvs = []
        tol = Rhino.RhinoDoc.ActiveDoc.ModelAbsoluteTolerance
        for shapeIndex, shape in enumerate(shapesL):
            if (groundBrep_singleBrepFace == None):
                projectionPlane = Rhino.Geometry.Plane(Rhino.Geometry.Point3d(0,0,shape.PointAtStart.Z), Rhino.Geometry.Vector3d(0,0,1))  # it always be constant because each shapesL has a constant height (coming from "OSM shapes" component)
                projectedShapeCrvs = [Rhino.Geometry.Curve.ProjectToPlane(shape, projectionPlane)]
            elif (groundBrep_singleBrepFace != None):
                projectionDirection = Rhino.Geometry.Vector3d(0,0,1)  # it can be projectionDirection = Rhino.Geometry.Vector3d(0,0,-1) as well, does not matter
                projectedShapeCrvs = Rhino.Geometry.Curve.ProjectToBrep(shape, groundBrep_singleBrepFace, projectionDirection, tol)
            
            if len(projectedShapeCrvs) == 0:  # the shape is located outside of the "groundTerrain_" ("if groundTerrain_" inputted. If "groundTerrain_" not inputted, len(projectedShapeCrvs) will never be equal to 0)
                topCrvPts = []
                #topCrvs = []  # its already defined at the start of this method, so an empty list will be returned
            elif len(projectedShapeCrvs) != 0:
                #joinedProjectedShapeCrvs = Rhino.Geometry.Curve.JoinCurves(projectedShapeCrvs, tol)
                if (not shape.IsClosed):
                    # shape is not closed (probably shapeType = 1), so there is no need to lift it, as it will not be extruded
                    topCrvs.extend(projectedShapeCrvs)
                    bottomCrvControlPt_highestZcoord = projectedShapeCrvs[0].PointAtStart.Z
                elif shape.IsClosed:
                    # shape is closed (shapeType = 0)
                    projectedShapeCrv = projectedShapeCrvs[0]  # always take the first curve from the list of shapes projected curves
                    if (not projectedShapeCrv.IsClosed):
                        # the projected shape is not a closed curve anymore (it was before the projection). This happens when shape intersects with the "groundTerrain_" bounding box
                        line = Rhino.Geometry.Line(projectedShapeCrv.PointAtStart, projectedShapeCrv.PointAtEnd).ToNurbsCurve()
                        joinedPolyCrv = Rhino.Geometry.Curve.JoinCurves([projectedShapeCrv,line], tol)[0]
                        bottomCrv = joinedPolyCrv.ToNurbsCurve()
                    else:
                        # the projected shape is still a closed curve (and it was before the projection)
                        bottomCrv = projectedShapeCrv.ToNurbsCurve()
                    
                    # find the highest Z coordinate of the shape edit points
                    bottomCrvControlPts = bottomCrv.GrevillePoints()
                    
                    if (bottomCrvControlPt_highestZcoord == None):  # it may != None for shapes which are included in other building shapes (like shapes which have valid "building:part" key)
                        if shapeIndex == 0:  # this is a fix in case the "shapesL" has more than one shape. If it does then their topCrv can be created to different Z coordinate, and therefor not being able to be capped together with other topCrv from the same "shapeL".
                            bottomCrvControlPt_highestZcoord = -10000  # dummy value
                            for bottomCrvControlPt in bottomCrvControlPts:
                                if bottomCrvControlPt.Z > bottomCrvControlPt_highestZcoord:
                                    bottomCrvControlPt_highestZcoord = bottomCrvControlPt.Z
                    
                    # move the shape edit points upwards for: bottomCrvControlPt_highestZcoord + minHeight/height, in order to create the topCrv
                    topCrvPts = []
                    for bottomCrvControlPt in bottomCrvControlPts:
                        if minHeight != "":
                            # there is a valid "min_height" key. Lift the projected points for this value
                            topCrvPt = Rhino.Geometry.Point3d(bottomCrvControlPt.X, bottomCrvControlPt.Y, bottomCrvControlPt_highestZcoord + height)
                            #topCrvPt = Rhino.Geometry.Point3d(bottomCrvControlPt.X, bottomCrvControlPt.Y, bottomCrvControlPt_highestZcoord + minHeight)
                            #topCrvPt = Rhino.Geometry.Point3d(bottomCrvControlPt.X, bottomCrvControlPt.Y, bottomCrvControlPt_highestZcoord + minHeight + height)
                        else:
                            # there is no valid "min_height" key. Lift the projected points for the "height" value
                            topCrvPt = Rhino.Geometry.Point3d(bottomCrvControlPt.X, bottomCrvControlPt.Y, bottomCrvControlPt_highestZcoord + height)
                        topCrvPts.append(topCrvPt)
                    topCrv = Rhino.Geometry.Polyline(topCrvPts).ToNurbsCurve()
                    topCrvs.append(topCrv)
        
        del shapesL
        del groundBrep_singleBrepFace
        del topCrvPts
        
        return topCrvs, bottomCrvControlPt_highestZcoord
    
    
    def createRenderMesh(self, mesh, u):
        """
        create render mesh and its texture image (material diffuse map file).
        the code of this method is entirely based on VB.NET components by Vicente Soler:
        http://www.grasshopper3d.com/xn/detail/2985220:Comment:663243
        """
        mesh.Unweld(0, False)
        
        dt = []
        c = mesh.Faces.Count
        for i in range(c - 1+1):
            sub_dt = []
            f = mesh.Faces[i]
            color1 = mesh.VertexColors[f.A]
            color2 = mesh.VertexColors[f.B]
            color3 = mesh.VertexColors[f.C]
            color4 = mesh.VertexColors[f.D]
            sub_dt.append(System.Drawing.Color.FromArgb(color1.R, color1.G, color1.B))
            sub_dt.append(System.Drawing.Color.FromArgb(color2.R, color2.G, color2.B))
            sub_dt.append(System.Drawing.Color.FromArgb(color3.R, color3.G, color3.B))
            sub_dt.append(System.Drawing.Color.FromArgb(color4.R, color4.G, color4.B))
            dt.append(sub_dt)
        
        mesh.TextureCoordinates.Clear()
        for i in range(mesh.Vertices.Count):
            mesh.TextureCoordinates.Add(0,0)
        
        size = math.ceil(math.sqrt(c))
        count = -1
        
        for x in xrange(size - 1+1):
            for y in xrange(size - 1+1):
                count += 1
                if count < c - 1+1:
                    f = mesh.Faces[count]
                    sb = size * 2
                    mesh.TextureCoordinates[f.A] = Rhino.Geometry.Point2f((x * 2 + 0.5) / sb, (y * 2 + 0.5) / sb)
                    mesh.TextureCoordinates[f.B] = Rhino.Geometry.Point2f((x * 2 + 1.5) / sb, (y * 2 + 0.5) / sb)
                    mesh.TextureCoordinates[f.C] = Rhino.Geometry.Point2f((x * 2 + 1.5) / sb, (y * 2 + 1.5) / sb)
                    mesh.TextureCoordinates[f.D] = Rhino.Geometry.Point2f((x * 2 + 0.5) / sb, (y * 2 + 1.5) / sb)
        
        
        dt_length = len(dt)
        size = math.ceil(math.sqrt(dt_length))
        sb = size * 2 - 1
        bm = System.Drawing.Bitmap(size * 2, size * 2)
        bmb = System.Drawing.Bitmap(size * 4, size * 4)
        count = -1
        
        for x in xrange(size - 1+1):
            for y in xrange(size - 1+1):
                count += 1
                if count < dt_length - 1+1:
                    bm.SetPixel(x * 2 + 0, sb - (y * 2 + 0), dt[count][0])
                    bm.SetPixel(x * 2 + 1, sb - (y * 2 + 0), dt[count][1])
                    bm.SetPixel(x * 2 + 1, sb - (y * 2 + 1), dt[count][2])
                    bm.SetPixel(x * 2 + 0, sb - (y * 2 + 1), dt[count][3])
        
        g = System.Drawing.Graphics.FromImage(bmb)
        g.InterpolationMode = System.Drawing.Drawing2D.InterpolationMode.NearestNeighbor
        g.DrawImage(bm, 0, 0, size * 4 + 1, size * 4 + 1)
        bmb.Save(u)
        del dt
        
        return mesh


class EnvironmentalAnalysis():
    """
    various environmental analysis methods
    """
    def noLeavesPeriod(self, criteria, latitude, sunWindowQuadrantIndex, leaflessStartHOY=None, leaflessEndHOY=None):
        """
        calculate season(seasonIndex) of the sunWindow Quadrant
        """
        if criteria == "perQuadrant":
            if latitude > 0:  # northern hemisphere
                if sunWindowQuadrantIndex < 72:
                    seasonIndex = 0  # winter/autumn
                elif sunWindowQuadrantIndex >= 72:
                    seasonIndex = 1  # spring/summer
            elif latitude < 0:  # southern hemisphere
                if sunWindowQuadrantIndex < 72:
                    seasonIndex = 1  # spring/summer
                elif sunWindowQuadrantIndex >= 72:
                    seasonIndex = 0  # winter/autumn
        elif criteria == "perHoy":
            if leaflessStartHOY < leaflessEndHOY:
                if (sunWindowQuadrantIndex >= leaflessStartHOY) and (sunWindowQuadrantIndex <= leaflessEndHOY):
                    seasonIndex = 0  # leafless period
                else:
                    seasonIndex = 1  # inleaf period
            elif leaflessStartHOY > leaflessEndHOY:
                if (sunWindowQuadrantIndex >= leaflessStartHOY) or (sunWindowQuadrantIndex <= leaflessEndHOY):
                    seasonIndex = 0  # leafless period
                else:
                    seasonIndex = 1  # inleaf period
        
        return seasonIndex
    
    
    def calculateSkyExposureFactor(self, testPt, contextMeshes, latitude, radius, precision, treesTransmissionIndices=[0,[0,0]], leaflessStartHOY=None, leaflessEndHOY=None):
        """
        calculate sky exposure factor
        """
        # lifting up the testPt due to MeshRay intersection
        tol = Rhino.RhinoDoc.ActiveDoc.ModelAbsoluteTolerance
        testPtLifted = Rhino.Geometry.Point3d(testPt.X, testPt.Y, testPt.Z+tol)
        gismo_geometry = CreateGeometry()
        
        precisionU = precision*5
        precisionV = int(precisionU/3.5)
        
        skyDomeHalfSphere = Rhino.Geometry.Sphere(Rhino.Geometry.Plane(Rhino.Geometry.Point3d(testPtLifted),Rhino.Geometry.Vector3d(0,0,1)), radius)
        splittedSkyDomeDomainUmin, splittedSkyDomeDomainUmax = [0, 2*math.pi]  # sphere diameter
        splittedSkyDomeDomainVmin, splittedSkyDomeDomainVmax = [0, 0.5*math.pi]  # sphere vertical arc
        splittedSkyDomeDomainVmax = 0.995*splittedSkyDomeDomainVmax
        
        stepU = (splittedSkyDomeDomainUmax - splittedSkyDomeDomainUmin)/precisionU
        stepV = (splittedSkyDomeDomainVmax - splittedSkyDomeDomainVmin)/precisionV
        
        skyDomePts = []
        for i in xrange(0,precisionU):
            for k in xrange(0,precisionV):
                u = splittedSkyDomeDomainUmin + stepU*i
                v = splittedSkyDomeDomainVmin + stepV*k
                skyDomePt = skyDomeHalfSphere.PointAt(u,v)
                skyDomePts.append(skyDomePt)
        skyDomeMeshPts = skyDomePts + skyDomePts[:precisionV]  # increases precisionU for 1
        skyDomeMesh = gismo_geometry.meshFromPoints(precisionU+1, precisionV, skyDomeMeshPts)
        meshFacesCentroids = [skyDomeMesh.Faces.GetFaceCenter(i) for i in xrange(skyDomeMesh.Faces.Count)]
        meshFaces = skyDomeMesh.Faces
        meshVertices = skyDomeMesh.Vertices
        
        meshFaceAreas = gismo_geometry.calculateMeshFaceAreas(skyDomeMesh)
        skyDomeMeshArea = sum(meshFaceAreas)
        skyDomeMeshArea2 = Rhino.Geometry.AreaMassProperties.Compute(skyDomeMesh).Area
        #print "skyDomeMeshArea: ", skyDomeMeshArea
        #print "skyDomeMeshArea2: ", skyDomeMeshArea2
        
        del skyDomeMeshPts
        del meshVertices
        del meshFaces
        del skyDomeMesh
        leaflessStartHOYdummy = 0; leaflessEndHOYdummy = 1
        skyExposureFactor = 0  # 0 equals to 100% shading, 1 equals to 0% shading
        for i,centroid in enumerate(meshFacesCentroids):
            raysIntensityWithoutTransmissionIndex = meshFaceAreas[i]/skyDomeMeshArea
            vector = Rhino.Geometry.Vector3d(centroid)-Rhino.Geometry.Vector3d(testPtLifted)
            ray = Rhino.Geometry.Ray3d(testPtLifted, vector)
            for meshIndex,mesh in enumerate(contextMeshes):
                intersectParam = Rhino.Geometry.Intersect.Intersection.MeshRay(mesh,ray)
                # ray hitted something
                if intersectParam >= 0:
                    seasonIndexDummy = self.noLeavesPeriod("perHoy", latitude, i, leaflessStartHOYdummy, leaflessEndHOYdummy)
                    if meshIndex == 0:  # context mesh hitted
                        treesTransmissionIndex = 0
                    elif meshIndex == 1:  # coniferousTrees mesh hitted
                        treesTransmissionIndex = treesTransmissionIndices[0]
                    elif meshIndex == 2:  # deciduousTrees mesh hitted
                        treesTransmissionIndex = treesTransmissionIndices[1][seasonIndexDummy]
                    skyExposureFactor += raysIntensityWithoutTransmissionIndex*treesTransmissionIndex
                    break
            # no hitting, the ray only hits the sky dome
            else:
                treesTransmissionIndex = 1
                skyExposureFactor += raysIntensityWithoutTransmissionIndex * treesTransmissionIndex
        
        del meshFacesCentroids
        
        return skyExposureFactor


class OSM():
    """
    methods for manipulation of OSM data
    """
    def calculateCRS_UTMzone(self, locationLatitudeD, locationLongitudeD):
        # calculate CRS data: CRS_UTMzone, northOrsouth
        # by http://stackoverflow.com/a/9188972/3137724 (link given by Even Rouault)
        CRS_UTMzone = (math.floor((locationLongitudeD + 180)/6) % 60) + 1
        if locationLatitudeD >= 0:
            # for northern hemisphere
            northOrsouth = "north"
        elif locationLatitudeD < 0:
            # for southern hemisphere
            northOrsouth = "south"
        
        return int(CRS_UTMzone), northOrsouth
    
    
    def UTM_CRS_from_latitude(self, locationLatitudeD, locationLongitudeD, originLatitudeD = 0, originLongitudeD = 0):
        """
        create UTM CRS from latitude, longitude and anchor latitude, anchor longitude
        """
        CRS = MapWinGIS.GeoProjectionClass()
        CRS_UTMzone, northOrsouth = self.calculateCRS_UTMzone(locationLatitudeD, locationLongitudeD)
        proj4_string = "+proj=utm +zone=%s +%s +datum=WGS84 +ellps=WGS84 +lat_0=%s +lon_0=%s" % (CRS_UTMzone, northOrsouth, originLatitudeD, originLongitudeD)#, resamplingMethod)
        CRS.ImportFromProj4(proj4_string)
        
        return CRS
    
    
    def CRS_from_EPSGcode(self, EPSGcode):
        """
        create CRS from EPSG code
        """
        CRS = MapWinGIS.GeoProjectionClass()
        CRS.ImportFromEPSG(EPSGcode)
        
        return CRS
    
    
    def convertBetweenTwoCRS(self, inputCRS, outputCRS, firstCoordinate, secondCoordinate):
        
        """
        shapefile = MapWinGIS.ShapefileClass()
        openShapefileSuccess = MapWinGIS.ShapefileClass.Open(shapefile, shapeFile_filePath, None)
        if openShapefileSuccess:
            pass
        """
        #print "__inputCRS_EPSG: ", inputCRS_EPSG
        # set the input CRS
        #inputCRS = MapWinGIS.GeoProjectionClass()
        #MapWinGIS.GeoProjectionClass.ImportFromEPSG(inputCRS, inputCRS_EPSG)
        #inputCRS.ImportFromEPSG(inputCRS_EPSG)
        
        # set the output CRS
        #outputCRS = MapWinGIS.GeoProjectionClass()
        #outputCRS.ImportFromEPSG(outputCRS_EPSG)
        
        successStartTransform = inputCRS.StartTransform(outputCRS)
        
        secondCoordinate_ref = clr.StrongBox[System.Double](secondCoordinate)
        firstCoordinate_ref = clr.StrongBox[System.Double](firstCoordinate)
        successTransform = MapWinGIS.GeoProjectionClass.Transform(inputCRS, firstCoordinate_ref, secondCoordinate_ref)
        
        inputCRS.StopTransform()
        
        originPtProjected = Rhino.Geometry.Point3d(firstCoordinate_ref.Value, secondCoordinate_ref.Value, 0)
        
        return originPtProjected
    
    
    def projectedLocationCoordinates(self, locationLatitudeD, locationLongitudeD):
        """
        convert latitude,longitude coordinates to x,y projected coordinates
        """
        # by http://stackoverflow.com/a/9188972/3137724 (link given by Even Rouault)
        outputCRS_UTMzone = (math.floor((locationLongitudeD + 180)/6) % 60) + 1
        if locationLatitudeD >= 0:
            # for northern hemisphere
            outputCRS_EPSG = 32600 + outputCRS_UTMzone
        elif locationLatitudeD < 0:
            # for southern hemisphere
            outputCRS_EPSG = 32700 + outputCRS_UTMzone
        
        # set the CRS to WGS 84
        inputCRS = MapWinGIS.GeoProjectionClass()
        inputCRS_EPSG = 4326  # WGS 84
        inputCRS.ImportFromEPSG(inputCRS_EPSG)
        
        # set the output CRS
        outputCRS = MapWinGIS.GeoProjectionClass()
        outputCRS.ImportFromEPSG(outputCRS_EPSG)
        
        successStartTransform = inputCRS.StartTransform(outputCRS)
        
        locationLatitudeD_ref = clr.StrongBox[System.Double](locationLatitudeD)
        locationLongitudeD_ref = clr.StrongBox[System.Double](locationLongitudeD)
        successTransform = MapWinGIS.GeoProjectionClass.Transform(inputCRS, locationLongitudeD_ref, locationLatitudeD_ref)
        
        inputCRS.StopTransform()
        
        originPtProjected = Rhino.Geometry.Point3d(locationLongitudeD_ref.Value, locationLatitudeD_ref.Value, 0)
        
        return originPtProjected
    
    
    def projectedLocationCoordinates2(locationLatitudeD, locationLongitudeD, unitConversionFactor):
        """
        convert latitude,longitude coordinates to x,y projected coordinates2
        this method should be replaced with upper "projectedLocationCoordinates" but only for 4.9.4? > versions of MapWinGIS
        """
        
        # by http://stackoverflow.com/a/9188972/3137724 (link given by Even Rouault)
        outputCRS_UTMzone = (math.floor((locationLongitudeD + 180)/6) % 60) + 1
        if locationLatitudeD >= 0:
            # for northern hemisphere
            outputCRS_EPSG = 32600 + outputCRS_UTMzone
        elif locationLatitudeD < 0:
            # for southern hemisphere
            outputCRS_EPSG = 32700 + outputCRS_UTMzone
        
        # create a dummy point with locationLatitudeD, locationLongitudeD coordinates
        dummyShape = MapWinGIS.ShapeClass()
        dummyShape.ShapeType = MapWinGIS.ShpfileType.SHP_POINT
        dummyShape.AddPoint(locationLongitudeD, locationLatitudeD)
        
        # insert a dummy point to the dummyShapefile
        dummyShapefile = MapWinGIS.ShapefileClass()
        openShapefileSuccess2 = MapWinGIS.ShapefileClass.CreateNew(dummyShapefile, "", MapWinGIS.ShpfileType.SHP_POINT)
        shapeIndex2 = clr.StrongBox[System.Int32]()
        success = dummyShapefile.EditInsertShape(dummyShape, shapeIndex2)
        
        # a single field needs to be defined due to inserting of "dummyShape"
        fieldName = "5"  # dummy name
        fieldType = MapWinGIS.FieldType.INTEGER_FIELD
        fieldPrecision = 1
        fieldWidth = 1
        success2 = dummyShapefile.EditAddField(fieldName, fieldType, fieldPrecision, fieldWidth)
        
        # set the CRS of dummyShapefile to WGS 84
        inputCRS = MapWinGIS.GeoProjectionClass()
        inputCRS_EPSG = 4326  # WGS 84
        inputCRS.ImportFromEPSG(inputCRS_EPSG)
        dummyShapefile.GeoProjection = inputCRS
        
        shapeFileFolderPath = "C:\\gismo\\shapefile_example2"
        if not os.path.exists(shapeFileFolderPath):
            os.makedirs(shapeFileFolderPath)
        shapefileFilePath = shapeFileFolderPath + "\\dummyShapefile_%s.shp" % str(time.time())
        success = MapWinGIS.ShapefileClass.SaveAs(dummyShapefile, shapefileFilePath, None)
        dummyShapefile.Close()
        
        # dummyShapefile2 = dummyShapefile
        dummyShapefile2 = MapWinGIS.ShapefileClass()
        openShapefileSuccess = MapWinGIS.ShapefileClass.Open(dummyShapefile2, shapefileFilePath, None)
        
        # reproject the dummyShapefile2
        outputCRS2 = MapWinGIS.GeoProjectionClass()
        outputCRS2.ImportFromEPSG(outputCRS_EPSG)
        numOfsuccessfullyReprojectedShapes = clr.StrongBox[System.Int32]()
        reprojectedShapefile = MapWinGIS.ShapefileClass.Reproject(dummyShapefile2, outputCRS2, numOfsuccessfullyReprojectedShapes)
        if reprojectedShapefile == None:
            reprojectErrorMsg2 = dummyShapefile2.ErrorMsg(dummyShapefile2.LastErrorCode)
            print "reprojectErrorMsg2: ", reprojectErrorMsg2
        dummyShapefile2.Close()
        
        # delete the dummyShapefile_timetime().shp files and whole its folder
        try:
            shutil.rmtree(shapeFileFolderPath)
        except:
            pass
        
        for i in range(reprojectedShapefile.NumShapes):
            shape = reprojectedShapefile.Shape[i]
            for k in range(shape.numPoints):
                pt = shape.Point[k]
                longitudeProjectedMeters = pt.x
                latitudeProjectedMeters = pt.y
                originPtProjected = Rhino.Geometry.Point3d(longitudeProjectedMeters/unitConversionFactor, latitudeProjectedMeters/unitConversionFactor, 0)  # in Rhino document units
         
        return originPtProjected
    
    
    def filterShapes(self, shortenedName_keys, subValuesL, shapesL, osm_id_Only, osm_way_id_Only, osm_id_Remove, osm_way_id_Remove):
        """
        filter values and shapes for the four inputs from "OSM ids" component
        """
        value__osm_id = "^#-@"  # dummy value, in case for some unknown reason there is no "osm_id" key
        value__osm_way_id = "^#-@"  # dummy value, in case there is no "osm_way_id" key (shapeType = 1,2)
        for shortenedName_keysIndex, key in enumerate(shortenedName_keys):
            if key == "osm_id":
                value__osm_id = subValuesL[shortenedName_keysIndex]  # it will always be a string, not float, because shapefile keeps its values as strings
            if key == "osm_way_id":
                value__osm_way_id = subValuesL[shortenedName_keysIndex]  # it will always be a string, not float, because shapefile keeps its values as strings
        
        
        # removing shapes
        if value__osm_id in osm_id_Remove:
            return [], []
        elif value__osm_way_id in osm_way_id_Remove:
            return [], []
        
        # allowing this shapes
        if value__osm_id in osm_id_Only:
            return subValuesL, shapesL
        elif value__osm_way_id in osm_way_id_Only:
            return subValuesL, shapesL
        else:
            if (len(osm_id_Only) == 0) and (len(osm_way_id_Only) == 0):
                # "osm_id_Only" and "osm_way_id_Only" are empty. Use ALL shapes except ones whos "osm_id" and "osm_way_id" are defined in either "osm_id_Remove" and "osm_way_id_Remove"
                return subValuesL, shapesL
            else:
                # either "osm_id_Only" and "osm_way_id_Only" are NOT empty. Use ONLY those shapes whos "osm_id" and "osm_way_id" are defined in either "osm_id_Only" and "osm_way_id_Only"
                return [], []
    
    
    def requiredTag_dictionary(self):
        """
        tags for particular OSM objects
        """
        requiredKeyRequiredValue_dict = {
        """Post office""" : ["leisure", ("post_office",)],
        """Office administrative""" : ["office", ("administrative",)],
        """Office government""" : ["office", ("government",)],
        """Residential building""" : ["building", ("residential", "apartments", "terrace", "house", "detached")],
        """Hospital""" : ["amenity", ("hospital",)],
        """Ambulance station""" : ["emergency", ("ambulance_station",)],
        """Pharmacy""" : ["amenity", ("pharmacy",)],
        """Police""" : ["amenity", ("police",)],
        """Fire station""" : ["amenity", ("fire_station",)],
        """Museum""" : ["tourism", ("museum",)],
        """Theatre""" : ["amenity", ("theatre",)],
        """Library""" : ["amenity", ("library",)],
        """Book store""" : ["shop", ("books",)],
        """College""" : ["amenity", ("college",)],
        """University""" : ["amenity", ("university",)],
        """School""" : ["amenity", ("school",)],
        """Kindergarten""" : ["amenity", ("kindergarten",)],
        # -----------------
        """Playground""" : ["leisure", ("playground",)],
        """Sports center""" : ["leisure", ("sports_centre",)],
        """Stadium""" : ["leisure", ("stadium",)],
        """Park""" : ["leisure", ("park",)],
        """Garden""" : ["leisure", ("garden",)],
        """Camping site""" : ["tourism", ("camp_site",)],
        """Forest""" : ["landuse", ("forest",)],
        """Grassland""" : ["natural", ("grassland",)],
        # -----------------
        """Cafe""" : ["amenity", ("cafe",)],
        """Bar""" : ["amenity", ("bar",)],
        """Pub""" : ["amenity", ("pub",)],
        """Winery""" : ["craft", ("winery",)],
        """Restaurant""" : ["amenity", ("restaurant",)],
        """Supermarket""" : ["shop", ("supermarket",)],
        """Public market""" : ["amenity", ("marketplace",)],
        """Mall""" : ["shop", ("mall",)],
        """Hostel""" : ["tourism", ("hostel",)],
        """Hotel""" : ["tourism", ("hotel",)],
        """Casino""" : ["amenity", ("casino",)],
        # -----------------
        """Road""" : ["highway", ("road", "primary", "secondary", "tertiary", "unclassified", "residential", "service", "track", "junction", "trunk", "motorway", "motorway_link", "trunk_link", "primary_link", "secondary_link", "tertiary_link", "living_street", "bus_guideway", "escape")],
        """Railway""" : ["railway", ("rail", "tram", "light_rail", "subway", "narrow_gauge", "funicular")],
        """Footway""" : ["highway", ("footway",)],
        """Pedestrian zone""" : ["highway", ("pedestrian",)],
        """Aeroway""" : ["aeroway", ("aerodrome",)],
        """Bicycle parking""" : ["amenity", ("bicycle_parking",)],
        """Bicycle rental""" : ["amenity", ("bicycle_rental",)],
        """Fuel""" : ["amenity", ("fuel",)],
        """Parking""" : ["amenity", ("parking",)],
        """Garage""" : ["landuse", ("garages",)],
        """Subway entrance""" : ["railway", ("subway_entrance",)],
        # -----------------
        """Construction area""" : ["landuse", ("construction",)],
        """Archaeological site""" : ["historic", ("archaeological_site",)],
        """Fountain""" : ["amenity", ("fountain",)],
        """Wind turbine""" : ["generator:source", ("wind",)],
        """Plant""" : ["power", ("plant",)],
        """Nuclear reactor""" : ["generator:source", ("nuclear",)],
        # -----------------
        """Internet access""" : ["internet_access", ("^",)],  # "^" means there is no specific value for this key
        """Toilet""" : ["amenity", ("toilets",)],
        """Building""" : ["building", ("^",)],  # "^" means there is no specific value for this key
        """Tree""" : ["natural", ("tree",)]
        }
        
        return requiredKeyRequiredValue_dict


def raiseWarning(booleanValue, printMsg):
    if not booleanValue:
        level = Grasshopper.Kernel.GH_RuntimeMessageLevel.Warning
        print printMsg
        ghenv.Component.AddRuntimeMessage(level, printMsg)


# send classes to sticky
sc.sticky["gismo_check"] = Check()
sc.sticky["gismo_mainComponent"] = mainComponent
sc.sticky["gismo_Preparation"] = Preparation
sc.sticky["gismo_CreateGeometry"] = CreateGeometry
sc.sticky["gismo_EnvironmentalAnalysis"] = EnvironmentalAnalysis
sc.sticky["gismo_OSM"] = OSM
sc.sticky["gismo_mapwingisFolder"] = mapFolder_

# check gismoFolder
gismo_mainComponent = mainComponent()
gismoFolder, printMsg = gismo_mainComponent.gismoWorkingFolder(gismoFolder_)
raiseWarning(gismoFolder, printMsg)
sc.sticky["gismo_gismoFolder"] = gismoFolder

# check mapWinGIS
iteropMapWinGIS_dll_folderPath, gdalDataPath_folderPath, validInstallFolder, printMsg = gismo_mainComponent.mapWinGIS(mapFolder_)
raiseWarning(validInstallFolder, printMsg)

if gismoFolder and validInstallFolder:
    print "The Gismo penguin is peeping!! Gismo Gismo component is ran successfully!\n\ngismoFolder_: %s\nmapFolder_: %s" % (gismoFolder, iteropMapWinGIS_dll_folderPath)
if gismoFolder:
    sc.sticky["gismoGismo_released"] = ""  # mapWinGIS might not be used for all components, so validInstallFolder = True is not important for all components
    # online check of Gismo Gismo version from the github repository

# send the Gismo_Gismo component to the back
ghenv.Component.OnPingDocument().SelectAll()
ghenv.Component.Attributes.Selected = False
ghenv.Component.OnPingDocument().BringSelectionToTop()
ghenv.Component.OnPingDocument().DeselectAll()
# ---------- end gismo ----------
ladybug = Ladybug_Ladybug(defaultFolder="c:\ladybug")  # -> Vviiiiiiiiiizzz; plug-in component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

# ---- group: location
# inputs (location, radius)
panel = Panel("USA_Manhattan")
# Make sure that in Rhino's:
# Tools -> Options -> Units, you set the following:
# 
# Model units: Meters
# Absolute tolerance: 0.01
# Relative tolerance: 1.0
# Angle tolerance: 1.0
panel_2 = Panel("-74.010640")
createlocation = Gismo_CreateLocation(locationName=panel, latitude="40.703731", longitude=panel_2)  # -> location
# ---------- createlocation: Python ----------
# create location
#
# Gismo is a plugin for GIS environmental analysis (GPL) started by Djordje Spasic.
#
# This file is part of Gismo.
#
# Copyright (c) 2017, Djordje Spasic <djordjedspasic@gmail.com>
# Component icon based on free OSM icon from: <https://icons8.com/web-app/13398/osm>
#
# Gismo is free software: you can redistribute it and/or modify it under the terms of the GNU General Public License as published by the Free Software Foundation, either version 3 of the License, or (at your option) any later version.
#
# Gismo is distributed in the hope that it will be useful, but WITHOUT ANY WARRANTY; without even the implied warranty of MERCHANTABILITY or FITNESS FOR A PARTICULAR PURPOSE. See the GNU General Public License for more details.
#
# You should have received a copy of the GNU General Public License along with this program. If not, see http://www.gnu.org/licenses/.
#
# The GPL-3.0+ license <http://spdx.org/licenses/GPL-3.0+>

"""
Use this component to construct a location based on latitude, longitude coordinates.
-
Provided by Gismo 0.0.1

    input:
        locationName_: A name of the location.
                       -
                       If nothing added to this input, "unknown location" will be used as default locationName_.
        latitude_: Location's latitude coordinate.
                   It ranges from -90 for locations south of equator, to 90 for locations above the equator.
                   -
                   If nothing added to this input, "40" will be used as default latitude_.
        longitude_: Location's longitude coordinate.
                    It ranges from -180 for locations west of Prime Meridian, to 180 for locations east of Prime Meridian.
                    -
                    If nothing added to this input, "0" will be used as default longitude_.
    
    output:
        readMe!: ...
        location: Joined string containing information about location's components: locationName, latitude, longitude, timeZone and elevation.
                  timeZone and elevation are always set to "0" as they do not affect Gismo components.
        
"""

ghenv.Component.Name = "Gismo_Create Location"
ghenv.Component.NickName = "CreateLocation"
ghenv.Component.Message = "VER 0.0.1\nJAN_29_2017"
ghenv.Component.IconDisplayMode = ghenv.Component.IconDisplayMode.application
ghenv.Component.Category = "Gismo"
ghenv.Component.SubCategory = "0 | Gismo"
#compatibleGismoVersion = VER 0.0.1\nJAN_29_2017
try: ghenv.Component.AdditionalHelpFromDocStrings = "2"
except: pass

import scriptcontext as sc
import Grasshopper


def checkInputs(locationName, latitude, longitude):
    
    # check inputs
    if (locationName == None):
        location = None
        validInputData = False
        printMsg = "Please define the \"locationName_\" input."
        return location, validInputData, printMsg
    
    if (latitude == None):
        location = None
        validInputData = False
        printMsg = "Please define the \"latitude_\" input."
        return location, validInputData, printMsg
    elif (latitude < -90) or (latitude > 90):
        location = None
        validInputData = False
        printMsg = "\"latitude_\" input can not be larger than 90 nor smaller than -90."
        return location, validInputData, printMsg
    
    if (longitude == None):
        location = None
        validInputData = False
        printMsg = "Please define the \"latitude_\" input."
        return location, validInputData, printMsg
    elif (longitude < -180) or (longitude > 180):
        location = None
        validInputData = False
        printMsg = "\"longitude_\" input can not be larger than 180 nor smaller than -180."
        return location, validInputData, printMsg
    
    
    timeZone = 0; elevation = 0  # default. These two inputs are not important for OSM and terrain components
    
    location = "Site:Location,\n" + \
               "%s,\n" % locationName + \
               "%s,      !Latitude\n" % latitude + \
               "%s,     !Longitude\n" % longitude + \
               "%s,     !Time Zone\n" % timeZone + \
               "%s;       !Elevation" % elevation
    
    validInputData = True
    printMsg = "ok"
    return location, validInputData, printMsg

level = Grasshopper.Kernel.GH_RuntimeMessageLevel.Warning
location, validInputData, printMsg = checkInputs(locationName_, latitude_, longitude_)
if not validInputData:
    print printMsg
    ghenv.Component.AddRuntimeMessage(level, printMsg)
# ---------- end createlocation ----------

# ---- group: radius
panel_3 = Panel("300")

# ----
# 2d lines (streets, rivers...)
osmshapes = Gismo_OSMShapes(location=createlocation, radius=panel_3, shapeType="1", bakeIt=False, runIt=Toggle(False))  # -> readMe, shapes, keys, values, port, titleOriginPt, title; inputs radius: Int32, origin: Point3d, shapeType: Int32, requiredKeys: list, onlyRemove_Ids: tree, bakeIt: Boolean, runIt: Boolean
# ---------- osmshapes: Python ----------
# OSM shapes
#
# Gismo is a plugin for GIS environmental analysis (GPL) started by Djordje Spasic.
#
# This file is part of Gismo.
#
# Copyright (c) 2017, Djordje Spasic <djordjedspasic@gmail.com>
# with assistance of Paul Meems <bontepaarden@gmail.com>
# Component icon based on free OSM icon from: <https://icons8.com/web-app/13398/osm>
#
# Gismo is free software: you can redistribute it and/or modify it under the terms of the GNU General Public License as published by the Free Software Foundation, either version 3 of the License, or (at your option) any later version.
#
# Gismo is distributed in the hope that it will be useful, but WITHOUT ANY WARRANTY; without even the implied warranty of MERCHANTABILITY or FITNESS FOR A PARTICULAR PURPOSE. See the GNU General Public License for more details.
#
# You should have received a copy of the GNU General Public License along with this program. If not, see http://www.gnu.org/licenses/.
#
# The GPL-3.0+ license <http://spdx.org/licenses/GPL-3.0+>

"""
Use this component to generate Open Street Map shapes for the chosen _location and radius_.
OSM shapes represent linear or point map elements from openstreetmap.org service - the largest free map online service.
Linear OSM shapes include: buildings footprints, park footprints, roads axes, rivers, lake boundaries, and any other linear map element ...
Point OSM shapes include: trees, bus stations, restaurants, pubs, markets, address plates ...
-
Component requires that you are connected to the Internet, as it has to download osm data.
It also requires MapWinGIS application to be installed in order for it to work. Download the MapWinGIS from:
https://github.com/MapWindow/MapWinGIS/releases
If you are using Rhino 5 x86, then download the "Win32" version.
If you are using Rhino 5 x64, then download the "x64" version.
-
Provided by Gismo 0.0.1
    
    input:
        _location: Output from Gismo's \"Create Location\" component. This is essentially a text containing information (latitude, longitude, name...) about a location on the Earth.
        radius_: Horizontal distance to which the surrounding terrain will be taken into account.
                 -
                 It can not be shorter than 50 meters or longer than 20 000 meters.
                 -
                 The component itself might inform the user to alter the initial radius_ inputted by the user.
                 This is due to restriction of downloadable OSM data being limited to 0.5 latitude x 0.5 longitude range. If radius_ value for chosen location gets is equal to the mentioned range, or larger than it, the component will inform the user to shrink the radius_ for a certain amount.
                 -
                 If not supplied, default value of 100 meters will be used.
                 -
                 In meters.
        north_: Input a vector to be used as a true North direction, or a number between 0 and 360 that represents the clockwise degrees off from the Y-axis.
                -
                If not supplied, default North direction will be set to the Y-axis (0 degrees).
        origin_: Origin for the final "shapes" output.
                 -
                 If not supplied, default point of (0,0,0) will be used.
        shapeType_: There are four shape geometry types:
                    -
                    0 - polygons: anything consisted of closed polygons: buildings, grass areas, forests, lakes, etc
                    1 - polylines: non closed polylines as: streets, roads, highways, rivers, canals, train tracks ...
                    2 - points: any point features, like:
                               Trees, building entrances, junctions between roads ...
                               Store locations: restaurants, bars, pharmacies, post offices ...
                    -
                    If nothing supplied, 0 will be used as a default value (polygons).
        requiredKeys_: A list of specific OpenStreetMap keys that you would like to use for each "shapeType_" input.
                       -
                       There are thousands of OpenStreetMap keys describing various map elements. You can find them listed in here: www.taginfo.openstreetmap.org/keys
                       -
                       However due to their enormous number it is suggested that you use the "OSM keys" component, which will automatically generate specific keys for specific object type.
                       Either that, or simply leave this input empty. It that way the component will take only those keys which are attached to all shapeType_ shapes.
                       -
                       If not supplied, only those keys that appear at that particular "location_" and "radius_" will be used.
        onlyRemove_Ids_: Use this input to define lists of Open Street Map ids. "OSM ids" component will generate them.
                         -
                         These lists can be used to define:
                         1) only those ids which will be included (isolated) when "OSM shapes" component is ran (use "osm_id_Only" and "osm_way_id_Only" inputs for this).
                         2) ids which will be removed when "OSM shapes" component is ran (use "osm_id_Remove" and "osm_way_id_Remove" inputs for this).
                         3) you can combine 1) and 2) and both define the: included and removed ids.
                         -
                         If nothing supplied to this input, then no OSM ids will be isolated nor removed: meaning all of them will be included.
        bakeIt_: Set to "True" to bake the shapes geometry into the Rhino scene.
                 -
                 If not supplied default value "False" will be used.
        _runIt: ...
    
    output:
        readMe!: ...
        shapes: Geometry of each shape.
                -
                Depening on the shapeType_ input this can be either a polygon (shapeType_ = 0), a polyline (shapeType_ = 1) or a point (shapeType_ = 2)
        keys: Each upper shape contains certain information (keys) attached to it (example: address, type of the building, area etc.).
              This output lists the available keys for all the shapes, or 
              in case some specific keys have been supplied to the "requiredKeys_" output, then they will be listed here.
        values: Each upper shape contains a value which corresponds to a certain key (example: "key=addr_stree; value=Second Avenue 14/2", "key=building; value=yes", "key:area; value=100" etc.)
                This ouput lists all values corresponding to each key, for each shape.
        titleOriginPt: Title base point, which can be used to move the "title" geometry with grasshopper's "Move" component.
                       -
                       Connect this output to a Grasshopper's "Point" parameter in order to preview the point in the Rhino scene.
        title: Title geometry with information about location, radius, north angle and shapeType.
"""

ghenv.Component.Name = "Gismo_OSM Shapes"
ghenv.Component.NickName = "OSMshapes"
ghenv.Component.Message = "VER 0.0.1\nFEB_18_2017"
ghenv.Component.IconDisplayMode = ghenv.Component.IconDisplayMode.application
ghenv.Component.Category = "Gismo"
ghenv.Component.SubCategory = "1 | OpenStreetMap"
#compatibleGismoVersion = VER 0.0.1\nFEB_09_2017
try: ghenv.Component.AdditionalHelpFromDocStrings = "1"
except: pass

import rhinoscriptsyntax as rs
import scriptcontext as sc
import Grasshopper
import System
import shutil
import Rhino
import math
import time
import clr
import os
import gc


def checkInputData(radiusM, north, originPt, shapeType, requiredKeys, onlyRemove_Ids):
    
    # check if MapWinGIS is properly installed
    gismoGismoComponentNotRan = False  # initial value
    if sc.sticky.has_key("gismo_mapwingisFolder"):
        mapFolder_ = sc.sticky["gismo_mapwingisFolder"]
        iteropMapWinGIS_dll_folderPath, gdalDataPath_folderPath, validInputData, printMsg = gismo_mainComponent.mapWinGIS(mapFolder_)
        if not validInputData:
            radiusM = northRad = northDeg = originPt = requiredKeys = shapeType = shapeTypeLabel = osm_id_Only = osm_way_id_Only = osm_id_Remove = osm_way_id_Remove = iteropMapWinGIS_dll_folderPath = unitConversionFactor = None
            return radiusM, northRad, northDeg, originPt, shapeType, shapeTypeLabel, requiredKeys, osm_id_Only, osm_way_id_Only, osm_id_Remove, osm_way_id_Remove, iteropMapWinGIS_dll_folderPath, unitConversionFactor, validInputData, printMsg
        if sc.sticky.has_key("MapWinGIS"):
            global MapWinGIS
            import MapWinGIS
        else:
            gismoGismoComponentNotRan = True
    else:
        gismoGismoComponentNotRan = True
    
    if (gismoGismoComponentNotRan == True):
        radiusM = northRad = northDeg = originPt = requiredKeys = shapeType = shapeTypeLabel = osm_id_Only = osm_way_id_Only = osm_id_Remove = osm_way_id_Remove = iteropMapWinGIS_dll_folderPath = unitConversionFactor = None
        validInputData = False
        printMsg = "The \"Gismo Gismo\" component has not been run. Run it before running this component."
        return radiusM, northRad, northDeg, originPt, shapeType, shapeTypeLabel, requiredKeys, osm_id_Only, osm_way_id_Only, osm_id_Remove, osm_way_id_Remove, iteropMapWinGIS_dll_folderPath, unitConversionFactor, validInputData, printMsg
    
    
    # check inputs
    if (radiusM == None):
        radiusM = 100  # default in meters
    elif (radiusM < 50):  # values of 10 or 20 meters can download an invalid .osm file from http://api.openstreetmap.org
        radiusM = northRad = northDeg = originPt = requiredKeys = shapeType = shapeTypeLabel = osm_id_Only = osm_way_id_Only = osm_id_Remove = osm_way_id_Remove = iteropMapWinGIS_dll_folderPath = unitConversionFactor = None
        validInputData = False
        printMsg = "radius_ input only supports values equal or larger than 50 meters."
        
        return radiusM, northRad, northDeg, originPt, shapeType, shapeTypeLabel, requiredKeys, osm_id_Only, osm_way_id_Only, osm_id_Remove, osm_way_id_Remove, iteropMapWinGIS_dll_folderPath, unitConversionFactor, validInputData, printMsg
    #arcAngleD = math.degrees( math.atan( radiusM / (6371000+elevation) ) )  # assumption of Earth being a sphere
    #arcLength = (arcAngleD*math.pi*R)/180
    # correction of radiusM length due to light refraction can not be calculated, so it is assumed that arcLength = radiusM. radiusM variable will be used from now on instead of arcLength.
    
    
    if (north == None):
        northRad = 0  # default, in radians
        northVec = Rhino.Geometry.Vector3d(0,1,0)
    else:
        try:  # check if it's a number
            north = float(north)
            if north < 0 or north > 360:
                radiusM = northRad = northDeg = originPt = requiredKeys = shapeType = shapeTypeLabel = osm_id_Only = osm_way_id_Only = osm_id_Remove = osm_way_id_Remove = iteropMapWinGIS_dll_folderPath = unitConversionFactor = None
                validInputData = False
                printMsg = "Please input north angle value from 0 to 360."
                return radiusM, northRad, northDeg, originPt, shapeType, shapeTypeLabel, requiredKeys, osm_id_Only, osm_way_id_Only, osm_id_Remove, osm_way_id_Remove, iteropMapWinGIS_dll_folderPath, unitConversionFactor, validInputData, printMsg
        except Exception, e:  # check if it's a vector
            north.Unitize()
        
        northRad, northVec = gismo_preparation.angle2northClockwise(north)
    northVec.Unitize()
    northDeg = int(360-math.degrees(northRad))
    if northDeg == 360: northDeg = 0
    
    
    if (originPt == None):
        originPt = Rhino.Geometry.Point3d(0,0,0)
    # send the origin of this component ("OSM shapes") to sc.sticky, in order for it be used in the "OSM 3D" and "OSM search" components
    sc.sticky["gismo_OSMshapesComp_origin"] = originPt
    
    
    if (len(requiredKeys) == 0):
        requiredKeys = []
    elif (len(requiredKeys) > 250):
        # .dbf files require maximal number of fields to be 255 (254 if one of the fields contains None values)
        # source: https://msdn.microsoft.com/en-us/library/3kfd3hw9
        radiusM = northRad = northDeg = originPt = requiredKeys = shapeType = shapeTypeLabel = osm_id_Only = osm_way_id_Only = osm_id_Remove = osm_way_id_Remove = iteropMapWinGIS_dll_folderPath = unitConversionFactor = None
        validInputData = False
        printMsg = "requiredKeys_ input accepts maximum 250 keys.\n" + \
                   "You inputted %s keys. Remove some of them." % len(requiredKeys)
        requiredKeys = None  # set in here so that it can be printed in the printMsg
        return radiusM, northRad, northDeg, originPt, shapeType, shapeTypeLabel, requiredKeys, osm_id_Only, osm_way_id_Only, osm_id_Remove, osm_way_id_Remove, iteropMapWinGIS_dll_folderPath, unitConversionFactor, validInputData, printMsg
    
    
    if (shapeType == None):
        shapeType = 0  # polygons
        shapeTypeLabel = "polygons"
    elif (shapeType == 0):
        shapeTypeLabel = "polygons"
    elif (shapeType == 1):
        shapeTypeLabel = "polylines"
    elif (shapeType == 2):
        shapeTypeLabel = "points"
    elif (shapeType < 0) or (shapeType > 2):
        radiusM = northRad = northDeg = originPt = requiredKeys = shapeType = shapeTypeLabel = osm_id_Only = osm_way_id_Only = osm_id_Remove = osm_way_id_Remove = iteropMapWinGIS_dll_folderPath = unitConversionFactor = None
        validInputData = False
        printMsg = "shapeType_ input can not be smaller than 0, nor larger than 2.\n" + \
                   "Please input some of the following values:\n" + \
                   "0 (polygons)\n" + \
                   "1 (polylines)\n" + \
                   "2 (points)."
        return radiusM, northRad, northDeg, originPt, shapeType, shapeTypeLabel, requiredKeys, osm_id_Only, osm_way_id_Only, osm_id_Remove, osm_way_id_Remove, iteropMapWinGIS_dll_folderPath, unitConversionFactor, validInputData, printMsg
    
    
    if (onlyRemove_Ids.BranchCount == 1) and (onlyRemove_Ids.Branches[0][0] == None):
        # in "OSM ids" component, an id exists both in "osm_id_Only_" and "osm_id_Remove_" inputs,  or an id exists both in "osm_way_id_Only_" and "osm_way_id_Remove_" inputs
        radiusM = northRad = northDeg = originPt = requiredKeys = shapeType = shapeTypeLabel = osm_id_Only = osm_way_id_Only = osm_id_Remove = osm_way_id_Remove = iteropMapWinGIS_dll_folderPath = unitConversionFactor = None
        validInputData = False
        printMsg = "Your \"_onlyRemove_Ids\" input is invalid. Check the \"readMe!\" output of \"OSM ids\" component to see what's wrong with it."
        return radiusM, northRad, northDeg, originPt, shapeType, shapeTypeLabel, requiredKeys, osm_id_Only, osm_way_id_Only, osm_id_Remove, osm_way_id_Remove, iteropMapWinGIS_dll_folderPath, unitConversionFactor, validInputData, printMsg
    elif (onlyRemove_Ids.BranchCount == 0):
        # nothing inputted to "OSM ids" component's four inputs
        osm_id_Only = [];  osm_way_id_Only = [];  osm_id_Remove = [];  osm_way_id_Remove = []
    else:
        # something inputted to at least one input of "OSM ids" component
        onlyRemove_IdsLL = onlyRemove_Ids.Branches
        osm_id_Only = list(onlyRemove_IdsLL[0])
        osm_way_id_Only = list(onlyRemove_IdsLL[1])
        osm_id_Remove = list(onlyRemove_IdsLL[2])
        osm_way_id_Remove = list(onlyRemove_IdsLL[3])
    
    
    unitConversionFactor, unitSystemLabel = gismo_preparation.checkUnits()
    
    
    validInputData = True
    printMsg = "ok"
    
    return radiusM, northRad, northDeg, originPt, shapeType, shapeTypeLabel, requiredKeys, osm_id_Only, osm_way_id_Only, osm_id_Remove, osm_way_id_Remove, iteropMapWinGIS_dll_folderPath, unitConversionFactor, validInputData, printMsg


def destinationLatLon(latitude1D, longitude1D):
    # "Destination point given distance and bearing from start point" by Vincenty solution
    # based on JavaScript code made by Chris Veness
    # http://www.movable-type.co.uk/scripts/latlong-vincenty.html
    
    # for WGS84:
    a = 6378137  # equatorial radius, meters
    b = 6356752.314245  # polar radius, meters
    f = 0.00335281066474  # flattening (ellipticity, oblateness) parameter = (a-b)/a, dimensionless
    
    bearingAnglesR = [math.radians(0), math.radians(180), math.radians(270), math.radians(90)]  # top, bottom, left, right
    latitudeLongitudeRegion = []
    for bearingAngle1R in bearingAnglesR:
        latitude1R = math.radians(latitude1D)
        longitude1R = math.radians(longitude1D)
        sinbearingAngle1R = math.sin(bearingAngle1R)
        cosbearingAngle1R = math.cos(bearingAngle1R)
        tanU1 = (1 - f) * math.tan(latitude1R)
        cosU1 = 1 / math.sqrt(1 + tanU1 * tanU1)
        sinU1 = tanU1 * cosU1
        sigma1 = math.atan2(tanU1, cosbearingAngle1R)
        sinBearingAngle1R = cosU1 * sinbearingAngle1R
        cosSqBearingAngle1R = 1 - (sinBearingAngle1R * sinBearingAngle1R)
        uSq = cosSqBearingAngle1R * (a * a - (b * b)) / (b * b)
        A = 1 + uSq / 16384 * (4096 + uSq * (-768 + uSq * (320 - (175 * uSq))))
        B = uSq / 1024 * (256 + uSq * (-128 + uSq * (74 - (47 * uSq))))
        sigma = radiusM / (b * A)  # radiusM in meters
        sigma_ = 0
        while abs(sigma - sigma_) > 1e-12:
            cos2sigmaM = math.cos(2 * sigma1 + sigma)
            sinsigma = math.sin(sigma)
            cossigma = math.cos(sigma)
            deltaSigma = B * sinsigma * (cos2sigmaM + B / 4 * (cossigma * (-1 + 2 * cos2sigmaM * cos2sigmaM) - (B / 6 * cos2sigmaM * (-3 + 4 * sinsigma * sinsigma) * (-3 + 4 * cos2sigmaM * cos2sigmaM))))
            sigma_ = sigma
            sigma = radiusM / (b * A) + deltaSigma
        
        tmp = sinU1 * sinsigma - (cosU1 * cossigma * cosbearingAngle1R)
        latitude2R = math.atan2(sinU1 * cossigma + cosU1 * sinsigma * cosbearingAngle1R, (1 - f) * math.sqrt(sinBearingAngle1R * sinBearingAngle1R + tmp * tmp))
        longitudeR = math.atan2(sinsigma * sinbearingAngle1R, cosU1 * cossigma - (sinU1 * sinsigma * cosbearingAngle1R))
        C = f / 16 * cosSqBearingAngle1R * (4 + f * (4 - (3 * cosSqBearingAngle1R)))
        L = longitudeR - ((1 - C) * f * sinBearingAngle1R * (sigma + C * sinsigma * (cos2sigmaM + C * cossigma * (-1 + 2 * cos2sigmaM * cos2sigmaM))))
        longitude2R = (longitude1R + L + 3 * math.pi) % (2 * math.pi) - math.pi  # normalise to -180...+180
        bearingAngle2R = math.atan2(sinBearingAngle1R, -tmp)
        
        latitude2D = math.degrees(latitude2R)
        longitude2D = math.degrees(longitude2R)
        bearingAngle2D = math.degrees(bearingAngle2R)
        if bearingAngle2D < 0:
            bearingAngle2D = 360-abs(bearingAngle2D)
        
        latitudeLongitudeRegion.append(latitude2D)
        latitudeLongitudeRegion.append(longitude2D)
    
    # latitude positive towards north, longitude positive towards east
    latitudeTopD, longitudeTopD, latitudeBottomD, longitudeBottomD, latitudeLeftD, longitudeLeftD, latitudeRightD, longitudeRightD = latitudeLongitudeRegion
    
    return latitudeTopD, longitudeTopD, latitudeBottomD, longitudeBottomD, latitudeLeftD, longitudeLeftD, latitudeRightD, longitudeRightD


def distanceBetweenTwoPoints(latitude1D, longitude1D, radiusM):
    # "Distance/bearing between two points (inverse solution)" by Vincenty solution
    # based on JavaScript code made by Chris Veness
    # http://www.movable-type.co.uk/scripts/latlong-vincenty.html
    
    # setting the latitude2D, longitude2D according to SRTM latitude range boundaries (-56 to 60)
    if latitude1D >= 0:
        # northern hemishere:
        latitude2D = 60
    elif latitude1D < 0:
        # southern hemishere:
        latitude2D = -56
    longitude2D = longitude1D
    
    # for WGS84:
    a = 6378137  # equatorial radius, meters
    b = 6356752.314245  # polar radius, meters
    f = 0.00335281066474  # flattening (ellipticity, oblateness) parameter = (a-b)/a, dimensionless
    
    latitude1R = math.radians(latitude1D)
    latitude2R = math.radians(latitude2D)
    longitude1R = math.radians(longitude1D)
    longitude2R = math.radians(longitude2D)
    
    L = longitude2R - longitude1R
    tanU1 = (1-f) * math.tan(latitude1R)
    cosU1 = 1 / math.sqrt((1 + tanU1*tanU1))
    sinU1 = tanU1 * cosU1
    tanU2 = (1-f) * math.tan(latitude2R)
    cosU2 = 1 / math.sqrt((1 + tanU2*tanU2))
    sinU2 = tanU2 * cosU2
    longitudeR = L
    longitudeR_ = 0
    
    for i in range(100):
        sinLongitudeR = math.sin(longitudeR)
        cosLongitudeR = math.cos(longitudeR)
        sinSqSigma = (cosU2*sinLongitudeR) * (cosU2*sinLongitudeR) + (cosU1*sinU2-sinU1*cosU2*cosLongitudeR) * (cosU1*sinU2-sinU1*cosU2*cosLongitudeR)
        sinSigma = math.sqrt(sinSqSigma)
        cosSigma = sinU1*sinU2 + cosU1*cosU2*cosLongitudeR
        sigma = math.atan2(sinSigma, cosSigma)
        sinBearingAngleR = cosU1 * cosU2 * sinLongitudeR / sinSigma
        cosSqBearingAngleR = 1 - sinBearingAngleR*sinBearingAngleR
        if cosSqBearingAngleR == 0:
            # if distanceM is measured along the equator line (latitude1D = latitude2D = 0, longitude1D != longitude2D != 0)
            cos2SigmaM = 0
        else:
            cos2SigmaM = cosSigma - 2*sinU1*sinU2/cosSqBearingAngleR
        C = f/16*cosSqBearingAngleR*(4+f*(4-3*cosSqBearingAngleR))
        longitudeR_ = longitudeR
        longitudeR = L + (1-C) * f * sinBearingAngleR * (sigma + C*sinSigma*(cos2SigmaM+C*cosSigma*(-1+2*cos2SigmaM*cos2SigmaM)))
    
    uSq = cosSqBearingAngleR * (a*a - b*b) / (b*b)
    A = 1 + uSq/16384*(4096+uSq*(-768+uSq*(320-175*uSq)))
    B = uSq/1024 * (256+uSq*(-128+uSq*(74-47*uSq)))
    deltaSigma = B*sinSigma*(cos2SigmaM+B/4*(cosSigma*(-1+2*cos2SigmaM*cos2SigmaM) - B/6*cos2SigmaM*(-3+4*sinSigma*sinSigma)*(-3+4*cos2SigmaM*cos2SigmaM)))
    
    distanceM = b*A*(sigma-deltaSigma)  # in meters
    
    bearingAngleForwardR = math.atan2(cosU2*sinLongitudeR,  cosU1*sinU2-sinU1*cosU2*cosLongitudeR)
    bearingAngleReverseR = math.atan2(cosU1*sinLongitudeR, -sinU1*cosU2+cosU1*sinU2*cosLongitudeR)
    
    bearingAngleForwardD = math.degrees(bearingAngleForwardR)
    bearingAngleReverseD = math.degrees(bearingAngleReverseR)
    
    return distanceM


def setupOsmconf_ini_File(requiredKeys, shapeType, overpassFile_filePathL, osmconf_ini_filePath):
    
    # identify unique keys from overpassFile_filePathL files
    if (len(requiredKeys) == 0):
        # nothing supplied to "requiredKeys_" input. Use the keys provided in the .osm file
        fullName_keysL = []
        for overpassFile_filePath in overpassFile_filePathL:
            requiredKeys = []
            
            #overpassFile = open(overpassFile_filePath,"r")
            with open(overpassFile_filePath) as overpassFile:
                foundTags = False
                lines = overpassFile.readlines()
                #for line in overpassFile.xreadlines():
                for line in lines:
                    if "tags" in line:
                        # "  "tags": {" line found
                        foundTags = True
                        continue  # start extracting the tags below it
                    if (foundTags == True) and ("}" not in line):
                        strippedLine = line.strip()
                        splittedLine = strippedLine.split(": ")
                        fieldName = splittedLine[0].replace("\"", "")
                        requiredKeys.append(fieldName)
                    else:
                        foundTags = False
                    
                foundTags = False
                overpassFile.close()
                
                #print "requiredKeys: ", requiredKeys
                requiredKeysSet = set(requiredKeys)
                uniqueKeys = list(requiredKeysSet)
                uniqueKeys.sort()  # sort the keys alphabetically
                fullName_keysL.append(uniqueKeys)
    
    elif (len(requiredKeys) != 0):
        # something supplied to "requiredKeys_" input. Use those keys
        fullName_keysL = [requiredKeys, requiredKeys, requiredKeys, requiredKeys, requiredKeys]  # polygons, points, polylines, polylines2, irrelevant
    
    
    
    # create lines for the new osmconf.ini file by inserting the fullName_keysL to each section ([points], [lines], [multipolygons], [multilinestrings], [other_relations])
    osmconf_ini_newFileLines = []
    points_tagPassed = lines_tagPassed = multipolygons_tagPassed = multilinestrings_tagPassed = other_relations_tagPassed = False  # initial values
    
    #overpassFile = open(osmconf_ini_filePath,"r")  # results in a resource leak (http://stackoverflow.com/questions/28396759/os-remove-in-windows-gives-error-32-being-used-by-another-process). Reported at: http://www.grasshopper3d.com/xn/detail/2985220:Comment:1682182
    with open(osmconf_ini_filePath) as overpassFile:
        lines = overpassFile.readlines()
        for line in lines:
            # setting keys are considered to be polygons. This puts all shapes with these keys into the multipolygons.shp file. Otherwise (their key is not listed in this line) if they are closed ways, they will be put into the lines.shp file
            if line.startswith("closed_ways_are_polygons="):
                line = "closed_ways_are_polygons=aeroway,amenity,boundary,building,building:levels,building:part,craft,geological,historic,landuse,leisure,military,natural,office,place,shop,sport,tourism\n"
            
            # checking for switches
            if (line == "[points]\n"):
                points_tagPassed = True
            elif (line == "[lines]\n"):
                lines_tagPassed = True
            elif (line == "[multipolygons]\n"):
                multipolygons_tagPassed = True
            elif (line == "[multilinestrings]\n"):
                multilinestrings_tagPassed = True
            elif (line == "[other_relations]\n"):
                other_relations_tagPassed = True
            
            # set "other_tags" and "all_tags" to "no"
            if (line == "#other_tags=no\n") or (line == "#other_tags=yes\n") or (line == "other_tags=yes\n"):
                line = "other_tags=no\n"
            if (line == "#all_tags=no\n") or (line == "#all_tags=yes\n") or (line == "all_tags=yes\n"):
                line = "all_tags=no\n"
            # set "attribute_name_laundering" to "no" (do not change ":" to "_" in key names)
            if (line == "#attribute_name_laundering=yes\n") or (line == "attribute_name_laundering=no\n") or (line == "attribute_name_laundering=yes\n"):
                line = "#attribute_name_laundering=no\n"
            # comment-out certain 3 lines to remove the "z_order" key from [lines].
            if line.startswith("computed_attributes="):
                line = "#" + line
            if line.startswith("z_order_type="):
                line = "#" + line
            if line.startswith("z_order_sql="):
                line = "#" + line
            
            if (points_tagPassed == True) and (lines_tagPassed == False) and (multipolygons_tagPassed == False) and (multilinestrings_tagPassed == False) and (other_relations_tagPassed == False):
                if line.startswith("attributes="):
                    line = "attributes="
                    for index, key in enumerate(fullName_keysL[2]):  # [points] (points) keys
                        if index != len(fullName_keysL[2])-1:
                            line = line + key + ","
                        else:
                            # last key in fullName_keysL[1]
                            line = line + key + "\n"
            elif (points_tagPassed == True) and (lines_tagPassed == True) and (multipolygons_tagPassed == False) and (multilinestrings_tagPassed == False) and (other_relations_tagPassed == False):
                if line.startswith("attributes="):
                    line = "attributes="
                    for index, key in enumerate(fullName_keysL[1]):  # [lines] (polylines) keys
                        if index != len(fullName_keysL[1])-1:
                            line = line + key + ","
                        else:
                            # last key in fullName_keysL[2]
                            line = line + key + "\n"
            elif (points_tagPassed == True) and (lines_tagPassed == True) and (multipolygons_tagPassed == True) and (multilinestrings_tagPassed == False) and (other_relations_tagPassed == False):
                if line.startswith("attributes="):
                    line = "attributes="
                    for index, key in enumerate(fullName_keysL[0]):  # [multipolygons] (polygons) keys
                        if index != len(fullName_keysL[0])-1:
                            line = line + key + ","
                        else:
                            # last key in fullName_keysL[0]
                            line = line + key + "\n"
            elif (points_tagPassed == True) and (lines_tagPassed == True) and (multipolygons_tagPassed == True) and (multilinestrings_tagPassed == True) and (other_relations_tagPassed == False):
                if line.startswith("attributes="):
                    line = "attributes="
                    for index, key in enumerate(fullName_keysL[3]):  # [multilinestrings] (polylines2) keys
                        if index != len(fullName_keysL[3])-1:
                            line = line + key + ","
                        else:
                            # last key in fullName_keysL[3]
                            line = line + key + "\n"
            elif (points_tagPassed == True) and (lines_tagPassed == True) and (multipolygons_tagPassed == True) and (multilinestrings_tagPassed == True) and (other_relations_tagPassed == True):
                if line.startswith("attributes="):
                    line = "attributes="
                    for index, key in enumerate(fullName_keysL[4]):  # [other_relations] keys
                        if index != len(fullName_keysL[4])-1:
                            line = line + key + ","
                        else:
                            # last key in fullName_keysL[4]
                            line = line + key + "\n"
            osmconf_ini_newFileLines.append(line)
    
    points_tagPassed = lines_tagPassed = multipolygons_tagPassed = multilinestrings_tagPassed = other_relations_tagPassed = False  # setting them back to "False" values
    overpassFile.close()  # results in a resource leak (http://stackoverflow.com/questions/28396759/os-remove-in-windows-gives-error-32-being-used-by-another-process). Reported at: http://www.grasshopper3d.com/xn/detail/2985220:Comment:1682182
    os.remove(osmconf_ini_filePath)  # delete the original "osmconf.ini" file
    
    # create the new osmconf.ini file
    osmconf_ini_newFilePath = osmconf_ini_filePath
    #new_overpassFile_file = open(osmconf_ini_newFilePath,"w")  # results in a resource leak (http://stackoverflow.com/questions/28396759/os-remove-in-windows-gives-error-32-being-used-by-another-process). Reported at: http://www.grasshopper3d.com/xn/detail/2985220:Comment:1682182
    with open(osmconf_ini_newFilePath, "w") as new_overpassFile_file:
        for line in osmconf_ini_newFileLines:
            new_overpassFile_file.write(line)
    new_overpassFile_file.close()  # results in a resource leak (http://stackoverflow.com/questions/28396759/os-remove-in-windows-gives-error-32-being-used-by-another-process). Reported at: http://www.grasshopper3d.com/xn/detail/2985220:Comment:1682182
    
    # deleting
    del overpassFile
    del new_overpassFile_file
    del osmconf_ini_newFileLines
    
    
    # return fullName_keysL (unlike those from the shapefiles ("shortenedName_keys") these are not limited to 10 characters and do not have ":" replaced with "_")
    if shapeType == 0:
        return ["osm_id", "osm_way_id"] + fullName_keysL[shapeType]
    else:
        return ["osm_id"] + fullName_keysL[shapeType]


def checkOsmShpFiles(locationLatitudeD, locationLongitudeD, fileNameIncomplete, radiusM, requiredKeys, shapeType):
    
    latitudeTopD, longitudeTopD, latitudeBottomD, longitudeBottomD, latitudeLeftD, longitudeLeftD, latitudeRightD, longitudeRightD = destinationLatLon(locationLatitudeD, locationLongitudeD)
    
    # check if osm region is 0.5x0.5 degrees
    if ((latitudeTopD - latitudeBottomD) >= 0.5)  or  ((longitudeRightD - longitudeLeftD) >= 0.5):
        distanceM = distanceBetweenTwoPoints(locationLatitudeD, locationLongitudeD, radiusM)
        correctedRadiusM = int(distanceM)  # int(distanceM) will always perform the math.floor(distanceM)
        validVisibilityRadiusM = False
        printMsg = "This component downloads map data from openstreetmap.org in order to create the shapes for the chosen _location.\n" + \
                   "But mentioned openstreetmap.org data has limits: the radius can not be longer than 0.25 degrees of latitude and longitude.\n" + \
                   "This is why the inputted radius_ value, needs to be shank.\n" + \
                   " \n" + \
                   "Please supply the \"radius_\" input with value: %s.\n" % correctedRadiusM
        return shapeFile_filePath, valid_osm_or_shp_files, printMsg
    
    
    # create "gismoFolder_\osm_files" folder
    # always use the "gismoFolder_" input of Gismo_Gismo component + "\osm_files" as the working folder for downloaded .osm files and converted shapefiles
    gismoFolder = sc.sticky["gismo_gismoFolder"]  # "gismoFolder_" input of Gismo_Gismo component
    osm_files_folderPath = os.path.join(gismoFolder, "osm_files")
    if not os.path.isdir(osm_files_folderPath):
        os.mkdir(osm_files_folderPath)
    
    # fileNames
    fileName = fileNameIncomplete + "_radius=" + str(round(radiusM/1000, 2)) + "KM"
    osm_shp_file_folderPath = os.path.join(osm_files_folderPath, fileName)
    if not os.path.isdir(osm_shp_file_folderPath):
        os.mkdir(osm_shp_file_folderPath)
    
    osmFile_filePath = os.path.join(osm_shp_file_folderPath, fileName + ".osm")
    
    osmconf_ini_filePath = os.path.join(iteropMapWinGIS_dll_folderPath, "gdal-data\\osmconf.ini")  # for MapWinGIS
    osmconf_ini_present = os.path.isfile(osmconf_ini_filePath)
    if osmconf_ini_present == False:
        osmconf_ini_filePath = os.path.join(iteropMapWinGIS_dll_folderPath, "MapWinGIS\\gdal-data\\osmconf.ini")  # for Map Window GIS Light
    
    overpassFile_nodeTags_filePath = os.path.join(osm_shp_file_folderPath, fileName + "_nodeTags" + ".txt")
    overpassFile_wayTags_filePath = os.path.join(osm_shp_file_folderPath, fileName + "_wayTags" + ".txt")
    overpassFile_filePathL = [overpassFile_wayTags_filePath, overpassFile_wayTags_filePath, overpassFile_nodeTags_filePath, overpassFile_wayTags_filePath, overpassFile_wayTags_filePath]  # [ [multipolygons] (polygons) keys, [lines] (polylines) key, [points] (points) key, [multilinestrings] (we use polylines again) key, [other_relations] (we use polylines again) keys ]
    
    shpMultipolygonsFile_filePath = os.path.join(osm_shp_file_folderPath, "multipolygons" + ".shp")
    shpLinesFile_filePath = os.path.join(osm_shp_file_folderPath, "lines" + ".shp")
    shpPointsFile_filePath = os.path.join(osm_shp_file_folderPath, "points" + ".shp")
    shpMultilinestringsFile_filePath = os.path.join(osm_shp_file_folderPath, "multilinestrings" + ".shp")
    
    
    #  check internet connection
    # connectedToInternet first check
    connectedToInternet1 = System.Net.NetworkInformation.NetworkInterface.GetIsNetworkAvailable()
    if connectedToInternet1 == False:
        # connectedToInternet second check
        try:
            client = System.Net.WebClient()
            client.OpenRead("http://www.google.com")
            connectedToInternet = True
        except:
            connectedToInternet = False
            # you are not connected to the Internet
    elif connectedToInternet1 == True:
        # no need for connectedToInternet second check
        connectedToInternet = True
    
    
    # always delete the .shp/.shx/.dbg/.prj files, whenever the "OSM Shapes" component is run
    files = os.listdir(osm_shp_file_folderPath)
    for fileNameWithExtension in files:
        fileExtension = fileNameWithExtension[-4:]
        if (fileExtension != ".osm") and (fileExtension != ".txt"):  # delete only .shp/.shx/.dbf/.prj files
            filePath = os.path.join(osm_shp_file_folderPath, fileNameWithExtension)
            os.remove(filePath)
    
    
    if len(requiredKeys) != 0:
        # something supplied to the "requiredKeys_" input, use those keys for the osmconf.ini file
        pass
    else:
        # nothing supplied to the "requiredKeys_" input
        # 2) check if overpassNodeTags....txt, overpassWayTags....txt, overpassRelationTags....txt files exist in "osm_files\osm_shp_file_folderPath\" folder
        if os.path.isfile(overpassFile_nodeTags_filePath) and os.path.isfile(overpassFile_wayTags_filePath):
            # 2) overpassNodeTags....txt, overpassWayTags....txt, overpassRelationTags....txt files EXIST in "osm_files\osm_shp_file_folderPath\" folder. Extract the "requiredKeys" from them
            requiredKeys = []
        else:
            # overpassNodeTags....txt, overpassWayTags....txt, overpassRelationTags....txt files DO NOT exist in "osm_files\osm_shp_file_folderPath\" folder
            downloadOverpassNodeFile_link = "http://overpass-api.de/api/interpreter?data=[out:json];node[~\".\"~\".\"](%s,%s,%s,%s);out;" % (latitudeBottomD, longitudeLeftD, latitudeTopD, longitudeRightD)
            downloadOverpassWayFile_link = "http://overpass-api.de/api/interpreter?data=[out:json];way[~\".\"~\".\"](%s,%s,%s,%s);out;" % (latitudeBottomD, longitudeLeftD, latitudeTopD, longitudeRightD)
            
            overpassNodeFileDownloaded = gismo_preparation.downloadFile(downloadOverpassNodeFile_link, overpassFile_nodeTags_filePath)
            overpassWayFileDownloaded = gismo_preparation.downloadFile(downloadOverpassWayFile_link, overpassFile_wayTags_filePath)
            
            if (overpassNodeFileDownloaded == True) and (overpassWayFileDownloaded == True):
                # overpassNodeTags....txt, overpassWayTags....txt, overpassRelationTags....txt files SUCCESSFULLY DOWNLOADED in "osm_files\osm_shp_file_folderPath\" folder. Extract the "requiredKeys" from them
                requiredKeys = []
            else:
                # one of the overpass .txt files has NOT BEEN DOWNLOADED. Use default requiredKeys:
                requiredKeys = ["name",
                                "name:en",
                                "amenity",
                                "addr:country",
                                "addr:city",
                                "addr:postcode",
                                "addr:street",
                                "addr:housenumber",
                                "height",
                                "building:levels",
                                "min_height",
                                "building",
                                "natural",
                                "leaf_type",
                                "leaf_cycle",
                                "diameter_crown"]
                if connectedToInternet == True:
                    print "Component failed to retrieve keys from the .osm file.\n" + \
                          "The following default list of keys will be used instead:\n" + \
                          "%s\n" % requiredKeys + \
                          " \n" + \
                          "You can also define your own keys through \"requiredKeys_\" input."
                elif connectedToInternet == False:
                    print "This component requires internet access in order to retrieve the keys from the .osm file.\n" + \
                          "As there's no internet access, default list of keys will be used instead:\n" + \
                          "%s\n" % requiredKeys + \
                          " \n" + \
                          "You can also define your own keys through \"requiredKeys_\" input."
    
    fullName_keys = setupOsmconf_ini_File(requiredKeys, shapeType, overpassFile_filePathL, osmconf_ini_filePath)
    
    
    # 1) check if lines.shp, multilinestrings....shp, multipolygons....shp, points....shp files exist in "osm_files\osm_shp_file_folderPath\" folder
    if os.path.isfile(shpMultipolygonsFile_filePath) and os.path.isfile(shpLinesFile_filePath) and os.path.isfile(shpPointsFile_filePath) and os.path.isfile(shpMultilinestringsFile_filePath):
        ####print "_1_SHP files exist!"
        # lines.shp, multilinestrings.shp, multipolygons.shp, points.shp files EXIST in "osm_files\osm_shp_file_folderPath\" folder. Disregard the .osm file
        valid_osm_or_shp_files = True
        osmToShpSwitch = False  # dummy value
        printMsg = "ok"
    else:
        ####print "_1_SHP files DO NOT exist"
        # lines.shp, multilinestrings.shp, multipolygons.shp, points.shp files do NOT exist in "osm_files\osm_shp_file_folderPath\" folder
        # check if .osm file exists in "osm_files\osm_shp_file_folderPath\" folder
        if os.path.isfile(osmFile_filePath):
            ####print "_2_OSM files exist!"
            # the .osm file exists. Convert it to 4 .shp files
            osmToShpSwitch = True
        else:
            ####print "_2_OSM file DOES NOT exist"
            # the .osm file does NOT exist. Download it first
            
            if connectedToInternet == False:
                # you are NOT connected to the Internet, exit this function
                shpLinesFile_filePath = shpMultilinestringsFile_filePath = shpMultipolygonsFile_filePath = shpPointsFile_filePath = None
                valid_osm_or_shp_files = osmToShpSwitch = False
                printMsg = "This component requires you to be connected to the Internet, in order to download the OSM shape data.\n" + \
                           "Please do connect, then rerun the component (set \"_runIt\" to False, then to True)."
            elif connectedToInternet == True:
                # you ARE connected to the Internet
                
                # download .osm file
                # based on: http://wiki.openstreetmap.org/wiki/Downloading_data
                downloadOSMfile_link = "http://overpass-api.de/api/map?bbox=%s,%s,%s,%s" % (longitudeLeftD,latitudeBottomD,longitudeRightD,latitudeTopD)
                osmFileDownloaded = gismo_preparation.downloadFile(downloadOSMfile_link, osmFile_filePath)
                
                if osmFileDownloaded == False:
                    # .osm file has NOT been downloaded
                    shpLinesFile_filePath = shpMultilinestringsFile_filePath = shpMultipolygonsFile_filePath = shpPointsFile_filePath = None
                    valid_osm_or_shp_files = osmToShpSwitch = False
                    printMsg = "This component requires OSM data to be downloaded from openstreetmap.org. It has just failed to do that. Try the following two fixes:\n" + \
                               " \n" + \
                               "1) Sometimes due to large number of requests, the component fails to download the OSM data even if openstreetmap.org website and their services are up and running.\n" + \
                               "In this case, wait a couple of seconds and try reruning the component.\n" + \
                               " \n" + \
                               "2) Try lowering the \"radius_\" input.\n" + \
                               " \n" + \
                               "If each of two mentioned advices fails, open a new topic about this issue on: www.grasshopper3d.com/group/gismo/forum."
                    
                elif osmFileDownloaded == True:
                    ####print "_OSM successfully downloaded!!!"
                    # .osm file has been downloaded. Convert it to 4 .shp files
                    osmToShpSwitch = True
    
    
    
    if osmToShpSwitch == True:
        # .osm file exists or has been downloaded. Convert it to 4 .shp files
        utils = MapWinGIS.UtilsClass()
        bstrOptions = '--config OSM_USE_CUSTOM_INDEXING NO -skipfailures -f "ESRI Shapefile"'
        convertToShapefilesResult = MapWinGIS.UtilsClass.OGR2OGR(utils, osmFile_filePath, osm_shp_file_folderPath, bstrOptions, None)
        if convertToShapefilesResult == False:
            # converting an .osm file to a .shp file failed. Possible "HTTP" error
            convertErrorNo = MapWinGIS.GlobalSettingsClass().GdalLastErrorNo
            convertErrorMsg = MapWinGIS.GlobalSettingsClass().GdalLastErrorMsg
            convertErrorType = MapWinGIS.GlobalSettingsClass().GdalLastErrorType
            print "convertErrorNo: ", convertErrorNo
            print "convertErrorMsg: ", convertErrorMsg
            print "convertErrorType: ", convertErrorType
            print "utils.ErrorMsg: ", utils.ErrorMsg
            print "utils.LastErrorCode: ", utils.LastErrorCode
            del utils
            del convertToShapefilesResult
            shpLinesFile_filePath = shpMultilinestringsFile_filePath = shpMultipolygonsFile_filePath = shpPointsFile_filePath = None
            valid_osm_or_shp_files = False
            printMsg = "An error:\n" + \
                       " \n" + \
                       "%s\n" % convertErrorMsg + \
                       " \n" + \
                       "emerged while processing the OSM shape data.\n" + \
                       "Restart Rhino and Grasshopper (close them, then run again) and run this component again.\n" + \
                       "If this same message appears again open a new topic about it on: www.grasshopper3d.com/group/gismo/forum."
        
        else:
            # converting an .osm file to a .shp file SUCCESSFUL
            del utils
            valid_osm_or_shp_files = True
            printMsg = "ok"
    
    if shapeType == 0:
        shapeFile_filePath = shpMultipolygonsFile_filePath
    elif shapeType == 1:
        shapeFile_filePath = shpLinesFile_filePath
    elif shapeType == 2:
        shapeFile_filePath = shpPointsFile_filePath
    elif shapeType == 3:
        shapeFile_filePath = shpMultilinestringsFile_filePath
    
    
    return shapeFile_filePath, fullName_keys, valid_osm_or_shp_files, printMsg


def filterShapes(shortenedName_keys, subValuesL, shapesL, osm_id_Only, osm_way_id_Only, osm_id_Remove, osm_way_id_Remove):
    
    value__osm_id = "^#-@"  # dummy value, in case for some unknown reason there is no "osm_id" field
    value__osm_way_id = "^#-@"  # dummy value, in case there is no "osm_way_id" field (shapeType = 1,2)
    for shortenedName_keysIndex, field in enumerate(shortenedName_keys):
        if field == "osm_id":
            value__osm_id = subValuesL[shortenedName_keysIndex]
        if field == "osm_way_id":
            value__osm_way_id = subValuesL[shortenedName_keysIndex]
    
    
    # removing shapes
    if value__osm_id in osm_id_Remove:
        return [], []
    elif value__osm_way_id in osm_way_id_Remove:
        return [], []
    
    # allowing this shapes
    if value__osm_id in osm_id_Only:
        return subValuesL, shapesL
    elif value__osm_way_id in osm_way_id_Only:
        return subValuesL, shapesL
    else:
        if (len(osm_id_Only) == 0) and (len(osm_way_id_Only) == 0):
            # "osm_id_Only" and "osm_way_id_Only" are empty. Use ALL shapes except ones whos "osm_id" and "osm_way_id" are defined in either "osm_id_Remove" and "osm_way_id_Remove"
            return subValuesL, shapesL
        else:
            # either "osm_id_Only" and "osm_way_id_Only" are NOT empty. Use ONLY those shapes whos "osm_id" and "osm_way_id" are defined in either "osm_id_Only" and "osm_way_id_Only"
            return [], []


def createShapesKeysValues(locationName, locationLatitudeD, locationLongitudeD, shapeFile_filePath, northRad, originPt, shapeType, osm_id_Only, osm_way_id_Only, osm_id_Remove, osm_way_id_Remove, unitConversionFactor):
    
    # UTM CRS for given location
    # by http://stackoverflow.com/a/9188972/3137724 (link given by Even Rouault)
    UTMzone = (math.floor((locationLongitudeD + 180)/6) % 60) + 1
    if locationLatitudeD >= 0:
        # for northern hemisphere
        northOrsouth = "north"
        outputCRS_EPSG = 32600 + UTMzone
    elif locationLatitudeD < 0:
        # for southern hemisphere
        northOrsouth = "south"
        outputCRS_EPSG = 32700 + UTMzone
    
    # output crs
    outputCRS = MapWinGIS.GeoProjectionClass()
    outputCRS.ImportFromEPSG(outputCRS_EPSG)
    
    
    
    # fix invalid shapes, overlapping shape issues, shape vertices direction ...
    shapefile = MapWinGIS.ShapefileClass()
    openShapefileSuccess = MapWinGIS.ShapefileClass.Open(shapefile, shapeFile_filePath, None)
    if openShapefileSuccess:
        numOfsuccessfullyReprojectedShapes = clr.StrongBox[System.Int32]()
        shapefileFixedSuccess, fixedShapefile = MapWinGIS.ShapefileClass.FixUpShapes(shapefile)  # fails on MapWinGIS 4.9.4.2. Does not fail on Map Window Lite 32x
        if shapefileFixedSuccess:
            # shape file has been fixed
            reprojectedShapefile = MapWinGIS.ShapefileClass.Reproject(shapefile, outputCRS, numOfsuccessfullyReprojectedShapes)
            #reprojectedShapefile = MapWinGIS.ShapefileClass.Reproject(fixedShapefile, outputCRS, numOfsuccessfullyReprojectedShapes)
        else:
            # shapefile has NOT been fixed. Use the initial shapefile
            reprojectedShapefile = MapWinGIS.ShapefileClass.Reproject(shapefile, outputCRS, numOfsuccessfullyReprojectedShapes)
        
        """
        # testing fixing of shapes
        print "numOfsuccessfullyReprojectedShapes: ", numOfsuccessfullyReprojectedShapes
        print "reprojectedShapefile: ", reprojectedShapefile
        # testing MapWinGIS.ShapefileClass.FixUpShapes
        shapeFile_filePath_saved = shapeFile_filePath[:-4] + "_saved_" + str(int(time.time())) + ".shp"
        print "shapeFile_filePath_saved: ", shapeFile_filePath_saved
        #success = MapWinGIS.ShapefileClass.SaveAs(reprojectedShapefile, shapeFile_filePath_saved, None)
        #print "success: ", success
        """
        
        if reprojectedShapefile == None:
            # reprojection failed
            
            convertErrorNo = MapWinGIS.GlobalSettingsClass().GdalLastErrorNo
            convertErrorMsg = MapWinGIS.GlobalSettingsClass().GdalLastErrorMsg
            convertErrorType = MapWinGIS.GlobalSettingsClass().GdalLastErrorType
            reprojectErrorMsg = MapWinGIS.GlobalSettingsClass().GdalReprojectionErrorMsg
            print "numOfsuccessfullyReprojectedShapes: ", numOfsuccessfullyReprojectedShapes
            print "convertErrorNo: ", convertErrorNo
            print "convertErrorMsg: ", convertErrorMsg
            print "convertErrorType: ", convertErrorType
            print "reprojectErrorMsg: ", reprojectErrorMsg
            print "utils.ErrorMsg: ", utils.ErrorMsg
            print "utils.LastErrorCode: ", utils.LastErrorCode
            
            reprojectionError = fixedShapefile.ErrorMsg(fixedShapefile.LastErrorCode)
            shpLinesFile_filePath = shpMultilinestringsFile_filePath = shpMultipolygonsFile_filePath = shpPointsFile_filePath = None
            validShapes = False
            printMsg = "The following error emerged while processing the data:\n" + \
                       " \n" + \
                       "\"%s\"\n" % reprojectionError + \
                       "numOfsuccessfullyReprojectedShapes: %s\n" % numOfsuccessfullyReprojectedShapes + \
                       " \n" + \
                       "Restart Rhino and Grasshopper (close them, then run again) and run this component again.\n" + \
                       "If this same message appears again open a new topic about it on: www.grasshopper3d.com/group/gismo/forum."
    
    
    originPtProjected = gismo_osm.projectedLocationCoordinates(locationLatitudeD, locationLongitudeD)  # in meters!
    
    # rotation due to north angle position
    #transformMatrixRotate = Rhino.Geometry.Transform.Rotation(-northRad, Rhino.Geometry.Vector3d(0,0,1), originPt)  # counter-clockwise
    transformMatrixRotate = Rhino.Geometry.Transform.Rotation(northRad, Rhino.Geometry.Vector3d(0,0,1), originPt)  # clockwise
    
    
    # open reprojectedShapefile
    
    # loop through shortenedName_keys (these are shapefile fields (":" is replaced with "_" and maximal size is 10 characters))
    shortenedName_keys = []
    for i in range(reprojectedShapefile.NumFields):
        field = reprojectedShapefile.Field(i)
        shortenedName_keys.append(field.Name)
    
    
    values = Grasshopper.DataTree[object]()
    shapes = Grasshopper.DataTree[object]()
    for i in range(reprojectedShapefile.NumShapes):
        shape = reprojectedShapefile.Shape[i]
        
        moveVector = originPt - originPtProjected
        
        if (shape.ShapeType == 0):  # NULL_SHAPE
            # ShapeType: NULL_SHAPE
            
            # values
            subValuesL = []
            for g in range(reprojectedShapefile.NumFields):
                value = reprojectedShapefile.CellValue(g,i)
                subValuesL.append(value)
            values.AddRange(subValuesL, Grasshopper.Kernel.Data.GH_Path(i))
            
            # pts
            ptsPerShape = [None]
            shapes.AddRange(ptsPerShape, Grasshopper.Kernel.Data.GH_Path(i))
        
        if (shape.ShapeType == 1):  # SHP_POINT
            # ShapeType: POINT
            
            # values
            subValuesL = []
            for g in range(reprojectedShapefile.NumFields):
                value = reprojectedShapefile.CellValue(g,i)
                if value == "yes": value = True  # for example: "building=yes"
                subValuesL.append(value)
            
            # pts
            ptsPerShape = []
            for k in range(shape.numPoints):
                pt = shape.Point[k]
                point3dProjected = Rhino.Geometry.Point3d(pt.x/unitConversionFactor, pt.y/unitConversionFactor, pt.z/unitConversionFactor)
                point3dMoved = point3dProjected + moveVector
                transformBoolSuccess = point3dMoved.Transform(transformMatrixRotate)
                ptsPerShape.append(point3dMoved)
            
            subValuesL_filtered, ptsPerShape_filtered = filterShapes(shortenedName_keys, subValuesL, ptsPerShape, osm_id_Only, osm_way_id_Only, osm_id_Remove, osm_way_id_Remove)
            
            values.AddRange(subValuesL_filtered, Grasshopper.Kernel.Data.GH_Path(i))
            shapes.AddRange(ptsPerShape_filtered, Grasshopper.Kernel.Data.GH_Path(i))
            del ptsPerShape
        
        if (shape.ShapeType == 3) or (shape.ShapeType == 5):  # POLYLINE and 
            # ShapeType: POLYLINE OR POLYGON
            
            for n in range(shape.NumParts):
                # values
                subValuesL = []
                for g in range(reprojectedShapefile.NumFields):
                    value = reprojectedShapefile.CellValue(g,i)
                    if value == "yes": value = True  # for example: "building=yes"
                    subValuesL.append(value)
                
                
                # points
                ptsPerPart = []
                subShape = shape.PartAsShape(n)
                for k in range(subShape.numPoints):
                    pt = subShape.Point[k]
                    point3dProjected = Rhino.Geometry.Point3d(pt.x/unitConversionFactor, pt.y/unitConversionFactor, pt.z/unitConversionFactor)  # in Rhino document units
                    point3dMoved = point3dProjected + moveVector
                    transformBoolSuccess = point3dMoved.Transform(transformMatrixRotate)
                    ptsPerPart.append(point3dMoved)
                polyline = Rhino.Geometry.Polyline(ptsPerPart)
                
                subValuesL_filtered, shapesL_filtered = filterShapes(shortenedName_keys, subValuesL, [polyline], osm_id_Only, osm_way_id_Only, osm_id_Remove, osm_way_id_Remove)
                
                values.AddRange(subValuesL_filtered, Grasshopper.Kernel.Data.GH_Path(i,n))
                shapes.AddRange(shapesL_filtered, Grasshopper.Kernel.Data.GH_Path(i,n))
                del subValuesL
                del ptsPerPart
                del polyline
                del subValuesL_filtered
                del shapesL_filtered
            subShape = None
    
    shapefile.Close()  # naknadno dodat - proveriti da li pravi neke probleme
    fixedShapefile.Close()
    reprojectedShapefile.Close()
    
    
    if (shapes.DataCount == 0):
        # this may happen if ids supplied to the "osm_id_Only_" and/or "osm_way_id_Only_" inputs of "OSM ids" component can not be found in this _location and/or radius_ (they may correspond to other _location and/or radius_)
        shortenedName_keys = values = shapes = None
        validShapes = False
        printMsg = "The ids you supplied through \"osm_id_Only_\" and/or \"osm_way_id_Only_\" inputs do not exist for this \"_location\" and/or \"radius_\" inputs.\nTry removing the ids from the \"osm_id_Only_\" and/or \"osm_way_id_Only_\" inputs of \"OSM ids\" component."
        
        return shortenedName_keys, values, shapes, validShapes, printMsg
    
    
    validShapes = True
    printMsg = "ok"
    
    return shortenedName_keys, values, shapes, validShapes, printMsg


def titleAndBaking(locationName, locationLatitudeD, locationLongitudeD, radiusM, northDeg, originPt, shapeType, shapeTypeLabel, shapes):
    
    # title
    titleLabelText = "OSM shapes for: %s\nLatitude: %s, Longitude: %s\nRadius: %sm, North: %s, GeometryType: %s" % (locationName, locationLatitudeD, locationLongitudeD, radiusM, northDeg, shapeTypeLabel)
    customTitle = None  # "legendBakePar_" input does not exist
    
    shapesFlattenedList = []
    ptcloud = Rhino.Geometry.PointCloud()  # use it for shapeType = 2 (because Point3d class does not contain the "GetBoundingBox" method)
    for subL in shapes.Branches:
        if len(subL) > 0:
            for shape in subL:
                if shapeType == 2:
                    # points (shapeType = 2)
                    ptcloud.Add(shape)
                else:
                    # polygons, polyline (shapeType = 0, 1)
                    curve = shape.ToNurbsCurve()
                    shapesFlattenedList.append(curve)
    
    if shapeType == 2:
        titleLabelMesh, titleStartPt, titleTextSize = gismo_preparation.createTitle("mesh", [ptcloud], [titleLabelText])
    else:
        titleLabelMesh, titleStartPt, titleTextSize = gismo_preparation.createTitle("mesh", shapesFlattenedList, [titleLabelText])
    
    
    # hide titleOriginPt
    ghenv.Component.Params.Output[5].Hidden = True
    
    
    # baking
    if bakeIt_:
        layerName = locationName + "_" + str(locationLatitudeD) + "_" + str(locationLongitudeD) + "_RADIUS=" + str(radiusM) + "M" + "_NORTH=" + str(northDeg) + "_GEOMETRYTYPE=" + str(shapeType)
        
        layParentName = "GISMO"; laySubName = "OSM"; layerCategoryName = "SHAPES"
        newLayerCategory = False
        laySubName_color = System.Drawing.Color.FromArgb(100,191,70)  # green
        layerColor = System.Drawing.Color.FromArgb(0,0,0)  # black
        
        layerIndex, layerName_dummy = gismo_preparation.createLayer(layParentName, laySubName, layerCategoryName, newLayerCategory, layerName, laySubName_color, layerColor) 
        
        geometryToBakeL = shapesFlattenedList + [originPt]
        geometryIds = gismo_preparation.bakeGeometry(geometryToBakeL, layerIndex)
        
        geometryToBakeL2 = [titleLabelMesh]
        geometryIds2 = gismo_preparation.bakeGeometry(geometryToBakeL2, layerIndex)
        
        # grouping
        groupIndex = gismo_preparation.groupGeometry("OSM_SHAPES" + "_" + layerName + "_shapesOnly", geometryIds)
        groupIndex2 = gismo_preparation.groupGeometry("OSM_SHAPES" + "_" + layerName + "_shapesAndTitleOrigin_", geometryIds2)
    
    
    # deleting
    del shapes; del ptcloud; del shapesFlattenedList
    
    return titleLabelMesh, titleStartPt


def printOutput(locationName, locationLatitudeD, locationLongitudeD, radiusM, northDeg, originPt, requiredKeys, shapeType, osm_id_Only, osm_way_id_Only, osm_id_Remove, osm_way_id_Remove):
    if bakeIt_ == True:
        bakedOrNot = "and baked "
    elif bakeIt_ == False:
        bakedOrNot = ""
    resultsCompletedMsg = "OSM shapes component results successfully completed %s!" % bakedOrNot
    printOutputMsg = \
    """
Input data:

Location (deg.): %s
Latitude (deg.): %s
Longitude (deg.): %s
North (deg.): %s

Radius (m): %s
Origin: %s
Shape type: %s
Required keys: %s
Only remove Ids: %s, %s, %s, %s
    """ % (locationName, locationLatitudeD, locationLongitudeD, northDeg, radiusM, originPt, shapeType, requiredKeys, osm_id_Only, osm_way_id_Only, osm_id_Remove, osm_way_id_Remove)
    print resultsCompletedMsg
    print printOutputMsg


level = Grasshopper.Kernel.GH_RuntimeMessageLevel.Warning
if sc.sticky.has_key("gismoGismo_released"):
    validVersionDate, printMsg = sc.sticky["gismo_check"].versionDate(ghenv.Component)
    if validVersionDate:
        gismo_mainComponent = sc.sticky["gismo_mainComponent"]()
        gismo_preparation = sc.sticky["gismo_Preparation"]()
        gismo_geometry = sc.sticky["gismo_CreateGeometry"]()
        gismo_osm = sc.sticky["gismo_OSM"]()
        
        locationName, locationLatitudeD, locationLongitudeD, timeZone, elevation, validLocationData, printMsg = gismo_preparation.checkLocationData(_location)
        if validLocationData:
            fileNameIncomplete = locationName + "_" + str(locationLatitudeD) + "_" + str(locationLongitudeD)  # incomplete due to missing "_radius=100KM" part
            radiusM, northRad, northDeg, originPt, shapeType, shapeTypeLabel, requiredKeys, osm_id_Only, osm_way_id_Only, osm_id_Remove, osm_way_id_Remove, iteropMapWinGIS_dll_folderPath, unitConversionFactor, validInputData, printMsg = checkInputData(radius_, north_, origin_, shapeType_, requiredKeys_, onlyRemove_Ids_)
            if validInputData:
                if _runIt:
                    shapeFile_filePath, fullName_keys, valid_osm_or_shp_files, printMsg = checkOsmShpFiles(locationLatitudeD, locationLongitudeD, fileNameIncomplete, radiusM, requiredKeys, shapeType)
                    if valid_osm_or_shp_files:
                        shortenedName_keys, values, shapes, validShapes, printMsg = createShapesKeysValues(locationName, locationLatitudeD, locationLongitudeD, shapeFile_filePath, northRad, originPt, shapeType, osm_id_Only, osm_way_id_Only, osm_id_Remove, osm_way_id_Remove, unitConversionFactor)
                        #keys = shortenedName_keys
                        keys = fullName_keys
                        if validShapes:
                            title, titleOriginPt = titleAndBaking(locationName, locationLatitudeD, locationLongitudeD, radiusM, northDeg, originPt, shapeType, shapeTypeLabel, shapes)
                            printOutput(locationName, locationLatitudeD, locationLongitudeD, radiusM, northDeg, originPt, requiredKeys, shapeType, osm_id_Only, osm_way_id_Only, osm_id_Remove, osm_way_id_Remove)
                            gc.collect()
                        else:
                            print printMsg
                            ghenv.Component.AddRuntimeMessage(level, printMsg)
                    else:
                        print printMsg
                        ghenv.Component.AddRuntimeMessage(level, printMsg)
                else:
                    print "All inputs are ok. Please set \"_runIt\" to True, in order to run the OSM Shapes component"
            else:
                print printMsg
                ghenv.Component.AddRuntimeMessage(level, printMsg)
        else:
            print printMsg
            ghenv.Component.AddRuntimeMessage(level, printMsg)
    else:
        print printMsg
        ghenv.Component.AddRuntimeMessage(level, printMsg)
else:
    printMsg = "First please run the Gismo Gismo component."
    print printMsg
    ghenv.Component.AddRuntimeMessage(level, printMsg)
# ---------- end osmshapes ----------
# terrain
terraingenerator = Ladybug_TerrainGenerator(location=createlocation, radius=panel_3, type="1", runIt=Toggle(False))  # -> readMe, pointsGeo, pointsXY, pointsZ, tiles, imagePath, port, terrain, origin, elevation; plug-in component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
geo = Geometry(terraingenerator.terrain)

# ---- group: buildings
# 2d shapes
# 3d buildings
osmobjects = Gismo_OSMObjects({"Post office", "Office administrative", "Office government", "Residential building", "Hospital", "Ambulance station", "Pharmacy", "Police", "Fire station", "Museum"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}, selected="Building")
osmkeys = Gismo_OSMKeys(OSMobjectName=osmobjects)  # -> readMe, requiredKeys, OSMwebpage
# ---------- osmkeys: Python ----------
# OSM keys
#
# Gismo is a plugin for GIS environmental analysis (GPL) started by Djordje Spasic.
#
# This file is part of Gismo.
#
# Copyright (c) 2017, Djordje Spasic <djordjedspasic@gmail.com>
# Component icon based on free OSM icon from: <https://icons8.com/web-app/13398/osm>
#
# Gismo is free software: you can redistribute it and/or modify it under the terms of the GNU General Public License as published by the Free Software Foundation, either version 3 of the License, or (at your option) any later version.
#
# Gismo is distributed in the hope that it will be useful, but WITHOUT ANY WARRANTY; without even the implied warranty of MERCHANTABILITY or FITNESS FOR A PARTICULAR PURPOSE. See the GNU General Public License for more details.
#
# You should have received a copy of the GNU General Public License along with this program. If not, see http://www.gnu.org/licenses/.
#
# The GPL-3.0+ license <http://spdx.org/licenses/GPL-3.0+>

"""
Use this component to generate a list of keys for the "requiredKeys_" input of "OSM shapes" component.
A list of keys depends on the chosen OSM object name (_OSMobjectName). Use "OSM Objects" dropdown list to generate the appropriate _OSMobjectName.
-
Provided by Gismo 0.0.1
    
    input:
        _OSMobjectName: OSM object name.
                        Use "OSM Objects" dropdown list to generate it.
    
    output:
        readMe!: ...
        requiredKeys: A list of keys for the chosen OSM object name (_OSMobjectName).
                      Supply it to the "requiredKeys_" input of "OSM shapes" component.
        OSMwebpage: Webpage containing detailed information about the chosen _OSMobjectName.
"""

ghenv.Component.Name = "Gismo_OSM Keys"
ghenv.Component.NickName = "OSMKeys"
ghenv.Component.Message = "VER 0.0.1\nFEB_18_2017"
ghenv.Component.IconDisplayMode = ghenv.Component.IconDisplayMode.application
ghenv.Component.Category = "Gismo"
ghenv.Component.SubCategory = "1 | OpenStreetMap"
#compatibleGismoVersion = VER 0.0.1\nJAN_29_2017
try: ghenv.Component.AdditionalHelpFromDocStrings = "2"
except: pass

import scriptcontext as sc
import Grasshopper
import System
import Rhino
import math


def main(OSMobjectName):
    
    # check _OSMobjectName
    if (OSMobjectName == None):
        requiredKeys = OSMwebpage = None
        validInputData = False
        printMsg = "Supply name to \"_OSMobjectName\" input by using \"OSM Objects\" dropdown list."
        return requiredKeys, OSMwebpage, validInputData, printMsg
    
    
    requiredKeys_dictionary = {
    """Post office""" :
    ["name",
    "name:en",
    "amenity",
    "addr:country",
    "addr:city",
    "addr:postcode",
    "addr:street",
    "addr:housenumber",
    "contact",
    "phone",
    "website",
    "opening_hours",
    "wheelchair",
    "ref",
    "ref:FR:LaPoste",
    "atm",
    "change_machine",
    "operator",
    "http://wiki.openstreetmap.org/wiki/Tag:amenity%3Dpost_office"]
    ,
    """Office administrative""" :
    ["name",
    "name:en",
    "office",
    "addr:country",
    "addr:city",
    "addr:postcode",
    "addr:street",
    "addr:housenumber",
    "phone",
    "opening_hours",
    "wheelchair",
    "operator",
    "http://wiki.openstreetmap.org/wiki/Tag:office%3Dadministrative"]
    ,
    """Office government""" :
    ["name",
    "name:en",
    "amenity",
    "office",
    "government",
    "admin_level",
    "addr:country",
    "addr:city",
    "addr:postcode",
    "addr:street",
    "addr:housenumber",
    "phone",
    "opening_hours",
    "wheelchair",
    "http://wiki.openstreetmap.org/wiki/Tag:office%3Dgovernment"]
    ,
    """Residential building""" :
    ["name",
    "name:en",
    "building",
    "addr:country",
    "addr:city",
    "addr:postcode",
    "addr:street",
    "addr:housenumber",
    "building:levels",
    "building:flats",
    "building:roof",
    "building:colour",
    "building:ruian:type",
    "roof:shape",
    "roof:colour",
    "roof:material",
    "ref:ruian:building",
    "source",
    "http://wiki.openstreetmap.org/wiki/Tag:building%3Dresidential"]
    ,
    """Hospital""" :
    ["name",
    "name:en",
    "amenity",
    "beds",
    "emergency",
    "addr:country",
    "addr:city",
    "addr:postcode",
    "addr:street",
    "addr:housenumber",
    "phone",
    "height",
    "building:levels",
    "min_height",
    "building",
    "entrance",
    "roof:shape",
    "start_date",
    "source",
    "http://wiki.openstreetmap.org/wiki/Tag:amenity%3Dhospital"]
    ,
    """Ambulance station""" :
    ["name",
    "name:en",
    "amenity",
    "beds",
    "emergency",
    "addr:country",
    "addr:city",
    "addr:postcode",
    "addr:street",
    "addr:housenumber",
    "phone",
    "height",
    "building:levels",
    "min_height",
    "building",
    "entrance",
    "source",
    "http://wiki.openstreetmap.org/wiki/Tag:emergency%3Dambulance_station"]
    ,
    """Pharmacy""" :
    ["name",
    "name:en",
    "amenity",
    "addr:country",
    "addr:city",
    "addr:postcode",
    "addr:street",
    "addr:housenumber",
    "phone",
    "website",
    "contact",
    "building",
    "brand",
    "opening_hours",
    "drive_through",
    "wheelchair",
    "dispensing",
    "shop",
    "vending",
    "operator",
    "source",
    "http://wiki.openstreetmap.org/wiki/Tag:amenity%3Dpharmacy"]
    ,
    """Police""" :
    ["name",
    "name:en",
    "amenity",
    "addr:country",
    "addr:city",
    "addr:postcode",
    "addr:street",
    "addr:housenumber",
    "contact",
    "phone",
    "website",
    "opening_hours",
    "wheelchair",
    "http://wiki.openstreetmap.org/wiki/Tag:amenity%3Dpolice"]
    ,
    """Fire station""" :
    ["name",
    "name:en",
    "amenity",
    "addr:country",
    "addr:city",
    "addr:postcode",
    "addr:street",
    "addr:housenumber",
    "contact",
    "phone",
    "operator",
    "http://wiki.openstreetmap.org/wiki/Tag:amenity%3Dfire_station"]
    ,
    """Museum""" :
    ["name",
    "name:en",
    "amenity",
    "tourism",
    "addr:country",
    "addr:city",
    "addr:postcode",
    "addr:street",
    "addr:housenumber",
    "phone",
    "opening_hours",
    "website",
    "entrance",
    "wheelchair",
    "subject",
    "shop",
    "operator",
    "http://wiki.openstreetmap.org/wiki/Tag:tourism%3Dmuseum"]
    ,
    """Theatre""" :
    ["name",
    "name:en",
    "amenity",
    "theatre:genre",
    "addr:country",
    "addr:city",
    "addr:postcode",
    "addr:street",
    "addr:housenumber",
    "phone",
    "website",
    "entrance",
    "wheelchair",
    "operator",
    "http://wiki.openstreetmap.org/wiki/Tag:amenity%3Dtheatre"]
    ,
    """Library""" :
    ["name",
    "name:en",
    "amenity",
    "tourism",
    "ref:isil",
    "addr:country",
    "addr:city",
    "addr:postcode",
    "addr:street",
    "addr:housenumber",
    "opening_hours",
    "shop",
    "entrance",
    "wheelchair",
    "operator",
    "http://wiki.openstreetmap.org/wiki/Tag:amenity%3Dlibrary"]
    ,
    """Book store""" :
    ["name",
    "name:en",
    "amenity",
    "shop",
    "addr:country",
    "addr:city",
    "addr:postcode",
    "addr:street",
    "addr:housenumber",
    "phone",
    "website",
    "opening_hours",
    "wheelchair",
    "brand",
    "books",
    "second_hand",
    "operator",
    "http://wiki.openstreetmap.org/wiki/Tag:shop%3Dbooks"]
    ,
    """College""" :
    ["name",
    "name:en",
    "amenity",
    "addr:country",
    "addr:city",
    "addr:postcode",
    "addr:street",
    "addr:housenumber",
    "phone",
    "website",
    "opening_hours",
    "entrance",
    "wheelchair",
    "operator",
    "http://wiki.openstreetmap.org/wiki/Tag:amenity%3Dcollege"]
    ,
    """University""" :
    ["name",
    "name:en",
    "amenity",
    "addr:country",
    "addr:city",
    "addr:postcode",
    "addr:street",
    "addr:housenumber",
    "phone",
    "website",
    "faculty",
    "department",
    "opening_hours",
    "entrance",
    "wheelchair",
    "landuse",
    "residential",
    "highway",
    "operator",
    "wiki.openstreetmap.org/wiki/Tag:amenity=university"]
    ,
    """School""" :
    ["name",
    "name:en",
    "amenity",
    "addr:country",
    "addr:city",
    "addr:postcode",
    "addr:street",
    "addr:housenumber",
    "phone",
    "website",
    "capacity",
    "isced:level",
    "fee",
    "religion",
    "denomination",
    "ref",
    "contact",
    "leisure",
    "landuse",
    "min_age",
    "max_age",
    "sport",
    "surface",
    "barrier",
    "entrance",
    "wheelchair",
    "operator",
    "http://wiki.openstreetmap.org/wiki/Tag:amenity%3Dschool"]
    ,
    """Kindergarten""" :
    ["name",
    "name:en",
    "amenity",
    "addr:country",
    "addr:city",
    "addr:postcode",
    "addr:street",
    "addr:housenumber",
    "phone",
    "website",
    "capacity",
    "isced:level",
    "fee",
    "religion",
    "denomination",
    "ref",
    "contact",
    "leisure",
    "landuse",
    "min_age",
    "max_age",
    "sport",
    "surface",
    "barrier",
    "entrance",
    "wheelchair",
    "access",
    "operator",
    "http://wiki.openstreetmap.org/wiki/Tag:amenity%3Dkindergarten"]
    ,
    # ------------
    """Playground""" :
    ["name",
    "name:en",
    "amenity",
    "leisure",
    "tourism",
    "opening_hours",
    "wheelchair",
    "natural",
    "barrier",
    "surface",
    "baby",
    "walking_disability",
    "sitting_disability",
    "blind",
    "min_age",
    "max_age",
    "centralkey",
    "access",
    "fee",
    "supervised",
    "operator",
    "http://wiki.openstreetmap.org/wiki/Tag:leisure%3Dplayground"]
    ,
    """Sports center""" :
    ["name",
    "name:en",
    "amenity",
    "leisure",
    "landuse",
    "sport",
    "address",
    "building",  # this is not a mistake!
    "operator",
    "http://wiki.openstreetmap.org/wiki/Tag:leisure%3Dsports_centre"]
    ,
    """Stadium""" :
    ["name",
    "name:en",
    "amenity",
    "leisure",
    "capacity",
    "sport",
    "addr:country",
    "addr:city",
    "addr:postcode",
    "addr:street",
    "addr:housenumber",
    "building",  # this is not a mistake!
    "entrance",
    "start_date",
    "owner",
    "operator",
    "http://wiki.openstreetmap.org/wiki/Tag:leisure%3Dstadium"]
    ,
    """Park""" :
    ["name",
    "name:en",
    "amenity",
    "leisure",
    "landuse",
    "boundary",
    "highway",
    "http://wiki.openstreetmap.org/wiki/Tag:leisure%3Dpark"]
    ,
    """Garden""" :
    ["name",
    "leisure",
    "garden:type",
    "garden:style",
    "access",
    "http://wiki.openstreetmap.org/wiki/Tag:leisure%3Dgarden"]
    ,
    """Camping site""" :
    ["name",
    "name:en",
    "fee",
    "opening_hours",
    "phone",
    "website",
    "addr:country",
    "addr:city",
    "addr:postcode",
    "addr:street",
    "addr:housenumber",
    "tents",
    "caravans",
    "openfire",
    "backcountry",
    "scout",
    "group_only",
    "impromptu",
    "camp_site",
    "drinking_water",
    "sanitary_dump_station",
    "internet_access",
    "internet_access:fee",
    "http://wiki.openstreetmap.org/wiki/Tag:tourism%3Dcamp_site"]
    ,
    """Forest""" :
    ["name",
    "name:en",
    "natural",
    "leaf_type",
    "leaf_cycle",
    "crop",
    "http://wiki.openstreetmap.org/wiki/Tag:landuse%3Dforest"]
    ,
    """Grassland""" :
    ["name",
    "name:en",
    "natural",
    "grassland",
    "landuse",
    "managed",
    "surface",
    "operator",
    "http://wiki.openstreetmap.org/wiki/Tag:natural%3Dgrassland"]
    ,
    # ------------
    """Cafe""" :
    ["name",
    "name:en",
    "amenity",
    "addr:country",
    "addr:city",
    "addr:postcode",
    "addr:street",
    "addr:housenumber",
    "phone",
    "website",
    "opening_hours",
    "internet_access",
    "wheelchair",
    "smoking",
    "self_service",
    "takeaway",
    "outdoor_seating",
    "cuisine",
    "diet",
    "breakfast",
    "lunch",
    "ice_cream",
    "operator",
    "http://wiki.openstreetmap.org/wiki/Tag:amenity%3Dcafe"]
    ,
    """Bar""" :
    ["name",
    "name:en",
    "amenity",
    "addr:country",
    "addr:city",
    "addr:postcode",
    "addr:street",
    "addr:housenumber",
    "contact",
    "phone",
    "internet_access",
    "opening_hours",
    "cuisine",
    "drink",
    "brewery",
    "microbrewery",
    "smoking",
    "wheelchair",
    "food",
    "cocktails",
    "beer_garden",
    "leisure",
    "outdoor_seating",
    "real_ale",
    "real_cider",
    "accommodation",
    "camra",
    "real_fire",
    "operator",
    "http://wiki.openstreetmap.org/wiki/Tag:amenity%3Dbar"]
    ,
    """Pub""" :  #(the same as for bar)
    ["name",
    "name:en",
    "amenity",
    "addr:country",
    "addr:city",
    "addr:postcode",
    "addr:street",
    "addr:housenumber",
    "contact",
    "phone",
    "internet_access",
    "opening_hours",
    "cuisine",
    "drink",
    "brewery",
    "microbrewery",
    "smoking",
    "wheelchair",
    "food",
    "cocktails",
    "beer_garden",
    "leisure",
    "outdoor_seating",
    "real_ale",
    "real_cider",
    "accommodation",
    "camra",
    "real_fire",
    "operator",
    "http://wiki.openstreetmap.org/wiki/Tag:amenity%3Dpub"]
    ,
    """Winery""" :
    ["name",
    "name:en",
    "amenity",
    "shop",
    "landuse",
    "addr:country",
    "addr:city",
    "addr:postcode",
    "addr:street",
    "addr:housenumber",
    "opening_hours",
    "entrance",
    "wheelchair",
    "operator",
    "http://wiki.openstreetmap.org/wiki/Tag:craft%3Dwinery"]
    ,
    """Restaurant""" :
    ["name",
    "name:en",
    "amenity",
    "addr:country",
    "addr:city",
    "addr:postcode",
    "addr:street",
    "addr:housenumber",
    "contact",
    "phone",
    "internet_access",
    "opening_hours",
    "stars",
    "cuisine",
    "leisure",
    "outdoor_seating",
    "cocktails",
    "diet",
    "opening_hours",
    "brewery",
    "microbrewery",
    "smoking",
    "wheelchair",
    "takeaway",
    "delivery",
    "drive_through",
    "reservation",
    "operator",
    "http://wiki.openstreetmap.org/wiki/Tag:amenity%3Drestaurant"]
    ,
    """Supermarket""" :
    ["name",
    "name:en",
    "amenity",
    "shop",
    "addr:country",
    "addr:city",
    "addr:postcode",
    "addr:street",
    "addr:housenumber",
    "phone",
    "website",
    "opening_hours",
    "wheelchair",
    "organic",
    "membership",
    "bulk_purchase",
    "operator",
    "http://wiki.openstreetmap.org/wiki/Tag:shop%3Dsupermarket"]
    ,
    """Public market""" :
    ["name",
    "name:en",
    "amenity",
    "shop",
    "addr:country",
    "addr:city",
    "addr:postcode",
    "addr:street",
    "addr:housenumber",
    "phone",
    "website",
    "opening_hours",
    "wheelchair",
    "building",  # this is not a mistake!
    "highway",
    "organic",
    "operator",
    "http://wiki.openstreetmap.org/wiki/Tag:amenity%3Dmarketplace"]
    ,
    """Mall""" :
    ["name",
    "name:en",
    "amenity",
    "shop",
    "addr:country",
    "addr:city",
    "addr:postcode",
    "addr:street",
    "addr:housenumber",
    "phone",
    "website",
    "opening_hours",
    "wheelchair",
    "building",  # this is not a mistake!
    "landuse",
    "operator",
    "http://wiki.openstreetmap.org/wiki/Tag:shop%3Dmall"]
    ,
    """Hostel""" :
    ["name",
    "name:en",
    "tourism",
    "stars",
    "rooms",
    "beds",
    "wheelchair",
    "addr:country",
    "addr:city",
    "addr:postcode",
    "addr:street",
    "addr:housenumber",
    "phone",
    "internet_access",
    "internet_access:fee",
    "smoking",
    "lacounty:ain",
    "lacounty:bld_id",
    "height",
    "building:levels",
    "min_height",
    "building",
    "ruian:building",
    "building:ruian:type",
    "building:units",
    "entrance",
    "website",
    "start_date",
    "ele",
    "operator",
    "source",
    "http://wiki.openstreetmap.org/wiki/Tag:tourism%3Dhostel"]
    ,
    """Hotel""" :  # (the same as hotel)
    ["name",
    "name:en",
    "tourism",
    "stars",
    "rooms",
    "beds",
    "wheelchair",
    "addr:country",
    "addr:city",
    "addr:postcode",
    "addr:street",
    "addr:housenumber",
    "phone",
    "internet_access",
    "internet_access:fee",
    "smoking",
    "lacounty:ain",
    "lacounty:bld_id",
    "height",
    "building:levels",
    "min_height",
    "building",
    "ruian:building",
    "building:ruian:type",
    "building:units",
    "entrance",
    "website",
    "start_date",
    "ele",
    "operator",
    "source",
    "http://wiki.openstreetmap.org/wiki/Tag:tourism%3Dhotel"]
    ,
    """Casino""" :
    ["name",
    "name:en",
    "amenity",
    "leisure",
    "addr:country",
    "addr:city",
    "addr:postcode",
    "addr:street",
    "addr:housenumber",
    "contact",
    "phone",
    "website",
    "internet_access",
    "opening_hours",
    "wheelchair",
    "smoking",
    "shop",
    "operator",
    "http://wiki.openstreetmap.org/wiki/Tag:amenity%3Dcasino"]
    ,
    # ------------
    """Road""" :
    ["name",
    "name:en",
    "ref",
    "alt_name",
    "old_name",
    "highway",
    "railway",
    "bridge",
    "tunnel",
    "layer",
    "tracktype",
    "access",
    "fee",
    "construction",
    "minspeed",
    "maxspeed",
    "maxheight",
    "maxwidth",
    "maxweight",
    "foot",
    "bicycle",
    "bus",
    "cycleway",
    "motorcar",
    "horse",
    "hov",
    "hgv",
    "surface",
    "tracktype",
    "width",
    "lit",
    "traffic_calming",
    "parking:condition",
    "parking:lane",
    "lanes",
    "lanes:forward",
    "lanes:backward",
    "oneway",
    "turn:lanes",
    "sidewalk",
    "crossing",
    "http://wiki.openstreetmap.org/wiki/Key:highway"]
    ,
    """Railway""" :
    ["name",
    "name:en",
    "railway",
    "gauge",
    "electrified",
    "frequency",
    "voltage",
    "usage",
    "service",
    "rack",
    "electrified",
    "gauge",
    "frequency",
    "voltage",
    "rack",
    "bridge",
    "tunnel",
    "http://wiki.openstreetmap.org/wiki/Key:railway"]
    ,
    """Footway""" :
    ["name",
    "name:en",
    "highway",
    "footway",
    "foot",
    "access",
    "lit",
    "wheelchair",
    "sidewalk",
    "bicycle",
    "layer",
    "surface",
    "smoothness",
    "incline",
    "width",
    "sac_scale",
    "trail_visibility",
    "kerb",
    "crossing",
    "crossing_ref",
    "http://wiki.openstreetmap.org/wiki/Tag:highway%3Dfootway"]
    ,
    """Pedestrian zone""" :
    ["name",
    "name:en",
    "highway",
    "sidewalk",
    "bicycle",
    "motorcar",
    "motorcycle",
    "layer",
    "surface",
    "smoothness",
    "incline",
    "width",
    "ref",
    "http://wiki.openstreetmap.org/wiki/Tag:highway%3Dpedestrian"]
    ,
    """Aeroway""" :  # airports/aerodromes, grass airplane take off strips...
    ["name",
    "name:en",
    "aeroway",
    "iata",
    "faa",
    "IFR",
    "icao",
    "addr:country",
    "addr:city",
    "addr:postcode",
    "addr:street",
    "addr:housenumber",
    "phone",
    "aerodrome:type",
    "variation",
    "ele",
    "operator",
    "http://wiki.openstreetmap.org/wiki/Tag:aeroway%3Daerodrome"]
    ,
    """Bicycle parking""" :
    ["name",
    "name:en",
    "amenity",
    "highway",
    "fee",
    "addr:country",
    "addr:city",
    "addr:postcode",
    "addr:street",
    "addr:housenumber",
    "covered",
    "access",
    "capacity",
    "bicycle_parking",
    "cyclestreets_id",
    "maxstay",
    "surveillance",
    "operator",
    "http://wiki.openstreetmap.org/wiki/Tag:amenity%3Dbicycle_parking"]
    ,
    """Bicycle rental""" :
    ["name",
    "name:en",
    "amenity",
    "addr:country",
    "addr:city",
    "addr:postcode",
    "addr:street",
    "addr:housenumber",
    "shop",
    "ref",
    "capacity",
    "network",
    "operator",
    "http://wiki.openstreetmap.org/wiki/Tag:amenity%3Dbicycle_rental"]
    ,
    """Fuel""" :  #(fuel station, filling station, petrol station, gas station and petrol garage)
    ["name",
    "name:en",
    "amenity",
    "addr:country",
    "addr:city",
    "addr:postcode",
    "addr:street",
    "addr:housenumber",
    "opening_hours",
    "wheelchair",
    "opening_hours",
    "payment:cash",
    "payment:mastercard",
    "payment:visa",
    "payment:diners_club",
    "payment:american_express",
    "payment:maestro",
    "payment:dkv",
    "payment:uta",
    "fuel:diesel",
    "fuel:octane_91",
    "fuel:octane_95",
    "fuel:octane_98",
    "fuel:e10",
    "fuel:lpg",
    "building",
    "highway",
    "access",
    "covered",
    "access",
    "shop",
    "sanitary_dump_station",
    "surface",
    "brand",
    "operator",
    "tenant",
    "http://wiki.openstreetmap.org/wiki/Tag:amenity%3Dfuel"]
    ,
    """Parking""" :  #(facility use by the public or by customers or other authorised users for the parking of cars, trucks, motorcycles, etc.)
    ["name",
    "name:en",
    "amenity",
    "parking",
    "tourism",
    "landuse",
    "addr:country",
    "addr:city",
    "addr:postcode",
    "addr:street",
    "addr:housenumber",
    "building",  # this is not a mistake!
    "park_ride",
    "parking:lane",
    "parking:condition",
    "ref",
    "access",
    "highway",
    "multi-storey",
    "underground",
    "rooftop",
    "sheds",
    "carports",
    "garage_boxes",
    "park_ride",
    "fee",
    "supervised",
    "capacity",
    "capacity:disabled",
    "capacity:parent",
    "capacity:charging",
    "maxstay",
    "maxheight",
    "opening_hours",
    "lit",
    "surface",
    "vending",
    "operator",
    "http://wiki.openstreetmap.org/wiki/Tag:amenity%3Dparking"]
    ,
    """Garage""" :
    ["name",
    "name:en",
    "amenity",
    "landuse",
    "addr:country",
    "addr:city",
    "addr:postcode",
    "addr:street",
    "addr:housenumber",
    "building",  # this is not a mistake!
    "highway",
    "multi-storey",
    "underground",
    "rooftop",
    "garage_boxes",
    "fee",
    "supervised",
    "capacity",
    "capacity:disabled",
    "capacity:parent",
    "capacity:charging",
    "maxstay",
    "maxheight",
    "opening_hours",
    "lit",
    "surface",
    "vending",
    "operator",
    "http://wiki.openstreetmap.org/wiki/Tag:landuse%3Dgarages"]
    ,
    """Subway entrances""" :
    ["name",
    "name:en",
    "addr:country",
    "addr:city",
    "addr:postcode",
    "addr:street",
    "addr:housenumber",
    "railway",
    "public_transport",
    "ref",
    "bicycle",
    "wheelchair",
    "barrier",
    "oneway",
    "http://wiki.openstreetmap.org/wiki/Tag:railway%3Dsubway_entrance"]
    ,
    # ------------
    """Construction area""" :
    ["name",
    "name:en",
    "landuse",
    "building",
    "construction",
    "end_date",
    "operator",
    "http://wiki.openstreetmap.org/wiki/Tag:landuse%3Dconstruction"]
    ,
    """Archaeological site""" :
    ["name",
    "name:en",
    "historic",
    "historic:civilization",
    "natural",
    "site_type",
    "fortification_type",
    "opening_hours",
    "wheelchair",
    "sprockhoff",
    "ref:mhs",
    "moved",
    "megalith_type",
    "field",
    "tomb",
    "http://wiki.openstreetmap.org/wiki/Tag:historic%3Darchaeological_site"]
    ,
    """Fountain""" :
    ["name",
    "name:en",
    "amenity",
    "natural",
    "man_made",
    "drinking_water",
    "lit",
    "http://wiki.openstreetmap.org/wiki/Tag:amenity%3Dfountain"]
    ,
    """Wind turbine""" :
    ["power",
    "name",
    "name:en",
    "ref",
    "branch",
    "height",
    "rotor:diameter",
    "start_date",
    "generator:type",
    "generator:source",
    "generator:plant",
    "generator:output:biogas",
    "generator:output:electricity",
    "generator:output:hot_water",
    "generator:output:hot_air",
    "generator:output:cold_water",
    "generator:output:cold_air",
    "generator:output:compress_air",
    "generator:output:stream",
    "generator:output:vacuum",
    "voltage",
    "frequency",
    "operator",
    "http://wiki.openstreetmap.org/wiki/Tag:power%3Dgenerator"]
    ,
    """Plant""" :
    ["power",
    "name",
    "name:en",
    "ref",
    "height",
    "start_date",
    "type",
    "landuse",
    "waterway",
    "plant:output:electricity",
    "plant:output:hot_water",
    "plant:output:hot_air",
    "plant:output:cold_water",
    "plant:output:cold_air",
    "plant:output:compress_air",
    "plant:output:stream",
    "plant:output:vacuum",
    "voltage",
    "frequency",
    "operator",
    "http://wiki.openstreetmap.org/wiki/Tag:power%3Dplant"]
    ,
    """Nuclear reactor""" :
    ["power",
    "name",
    "name:en",
    "ref",
    "branch",
    "height",
    "start_date",
    "generator:type",
    "generator:source",
    "generator:plant",
    "generator:output:biogas",
    "generator:output:electricity",
    "generator:output:hot_water",
    "generator:output:hot_air",
    "generator:output:cold_water",
    "generator:output:cold_air",
    "generator:output:compress_air",
    "generator:output:stream",
    "generator:output:vacuum",
    "voltage",
    "frequency",
    "operator",
    "http://wiki.openstreetmap.org/wiki/Tag:power%3Dgenerator"]
    ,
    # ------------
    """Internet access""" :
    ["name",
    "name:en",
    "amenity",
    "tourism",
    "addr:country",
    "addr:city",
    "addr:postcode",
    "addr:street",
    "addr:housenumber",
    "internet_access",
    "wifi",
    "http://wiki.openstreetmap.org/wiki/Key:internet_access"]
    ,
    """Toilet""" :
    ["name",
    "name:en",
    "toilets",
    "amenity",
    "addr:country",
    "addr:city",
    "addr:postcode",
    "addr:street",
    "addr:housenumber",
    "access",
    "description",
    "drinking_water",
    "fee",
    "indoor",
    "opening_hours",
    "supervised",
    "wheelchair",
    "diaper",
    "entrance",
    "female",
    "male",
    "unisex",
    "toilets:disposal",
    "composting",
    "man_made",
    "operator",
    "http://wiki.openstreetmap.org/wiki/Tag:amenity%3Dtoilets"]
    ,
    """Building""" :
    ["name",
    "name:en",
    "building",
    "amenity",
    "addr:country",
    "addr:city",
    "addr:postcode",
    "addr:street",
    "addr:housenumber",
    "height",
    "building:levels",
    "building:min_level",
    "building:part",
    "min_height",
    "roof:height",
    "roof:shape",
    "roof:angle",
    "roof:material",
    "roof:color",
    "roof:levels",
    "entrance",
    "access",
    "http://wiki.openstreetmap.org/wiki/Buildings"]
    ,
    """Tree""" :
    ["name",
    "name:en",
    "natural",
    "landuse",
    "leaf_type",
    "leaf_cycle",
    "height",
    "circumference",
    "diameter_crown",
    "type",
    "genus",
    "species",
    "species:en",
    "taxon",
    "sex",
    "denotation",
    "historic",
    "http://wiki.openstreetmap.org/wiki/Tag:natural%3Dtree"]
    }
    
    if requiredKeys_dictionary.has_key(OSMobjectName):
        requiredKeys_unsliced = requiredKeys_dictionary[OSMobjectName]
        OSMwebpage = requiredKeys_unsliced[-1]
        requiredKeys = requiredKeys_unsliced[:-1]
    else:
        # "_OSMobjectName" does not exist in upper "requiredKeys_dictionary"
        requiredKeys = OSMwebpage = None
        validInputData = False
        printMsg = "Supplied \"_OSMobjectName\" does not exist among this component's data.\n" + \
                   "Try creating your own \"requiredKeys\" output manually by looking at:\n \n" + \
                   "http://taginfo.openstreetmap.org/keys"
        return requiredKeys, OSMwebpage, validInputData, printMsg
    
    
    resultsCompletedMsg = "OSM keys component results successfully completed!\n \nInput data:\n \nOSMobjectName: %s" % OSMobjectName
    print resultsCompletedMsg
    
    validInputData = True
    printMsg = "ok"
    
    return requiredKeys, OSMwebpage, validInputData, printMsg


level = Grasshopper.Kernel.GH_RuntimeMessageLevel.Warning
if sc.sticky.has_key("gismoGismo_released"):
    validVersionDate, printMsg = sc.sticky["gismo_check"].versionDate(ghenv.Component)
    if validVersionDate:
        requiredKeys, OSMwebpage, validInputData, printMsg = main(_OSMobjectName)
        if not validInputData:
            print printMsg
            ghenv.Component.AddRuntimeMessage(level, printMsg)
    else:
        print printMsg
        ghenv.Component.AddRuntimeMessage(level, printMsg)
else:
    printMsg = "First please run the Gismo Gismo component."
    print printMsg
    ghenv.Component.AddRuntimeMessage(level, printMsg)
# ---------- end osmkeys ----------
osmshapes_2 = Gismo_OSMShapes(
    location=createlocation,
    radius=panel_3,
    shapeType="0",
    requiredKeys=osmkeys.requiredKeys,
    bakeIt=False,
    runIt=Toggle(False))  # -> readMe, shapes, keys, values, port, titleOriginPt, title; inputs radius: Int32, origin: Point3d, shapeType: Int32, requiredKeys: list, onlyRemove_Ids: tree, bakeIt: Boolean, runIt: Boolean; same code as osmshapes
osm3d = Gismo_OSM3D(
    shapes=osmshapes_2.shapes,
    keys=osmshapes_2.keys,
    values=osmshapes_2.values,
    randomHeightRange="10 to 20",
    treeType=2,
    groundTerrain=geo,
    bakeIt=False,
    runIt=Toggle(False))  # -> readMe, threeDeeShapes, threeDeeKeys, threeDeeValues, height; inputs shapes: tree of GeometryBase, keys: list, values: tree, onlyRemove_Ids: tree, treeType: Int32, groundTerrain: Brep, bakeIt: Boolean, runIt: Boolean
# ---------- osm3d: Python ----------
# OSM 3D
#
# Gismo is a plugin for GIS environmental analysis (GPL) started by Djordje Spasic.
#
# This file is part of Gismo.
#
# Copyright (c) 2017, Djordje Spasic <djordjedspasic@gmail.com>
# with assistance of Vladimir Elistratov and his Blender OSM project <https://github.com/vvoovv/blender-osm>
# Component icon based on free OSM icon from: <https://icons8.com/web-app/13398/osm> and <http://www.freeiconspng.com/free-images/3d-icon-9783>
#
# Gismo is free software: you can redistribute it and/or modify it under the terms of the GNU General Public License as published by the Free Software Foundation, either version 3 of the License, or (at your option) any later version.
#
# Gismo is distributed in the hope that it will be useful, but WITHOUT ANY WARRANTY; without even the implied warranty of MERCHANTABILITY or FITNESS FOR A PARTICULAR PURPOSE. See the GNU General Public License for more details.
#
# You should have received a copy of the GNU General Public License along with this program. If not, see http://www.gnu.org/licenses/.
#
# The GPL-3.0+ license <http://spdx.org/licenses/GPL-3.0+>

"""
Use this component to create 3d geometry of structures/building and tree shapes created with Gismo "OSM shapes" component.
Creation of 3d shapes can be done in three ways:
1) If there is a valid value (not equal to "") for the "height" key, then the shape will always be extruded according to this value.
2) If this value is lacking (equal to ""), then the shape can be extruded according to the "building:levels" key value.
3) If both of these two values are lacking (equal to ""), or the very keys are lacking, and there is a valid value ("True") for the "building" key, then the shape will be extruded, according to the supplied domain generated from the randomHeightRange_ input.
If neither of these three ways are fulfilled, then no creation of 3d shapes will be performed.
-
Provided by Gismo 0.0.1
    
    input:
        _shapes: Plug in the shapes from the Gismo OSM shapes "shapes" output
        _keys: Plug in the keys from the Gismo OSM shapes "keys" output.
        _values: Plug in the values from the Gismo OSM shapes "values" output.
        onlyRemove_Ids_: Use this input to define lists of Open Street Map ids. "OSM ids" component will generate them.
                         These lists can be used to define:
                         1) only those ids which will be included (isolated) when "OSM 3D" component is ran (use "osm_id_Only" and "osm_way_id_Only" inputs for this).
                         2) ids which will be removed when "OSM 3D" component is ran (use "osm_id_Remove" and "osm_way_id_Remove" inputs for this).
                         3) you can combine 1) and 2) and both define the: included and removed ids.
                         -
                         If nothing supplied to this input, then no OSM ids will be isolated nor removed: meaning all of them will be included.
        heightPerLevel_: Some supplied "_shapes" may contain "building_l" keys. This can be used to extrude those buildings, by supplying the height value of each level (above ground) in Rhino document units (meters, feets...).
                         -
                         If nothing supplied, the default value of 3 meters (9.84 feets) per level will be used.
                         -
                         In Rhino document units (meters, feets...).
        randomHeightRange_: This output can be useful if supplied "_shapes" do not contain valid values for "height" and "building_l" keys.
                            If they still contain the "building" key with value "True", then this can be used to extrude the shapes, by using some random extrude domain.
                            So to randomly extrude "buildings" shapes, just supply the "Construct Domain" to the randomHeightRange_ input. For example, input the "Construct Domain" component by using "20" and "30" as its starting and ending domain values. This will randomly extrude all buildings by 20 to 30 meters height. Of course in case the Rhino document units is: meters. It can be any other unit.
                            -
                            If nothing supplied, no random extrusion of the shapes will be applied.
                            -
                            Domain in Rhino document units (meters, feets...).
        treeType_: There are three tree geometric types:
                   0 - round
                   1 - polygonized
                   2 - random shaped
                   -
                   If nothing supplied, the default type 2 type (random) will be used.
                   -
                   Integer.
        groundTerrain_: The ground terrain surface on which the "threeDeeShapes" will be laid onto.
                        Supply it by using "terrain" output of the Ladybug "Terrain Generator" (type_ = 1) or Gismo "Terrain Generator" (type_ = 2 or type_ = 3) components.
                        -
                        If nothing supplied, the "threeDeeShapes" will always be laid flat onto a horizontal plane, with plane origin being the "origin" input of the "OSM shapes" component.
        bakeIt_: Set to "True" to bake the extruded _shape geometry into the Rhino scene.
                 The geometry will be grouped. To ungroup it, select it and call the "Ungroup" Rhino command.
                 -
                 If not supplied default value "False" will be used.
        _runIt: ...
    
    output:
        readMe!: ...
        threeDeeValues: Generated 3d shapes from the inputted "_shapes".
                        -
                        Those can be extruded buildings, or trees.
                        -
                        If 3d shape has not been created then that branch will be empty.
                        Use "Clean Tree" component and set the "E" input to "True" to remove all these empty branches.
        threeDeeKeys: A list of keys. This output is the same as "keys" output of "OSM shapes" component.
        threeDeeValues: Values corresponding to each shape in "threeDeeValues" output.
                        -
                        If 3d shape has not been created then that branch will not have any values (it will be empty).
                        Use "Clean Tree" component and set the "E" input to "True" to remove all these empty branches.
        height: The height of each shape from the "threeDeeShapes" output.
                -
                In Rhino document units (meters, feets...).
"""

ghenv.Component.Name = "Gismo_OSM 3D"
ghenv.Component.NickName = "OSM3D"
ghenv.Component.Message = "VER 0.0.1\nFEB_09_2017"
ghenv.Component.IconDisplayMode = ghenv.Component.IconDisplayMode.application
ghenv.Component.Category = "Gismo"
ghenv.Component.SubCategory = "1 | OpenStreetMap"
#compatibleGismoVersion = VER 0.0.1\nFEB_09_2017
try: ghenv.Component.AdditionalHelpFromDocStrings = "3"
except: pass

import scriptcontext as sc
import Grasshopper
import System
import random
import Rhino
import math
import time
import gc


def checkInputData(shapes, keys, values, heightPerLevel, randomHeightRange, treeType, onlyRemove_Ids):
    
    unitConversionFactor, unitSystemLabel = gismo_preparation.checkUnits()
    
    # check inputs
    if (shapes.DataCount == 0):
        heightPerLevel = randomHeightRange = randomHeightRangeStart = randomHeightRangeEnd = treeType = osm_id_Only = osm_way_id_Only = osm_id_Remove = osm_way_id_Remove = shapeType = None
        validInputData = False
        printMsg = "Please connect the \"shapes\" output from Gismo \"OSM shapes\" component to this component's \"_shapes\" input."
        return heightPerLevel, randomHeightRange, randomHeightRangeStart, randomHeightRangeEnd, treeType, osm_id_Only, osm_way_id_Only, osm_id_Remove, osm_way_id_Remove, shapeType, unitConversionFactor, validInputData, printMsg
    
    elif (len(shapes.Branches) == 1) and (shapes.Branches[0][0] == None):
        # this happens when "OSM shapes" component's "_runIt" input is set to "False"
        heightPerLevel = randomHeightRange = randomHeightRangeStart = randomHeightRangeEnd = treeType = osm_id_Only = osm_way_id_Only = osm_id_Remove = osm_way_id_Remove = shapeType = None
        validInputData = False
        printMsg = "There is no data supplied to the \"_shapes\" input.\n" + \
                   " \n" + \
                   "Please connect the \"shapes\" output from Gismo \"OSM shapes\" component to this component's \"_shapes\" input.\n" + \
                   "And make sure that you set the \"OSM shapes\" \"_runIt\" input to \"True\"."
        return heightPerLevel, randomHeightRange, randomHeightRangeStart, randomHeightRangeEnd, treeType, osm_id_Only, osm_way_id_Only, osm_id_Remove, osm_way_id_Remove, shapeType, unitConversionFactor, validInputData, printMsg
    
    
    if (len(keys) == 0):
        heightPerLevel = randomHeightRange = randomHeightRangeStart = randomHeightRangeEnd = treeType = osm_id_Only = osm_way_id_Only = osm_id_Remove = osm_way_id_Remove = shapeType = None
        validInputData = False
        printMsg = "Please connect the \"keys\" output from Gismo \"OSM shapes\" component to this component's \"_keys\" input."
        return heightPerLevel, randomHeightRange, randomHeightRangeStart, randomHeightRangeEnd, treeType, osm_id_Only, osm_way_id_Only, osm_id_Remove, osm_way_id_Remove, shapeType, unitConversionFactor, validInputData, printMsg
    elif (len(keys) == 1) and (keys[0] == None):
        # this happens when "OSM shapes" component's "_runIt" input is set to "False"
        heightPerLevel = randomHeightRange = randomHeightRangeStart = randomHeightRangeEnd = treeType = osm_id_Only = osm_way_id_Only = osm_id_Remove = osm_way_id_Remove = shapeType = None
        validInputData = False
        printMsg = "There is no data supplied to the \"_keys\" input.\n" + \
                   " \n" + \
                   "Please connect the \"keys\" output from Gismo \"OSM shapes\" component to this component's \"_keys\" input.\n" + \
                   "And make sure that you set the \"OSM shapes\" \"_runIt\" input to \"True\"."
        return heightPerLevel, randomHeightRange, randomHeightRangeStart, randomHeightRangeEnd, treeType, osm_id_Only, osm_way_id_Only, osm_id_Remove, osm_way_id_Remove, shapeType, unitConversionFactor, validInputData, printMsg
    
    
    if (values.DataCount == 0):
        heightPerLevel = randomHeightRange = randomHeightRangeStart = randomHeightRangeEnd = treeType = osm_id_Only = osm_way_id_Only = osm_id_Remove = osm_way_id_Remove = shapeType = None
        validInputData = False
        printMsg = "Please connect the \"values\" output from Gismo \"OSM shapes\" component to this component's \"_values\" input."
        return heightPerLevel, randomHeightRange, randomHeightRangeStart, randomHeightRangeEnd, treeType, osm_id_Only, osm_way_id_Only, osm_id_Remove, osm_way_id_Remove, shapeType, unitConversionFactor, validInputData, printMsg
    
    elif (len(values.Branches) == 1) and (values.Branches[0][0] == None):
        # this happens when "OSM shapes" component's "_runIt" input is set to "False"
        heightPerLevel = randomHeightRange = randomHeightRangeStart = randomHeightRangeEnd = treeType = osm_id_Only = osm_way_id_Only = osm_id_Remove = osm_way_id_Remove = shapeType = None
        validInputData = False
        printMsg = "There is no data supplied to the \"_values\" input.\n" + \
                   " \n" + \
                   "Please connect the \"values\" output from Gismo \"OSM shapes\" component to this component's \"_values\" input.\n" + \
                   "And make sure that you set the \"OSM shapes\" \"_runIt\" input to \"True\"."
        return heightPerLevel, randomHeightRange, randomHeightRangeStart, randomHeightRangeEnd, treeType, osm_id_Only, osm_way_id_Only, osm_id_Remove, osm_way_id_Remove, shapeType, unitConversionFactor, validInputData, printMsg
    
    
    if len(shapes.Paths) != len(values.Paths):
        heightPerLevel = randomHeightRange = randomHeightRangeStart = randomHeightRangeEnd = treeType = osm_id_Only = osm_way_id_Only = osm_id_Remove = osm_way_id_Remove = shapeType = None
        validInputData = False
        printMsg = "The number of tree branches inputted to the \"_shapes\" and \"_values\" inputs do not match.\n" + \
                   " \n" + \
                   "Make sure that you connected:\n" + \
                   "\"keys\" output from Gismo \"OSM shapes\" component to this component's \"_keys\" input. And:\n" + \
                   "\"values\" output from Gismo \"OSM shapes\" component to this component's \"_values\" input."
        return heightPerLevel, randomHeightRange, randomHeightRangeStart, randomHeightRangeEnd, treeType, osm_id_Only, osm_way_id_Only, osm_id_Remove, osm_way_id_Remove, shapeType, unitConversionFactor, validInputData, printMsg
    
    
    # heightPerLevel_ is always in Rhino document units
    if (heightPerLevel == None):
        heightPerLevel = 3/unitConversionFactor  # 3 meters (10 feet)
    elif (heightPerLevel <= 0):
        heightPerLevel = randomHeightRange = randomHeightRangeStart = randomHeightRangeEnd = treeType = osm_id_Only = osm_way_id_Only = osm_id_Remove = osm_way_id_Remove = shapeType = None
        validInputData = False
        printMsg = "heightPerLevel_ input must be larger than 0.\n" + \
                   "Please supply a value larger than 0."
        return heightPerLevel, randomHeightRange, randomHeightRangeStart, randomHeightRangeEnd, treeType, osm_id_Only, osm_way_id_Only, osm_id_Remove, osm_way_id_Remove, shapeType, unitConversionFactor, validInputData, printMsg
    
    
    # randomHeightRange_ is always in Rhino document units
    if (randomHeightRange == None):
        randomHeightRangeStart = randomHeightRangeEnd = None  # dummy values, will not be used
    else:
        # randomHeightRangeStart can be larger than randomHeightRangeEnd, the random.uniform will still generate a random value between those two numbers.
        # randomHeightRangeStart == randomHeightRangeEnd, the a single value will always be generated (equal to randomHeightRangeStart and randomHeightRangeEnd)
        randomHeightRangeStart = randomHeightRange.T0
        randomHeightRangeEnd = randomHeightRange.T1
    
    
    if (treeType == None):
        treeType = 2  # default (random)
    elif (treeType < 0) or (treeType > 2):
        heightPerLevel = randomHeightRange = randomHeightRangeStart = randomHeightRangeEnd = treeType = osm_id_Only = osm_way_id_Only = osm_id_Remove = osm_way_id_Remove = shapeType = None
        validInputData = False
        printMsg = "treeType_ input must can only have one of the following values:\n" + \
                   "0 - round tree\n" + \
                   "1 - polygonized tree\n" + \
                   "2 - random shaped tree\n" + \
                   " \n" + \
                   "Please supply one of these values."
        return heightPerLevel, randomHeightRange, randomHeightRangeStart, randomHeightRangeEnd, treeType, osm_id_Only, osm_way_id_Only, osm_id_Remove, osm_way_id_Remove, shapeType, unitConversionFactor, validInputData, printMsg
    
    
    if (onlyRemove_Ids.BranchCount == 1) and (onlyRemove_Ids.Branches[0][0] == None):
        # in "OSM ids" component, an id exists both in "osm_id_Only_" and "osm_id_Remove_" inputs,  or an id exists both in "osm_way_id_Only_" and "osm_way_id_Remove_" inputs
        heightPerLevel = randomHeightRange = randomHeightRangeStart = randomHeightRangeEnd = treeType = osm_id_Only = osm_way_id_Only = osm_id_Remove = osm_way_id_Remove = shapeType = None
        validInputData = False
        printMsg = "Your \"_onlyRemove_Ids\" input is invalid. Check the \"readMe!\" output of \"OSM ids\" component to see what's wrong with it."
        return heightPerLevel, randomHeightRange, randomHeightRangeStart, randomHeightRangeEnd, treeType, osm_id_Only, osm_way_id_Only, osm_id_Remove, osm_way_id_Remove, shapeType, unitConversionFactor, validInputData, printMsg
    elif (onlyRemove_Ids.BranchCount == 0):
        # nothing inputted to "OSM ids" component's four inputs
        osm_id_Only = [];  osm_way_id_Only = [];  osm_id_Remove = [];  osm_way_id_Remove = []
    else:
        # something inputted to at least one input of "OSM ids" component
        onlyRemove_IdsLL = onlyRemove_Ids.Branches
        osm_id_Only = list(onlyRemove_IdsLL[0])
        osm_way_id_Only = list(onlyRemove_IdsLL[1])
        osm_id_Remove = list(onlyRemove_IdsLL[2])
        osm_way_id_Remove = list(onlyRemove_IdsLL[3])
    
    
    # check the "shapeType_" input value set in the "OSM shapes" component.
    shapeType = gismo_preparation.checkShapeType(shapes.Branches)
    if shapeType == 1:
        heightPerLevel = randomHeightRange = randomHeightRangeStart = randomHeightRangeEnd = treeType = osm_id_Only = osm_way_id_Only = osm_id_Remove = osm_way_id_Remove = shapeType = None
        validInputData = False
        printMsg = "This component supports only creation of 3d buildings and trees. So \"shapeType_\" input of \"OSM shapes\" component needs to be set to either 0 or 2."
        return heightPerLevel, randomHeightRange, randomHeightRangeStart, randomHeightRangeEnd, treeType, osm_id_Only, osm_way_id_Only, osm_id_Remove, osm_way_id_Remove, shapeType, unitConversionFactor, validInputData, printMsg
    
    
    del shapes; del keys; del values  # delete local variables
    validInputData = True
    printMsg = "ok"
    
    return heightPerLevel, randomHeightRange, randomHeightRangeStart, randomHeightRangeEnd, treeType, osm_id_Only, osm_way_id_Only, osm_id_Remove, osm_way_id_Remove, shapeType, unitConversionFactor, validInputData, printMsg


def isNumber(string):
    """
    check if a string can be converted to a number
    """
    try:
        number = float(string)
        return True
    except:
        return False


def createThreeDeeShapes(shapesDataTree, keys, valuesDataTree, heightPerLevel, randomHeightRange, randomHeightRangeStart, randomHeightRangeEnd, treeType, groundTerrain, osm_id_Only, osm_way_id_Only, osm_id_Remove, osm_way_id_Remove, shapeType, unitConversionFactor):
    
    # use the Z coordinate of the origin_ input from "OSM shapes"
    OSMshapesComp_origin = sc.sticky["gismo_OSMshapesComp_origin"]
    
    
    # a) filter all "building" shapes to a single list, to be used for comparison of centroids. This is used so that all shapes with valid "building:part" key within a shape with valid "building" tag will be level to that shape, in case groundTerrain_ is inputted.
    # b) check if shapes with valid "building" tags contain the shapes with valid "building:part" and "height" tags. In that case if "randomHeightRange_" is inputted, the shape with "building" tag will not be extruded.
    building_keyIndex = None
    buildingPart_keyIndex = None
    height_keyIndex = None
    osm_id_keyIndex = None
    osm_way_id_keyIndex = None
    for keyIndex,key in enumerate(keys):
        if (key == "building"):
            building_keyIndex = keyIndex
        elif (key == "building:part"):  # "building_p"
            buildingPart_keyIndex = keyIndex
        elif (key == "height"):
            height_keyIndex = keyIndex
        elif (key == "osm_id"):
            osm_id_keyIndex = keyIndex
        elif (key == "osm_way_id"):
            osm_way_id_keyIndex = keyIndex
    
    buildingShapes = []
    buildingShapes_with_BuildingPartsAndHeight_insideL2 = []
    valueBuilding = ""  # dummy value in case "building" key does not exist
    valueBuildingPart = ""  # dummy value in case "building:part" key does not exist
    valueHeight = ""  # dummy value in case "height" key does not exist
    valueHeight2 = ""  # dummy value in case "height" key does not exist
    value_osm_id = ""  # initial "osm_id" key value
    value_osm_way_id = ""  # dummy value in case "osm_way_id" key does not exist
    if (building_keyIndex != None) and (shapeType == 0):  # "(shapeType == 0)" because a node can also be tagged as: "building=yes"
        
        shapesLL = shapesDataTree.Branches
        valuesLL = valuesDataTree.Branches
        paths = shapesDataTree.Paths  # obrisati ovaj red
        shapePlane = Rhino.Geometry.Plane(Rhino.Geometry.Point3d(0,0,OSMshapesComp_origin.Z), Rhino.Geometry.Vector3d(0,0,1))  # it will always be constant because each shapesL has a constant height (coming from "OSM shapes" component)
        tol = Rhino.RhinoDoc.ActiveDoc.ModelAbsoluteTolerance
        for branchIndex,shapesL in enumerate(shapesLL):
            if len(shapesL) != 0:  # some shape may have been removed with the "OSM ids" component
                valueBuilding = valuesLL[branchIndex][building_keyIndex]  # for a)
                if (height_keyIndex != None):
                    valueHeight = valuesLL[branchIndex][height_keyIndex]
                else:
                    valueHeight = None  # the "height" key does not exist in "keys"
                    value_osm_id = valuesLL[branchIndex][osm_id_keyIndex]
                if (osm_way_id_keyIndex != None):
                    value_osm_way_id = valuesLL[branchIndex][osm_way_id_keyIndex]
                else:
                    value_osm_way_id = None  # the "osm_way_id" key does not exist in "keys"
                if (valueBuilding != ""):
                    buildingShapes.append(shapesL[0])  # "shapes" output from "OSM shapes" component will always have one item per branch
                    
                    # for b)
                    if (valueHeight == ""):  # there is a shapesL[0] with a valid "building" value but invalid "height" value (it does not have a value for "height" key)
                        shapesLArea = Rhino.Geometry.AreaMassProperties.Compute(shapesL[0]).Area
                        innerShapesTotalArea = 0
                        for branchIndex2,shapesL2 in enumerate(shapesLL):  # for b)
                            if len(shapesL2) != 0:  # some shape may have been removed with the "OSM ids" component
                               if (buildingPart_keyIndex != None) and (height_keyIndex != None):# OVAJ RED JE SKORO DODAT. proveriti da li pravi probleme
                                    valueBuildingPart = valuesLL[branchIndex2][buildingPart_keyIndex]
                                    valueHeight2 = valuesLL[branchIndex2][height_keyIndex]
                                    if (valueBuildingPart != "") and (valueHeight2 != ""):  # there is AT LEAST ONE shapesL2[0] with a valid "building:part" and "height" values
                                        shapeCentroid = Rhino.Geometry.AreaMassProperties.Compute(shapesL2[0]).Centroid
                                        pointContainment = shapesL[0].Contains(shapeCentroid, shapePlane, tol)
                                        if (pointContainment == Rhino.Geometry.PointContainment.Inside):# or (pointContainment == Rhino.Geometry.PointContainment.Coincident):
                                            shapesL2Area = Rhino.Geometry.AreaMassProperties.Compute(shapesL2[0]).Area
                                            innerShapesTotalArea += shapesL2Area
                        
                        if innerShapesTotalArea >= shapesLArea:
                            # shapesL[0] containsts other shapesL2[0]'s which fill up (cover) the complete shapesL[0] area. In that case do not extrude the shapesL[0]
                            if (value_osm_id != ""):
                                #print "value_osm_id: ", value_osm_id
                                osm_id_Remove.append(value_osm_id)
                            elif (value_osm_way_id != ""):
                                #print "value_osm_way_id: ", value_osm_way_id
                                osm_way_id_Remove.append(value_osm_way_id)
                    
                    else:
                        # shapesL[0] does contain a valid "building" value but not a valid "height" value
                        #buildingShapes_with_BuildingPartsAndHeight_insideL[branchIndex].append(False)
                        pass
                else:
                    # shapesL[0] does not contain a valid "building" value
                    #buildingShapes_with_BuildingPartsAndHeight_insideL[branchIndex].append(False)
                    pass
        
        del shapesLL
        del valuesLL
    
    
    # get groundBrep_singleBrepFace
    if (groundTerrain != None):
        groundBrep_singleBrepFace = groundTerrain.Faces[0].DuplicateFace(False)  # always use the top face (the actual terrain) in case inputted groundTerrain_ has been created as a polysurface
        accurate = False
        bb_volume, bb_centroid, bb_length, bb_depth, bb_height, bb_bottomLeftCorner, bb_bottomRightCorner, bb_topRightCorner, bb_topLeftCorner = gismo_preparation.boundingBox_properties([groundTerrain], accurate)
    elif (groundTerrain == None):
        groundBrep_singleBrepFace = None
        bb_height = 10  # dummy value
    bb_height = 3000  # dummy large value (until "Ladybug Terrain Generator" starts support "origin_" input to be on the terrain)
    
    
    
    if (shapeType == 0):
        # shift the paths in "shapes" and "values" data trees by -1, to extrude buildings
        shapes_shiftedPaths_DataTree = gismo_preparation.datatree_shiftPaths(shapesDataTree)
        values_shiftedPaths_DataTree = gismo_preparation.datatree_shiftPaths(valuesDataTree)
    elif (shapeType != 0):
        # no shifting of paths should be done in case the trees need to be created
        shapes_shiftedPaths_DataTree = shapesDataTree
        values_shiftedPaths_DataTree = valuesDataTree
    
    shapes_shiftedPaths_Paths = shapes_shiftedPaths_DataTree.Paths
    shapes_shiftedPaths_LL = shapes_shiftedPaths_DataTree.Branches
    values_shiftedPaths_LL = values_shiftedPaths_DataTree.Branches
    
    threeDeeShapesDataTree = Grasshopper.DataTree[object]()
    threeDeeValuesDataTree = Grasshopper.DataTree[object]()
    heightDataTree = Grasshopper.DataTree[object]()
    
    projectionDirection = Rhino.Geometry.Vector3d(0,0,1)  # it can be direction = Rhino.Geometry.Vector3d(0,0,-1) as well, does not matter
    tol = Rhino.RhinoDoc.ActiveDoc.ModelAbsoluteTolerance
    atleastOneThreeDeeShapeCanBeCreated = False  # initial value
    for branchIndex,shapesL in enumerate(shapes_shiftedPaths_LL):
        if len(shapesL) == 0:
            # some shape may have been removed with the "OSM ids" component
            height = 0
            threeDeeShapeL = []
            threeDeeValueL = []
        else:
            subValuesL_filtered, shapesL_filtered = gismo_osm.filterShapes(keys, values_shiftedPaths_LL[branchIndex], "shapesL dummy string", osm_id_Only, osm_way_id_Only, osm_id_Remove, osm_way_id_Remove)
            if (len(subValuesL_filtered) == 0) and (len(shapesL_filtered) == 0):
                # the id supplied to the "osm_id_Only, osm_way_id_Only, osm_id_Remove, osm_way_id_Remove" is found
                height = 0
                threeDeeShapeL = []
                threeDeeValueL = []
            elif (len(subValuesL_filtered) != 0) and (len(shapesL_filtered) != 0):
                # the id supplied to the "osm_id_Only, osm_way_id_Only, osm_id_Remove, osm_way_id_Remove" is NOT found
                valueBuilding = ""  # dummy value in case "building" key does not exist
                valueHeight = ""  # dummy value in case "height" key does not exist
                valueMinHeight = ""  # dummy value in case "height" key does not exist
                valueLevel = ""  # dummy value in case "building_l" key does not exist
                valueLeafType = ""  # dummy value in case "leaf_type" key does not exist
                valueCycleType = ""  # dummy value in case "leaf_cycle" key does not exist
                valueNatural = ""  # dummy value in case "natural" key does not exist
                valueDiameterCrown = ""  # dummy value in case "diameter_c" key does not exist
                deciduousOrConiferous = ""  # dummy value in case "leaf_type", "leaf_cycle", "natural" keys do not exist
                for keyIndex,key in enumerate(keys):
                    if (key == "building"):
                        valueBuilding = values_shiftedPaths_LL[branchIndex][keyIndex]
                    elif (key == "height"):
                        valueHeight = values_shiftedPaths_LL[branchIndex][keyIndex]
                    elif (key == "building:levels"):  # the short name is: building_l
                        valueLevel = values_shiftedPaths_LL[branchIndex][keyIndex]
                    
                    elif (key == "leaf_type"):
                        valueLeafType = values_shiftedPaths_LL[branchIndex][keyIndex]
                    elif (key == "leaf_cycle"):
                        valueCycleType = values_shiftedPaths_LL[branchIndex][keyIndex]
                    elif (key == "natural"):
                        valueNatural = values_shiftedPaths_LL[branchIndex][keyIndex]
                    elif (key == "diameter_crown"):  # the short name is: diameter_c
                        valueDiameterCrown = values_shiftedPaths_LL[branchIndex][keyIndex]
                    
                    if (key == "min_height"):
                        valueMinHeight = values_shiftedPaths_LL[branchIndex][keyIndex]
                
                # find the "height" for both extruding buildings and trees
                if isNumber(valueHeight):
                    # there is "height" key, and it's value is not ""
                    height = float(valueHeight)/unitConversionFactor  # in Rhino document units
                    threeDeeShapesObject = "3d building"
                elif isNumber(valueLevel):
                    # there is "building_l" key, and it's value is not ""
                    height = float(valueLevel) * heightPerLevel  # in Rhino document units
                    threeDeeShapesObject = "3d building"
                elif (valueBuilding != "")  and  (not isNumber(valueHeight) and (not isNumber(valueLevel))):
                    # a) there are "height" key and "building_l" keys and both have "" values. And there is "building" key, and it's valid (it's not equal to "". So it's either True or some other value, like: "residential", "house", "industrial"...) or
                    # b) there are NO "height" and "building_l" keys. And there is "building" key, and it's valid (it's not equal to "". So it's either True or some other value, like: "residential", "house", "industrial"...)
                    if (randomHeightRange != None):
                        # domain supplied into the "randomHeightRange_" input
                        height = round(random.uniform(randomHeightRangeStart, randomHeightRangeEnd),2)  # in Rhino document units
                        threeDeeShapesObject = "3d building"
                    else:
                        # nothing inputted to the "randomHeightRange_" input
                        height = 0
                        threeDeeShapesObject = None
                        atleastOneThreeDeeShapeCanBeCreated = True
                else:
                    # there are "height", "building:l", "building" keys but they are all invalid ("", "", "")
                    # there are NO "height", "building_l", "building" keys
                    height = 0
                    threeDeeShapesObject = None
                
                if isNumber(valueMinHeight):
                    valueMinHeight = float(valueMinHeight)
                
                
                
                if (shapeType == 2):
                    # identify whether a 3d tree will be created
                    if (valueLeafType == "broadleaved"):
                        deciduousOrConiferous = "deciduous"
                        threeDeeShapesObject = "3d tree"
                    elif (valueLeafType == "needleleaved"):
                        deciduousOrConiferous = "coniferous"
                        threeDeeShapesObject = "3d tree"
                    elif (valueCycleType == "deciduous") or (valueCycleType == "semi_deciduous"):
                        deciduousOrConiferous = "deciduous"
                        threeDeeShapesObject = "3d tree"
                    elif (valueCycleType == "evergreen") or (valueCycleType == "semi_evergreen"):
                        deciduousOrConiferous = "coniferous"
                        threeDeeShapesObject = "3d tree"
                    elif (valueNatural == "tree"):
                        deciduousOrConiferous = "deciduous"  # always use "deciduous" if not specified which "deciduousOrConiferous" the tree is
                        threeDeeShapesObject = "3d tree"
                    elif (valueDiameterCrown != ""):
                        deciduousOrConiferous = "deciduous"  # always use "deciduous" if not specified which "deciduousOrConiferous" the tree is
                        threeDeeShapesObject = "3d tree"
                    else:
                        threeDeeShapesObject = None
                
                
                
                # 1) try creating 3d trees
                if (threeDeeShapesObject == "3d tree"):
                    if (height == 0):
                        # this happens if the value for the "height" key was: "", or there the "height" key does not even exist
                        if (randomHeightRange != None):
                            # domain supplied into the "randomHeightRange_" input
                            height = round(random.uniform(randomHeightRangeStart, randomHeightRangeEnd),2)  # in Rhino document units
                        else:
                            # nothing inputted to the "randomHeightRange_" input
                            height = 0
                            atleastOneThreeDeeShapeCanBeCreated = True
                    
                    if (height != 0):
                        # there is "height" key, and its value is valid (not "")
                        #atleastOneThreeDeeShapeCanBeCreated = True  # proveriti da li pravi problem
                        threeDeeShapeL = []
                        threeDeeValueL = values_shiftedPaths_LL[branchIndex]
                        
                        if deciduousOrConiferous == "":
                            deciduousOrConiferous = "deciduous"  # by default, if it can not be identified if a tree is deciduous or coniferous always use the deciduous
                            #deciduousOrConiferous = "coniferous"
                        
                        numOfTreeHorizontalSegments = 6  # this value is fixed, and should not be changed
                        
                        # heights and radii
                        trunkRadius = height/random.uniform(44, 48)  # lower values (than 44,48) can result in "bottomCrown_brep" not being able to be created
                        if isNumber(valueDiameterCrown):
                            # there is a valid "valueDiameterCrown" value
                            crownRadius = valueDiameterCrown
                        else: 
                            # valueDiameterCrown == ""
                            crownRadius = height/random.uniform(2, 5)
                        
                        trunkHeight = 0.2*height
                        crownHeight = height - trunkHeight
                        
                        treeBottom_pt = shapesL[0].Location  # convert Point to Point3d
                        unprojectedTrunkBottom_crv = Rhino.Geometry.Circle(treeBottom_pt, trunkRadius).ToNurbsCurve()
                        
                        # project the shapes (points) to the groundTerrain_
                        if (groundTerrain == None):
                            projectedTreeBottom_pt = treeBottom_pt
                            projectedTrunkBottom_crv = unprojectedTrunkBottom_crv
                            
                            extrusionVector = Rhino.Geometry.Vector3d(0, 0, trunkHeight)
                            trunkBrep = Rhino.Geometry.Surface.CreateExtrusion(projectedTrunkBottom_crv, extrusionVector).ToBrep()
                            trunkTop_pt = Rhino.Geometry.Point3d(projectedTreeBottom_pt.X, projectedTreeBottom_pt.Y, projectedTreeBottom_pt.Z + trunkHeight)
                            trunkTop_crv = Rhino.Geometry.Circle(trunkTop_pt, trunkRadius).ToNurbsCurve()
                        elif (groundTerrain != None):
                            projectedTreeBottom_pts = Rhino.Geometry.Intersect.Intersection.ProjectPointsToBreps([groundTerrain], [treeBottom_pt], projectionDirection, tol)
                            if len(projectedTreeBottom_pts) == 0:
                                # the shapeL[0] point is located outside of terrainGround_ input boundaries
                                # add "None" to the threeDeeShapesDataTree
                                height = 0
                                threeDeeShapeL = []
                                threeDeeValueL = []
                                threeDeeShapesDataTree.AddRange(threeDeeShapeL, shapes_shiftedPaths_Paths[branchIndex])
                                threeDeeValuesDataTree.AddRange(threeDeeValueL, shapes_shiftedPaths_Paths[branchIndex])
                                heightDataTree.AddRange([height], shapes_shiftedPaths_Paths[branchIndex])
                                continue
                            else:
                                projectedTreeBottom_pt = projectedTreeBottom_pts[0]
                                projectedTrunkBottom_crv1 = Rhino.Geometry.Curve.ProjectToBrep(unprojectedTrunkBottom_crv, groundTerrain, projectionDirection, tol)[0]
                                if (not projectedTrunkBottom_crv1.IsClosed):
                                    # the projected shape is not a closed curve anymore (it was before the projection)
                                    line = Rhino.Geometry.Line(projectedTrunkBottom_crv1.PointAtStart, projectedTrunkBottom_crv1.PointAtEnd).ToNurbsCurve()
                                    joinedPolyCrv = Rhino.Geometry.Curve.JoinCurves([projectedTrunkBottom_crv1,line], tol)[0]
                                    projectedTrunkBottom_crv = joinedPolyCrv.ToNurbsCurve()
                                else:
                                    # the projected curve is still a closed curve (and it was before the projection)
                                    projectedTrunkBottom_crv = projectedTrunkBottom_crv1
                                
                                # a) trunk
                                trunkTop_pt = Rhino.Geometry.Point3d(projectedTreeBottom_pt.X, projectedTreeBottom_pt.Y, projectedTreeBottom_pt.Z + trunkHeight)
                                trunkTop_crv = Rhino.Geometry.Circle(trunkTop_pt, trunkRadius).ToNurbsCurve()
                                extrudePathCurve = Rhino.Geometry.Line(trunkTop_pt, Rhino.Geometry.Point3d(trunkTop_pt.X, trunkTop_pt.Y, trunkTop_pt.Z - bb_height)).ToNurbsCurve()
                                extrusionVector = Rhino.Geometry.Vector3d(0, 0, -bb_height)
                                extrudedShapeBrep = Rhino.Geometry.Surface.CreateExtrusion(trunkTop_crv, extrusionVector).ToBrep()
                                splittedBreps = Rhino.Geometry.Brep.Split(extrudedShapeBrep, groundBrep_singleBrepFace, tol)
                                trunkBrep = splittedBreps[0]
                                del splittedBreps
                        
                        # b) crown
                        # crown curves/polylines
                        crownSection_crvs = []
                        
                        if deciduousOrConiferous == "deciduous":
                            crownRadii = [0.15*crownRadius, crownRadius, crownRadius, crownRadius, 0.15*crownRadius]  # [crownBottom_crv radius, crownMiddle1_crv, crownMiddle2_crv, crownTop_crv]
                            crownPartitionHeights = [0*crownHeight, 0.275*crownHeight, 0.5*crownHeight, 0.725*crownHeight, 1.0*crownHeight]
                        elif deciduousOrConiferous == "coniferous":
                            crownRadii = [0.2*crownRadius, crownRadius, 0.1*crownRadius]  # [crownBottom_crv radius, crownMiddle1_crv, crownMiddle2_crv, crownTop_crv]
                            crownPartitionHeights = [0*crownHeight, 0.05*crownHeight, 1.0*crownHeight]
                        
                        for i in xrange(len(crownRadii)):
                            crown_pt = Rhino.Geometry.Point3d(trunkTop_pt.X, trunkTop_pt.Y, trunkTop_pt.Z + crownPartitionHeights[i])
                            circleCrv = Rhino.Geometry.Circle(crown_pt, crownRadii[i]).ToNurbsCurve()
                            if (treeType == 0):
                                crownSection_crvs.append(circleCrv)
                            elif (treeType == 1):
                                includeEnds = True
                                circleDivision_tL = list(Rhino.Geometry.Curve.DivideByCount(circleCrv, numOfTreeHorizontalSegments, includeEnds))
                                circleDivision_tL = circleDivision_tL + [circleDivision_tL[0]]  # closing the polyline
                                circleDivision_ptsL = [circleCrv.PointAt(t) for t in circleDivision_tL]
                                crown_polyline = Rhino.Geometry.Polyline(circleDivision_ptsL).ToNurbsCurve()
                                crownSection_crvs.append(crown_polyline)
                            elif (treeType == 2):
                                centroid = Rhino.Geometry.AreaMassProperties.Compute(circleCrv).Centroid
                                includeEnds = True
                                t_L = circleCrv.DivideByCount(12, includeEnds)
                                randomCirclePts = []
                                for t in t_L:
                                    pt = circleCrv.PointAt(t)
                                    vector = pt - centroid
                                    vectorScaleFactor = random.uniform(-0.2, 0.2)
                                    randomPt = pt + vector*vectorScaleFactor
                                    randomCirclePts.append(randomPt)
                                    degree = 3; knotstyle = 3; knotstyle2 = System.Enum.ToObject(Rhino.Geometry.CurveKnotStyle, 3); start_tangent = end_tangent = Rhino.Geometry.Vector3d.Unset
                                randomCirclePts2 = randomCirclePts + [randomCirclePts[0]]  # close the crv
                                randomCrv = Rhino.Geometry.Curve.CreateInterpolatedCurve(randomCirclePts2, degree, knotstyle2, start_tangent, end_tangent)
                                crownSection_crvs.append(randomCrv)
                        
                        # crow brep
                        bottomCrown_brep = Rhino.Geometry.Brep.CreatePlanarBreps([crownSection_crvs[0],trunkTop_crv])[0]
                        topCrown_brep = Rhino.Geometry.Brep.CreatePlanarBreps(crownSection_crvs[-1])[0]
                        if (treeType == 0):
                            loftType2 = Rhino.Geometry.LoftType.Normal
                        elif (treeType == 1):
                            loftType2 = Rhino.Geometry.LoftType.Straight
                        elif (treeType == 2):
                            loftType2 = Rhino.Geometry.LoftType.Normal
                        closed = False
                        crownSideBrep = Rhino.Geometry.Brep.CreateFromLoft(crownSection_crvs, Rhino.Geometry.Point3d.Unset, Rhino.Geometry.Point3d.Unset, loftType2, closed)[0]
                        treeJoinedBrep = Rhino.Geometry.Brep.JoinBreps([bottomCrown_brep, crownSideBrep, topCrown_brep, trunkBrep], tol)[0]
                        treeJoinedBrep.Flip()  # for some reason the "treeJoinedBrep" has always normals pointed downwards
                        threeDeeShapeL.append(treeJoinedBrep)
                
                
                
                # 2) try creating 3d buildings
                elif (threeDeeShapesObject == "3d building"):
                    # check if a building can be created (if height != 0)
                    if (height != 0):
                        
                        bottomCrvControlPt_highestZcoord = None  # check if commenting-out this line will make some errors
                        # find out whether shapesL is included in other building shapes (like shapesL which have valid "building:part" key). If it is, then calculate the "bottomCrvControlPt_highestZcoord" of that other building shape
                        shapePlane = Rhino.Geometry.Plane(Rhino.Geometry.Point3d(0,0,shapesL[0].PointAtStart.Z), Rhino.Geometry.Vector3d(0,0,1))  # it will always be constant because each shapesL has a constant height (coming from "OSM shapes" component)
                        for buildingShape in buildingShapes:
                            shapeCentroid = Rhino.Geometry.AreaMassProperties.Compute(shapesL[0]).Centroid
                            pointContainment = buildingShape.Contains(shapeCentroid, shapePlane, tol)
                            if (pointContainment == Rhino.Geometry.PointContainment.Inside) or (pointContainment == Rhino.Geometry.PointContainment.Coincident):
                                # shapesL[0]'s centroid is contained inside another shapesL[0] (which has a valid "building" key), so use the "bottomCrvControlPt_highestZcoord" of that another shapesL[0]
                                dummy_topCrvs, bottomCrvControlPt_highestZcoord = gismo_createGeometry.liftingOSMshapes_from_groundTerrain([buildingShape], groundBrep_singleBrepFace, height, valueMinHeight)  # "bottomCrvControlPt_highestZcoord" calculated
                                del dummy_topCrvs
                                break  # the shapesL[0] has found to be inside another shapesL[0] which has a valid "building" key. No need for checking of other shapes
                        
                        topCrvs, dummy_bottomCrvControlPt_highestZcoord = gismo_createGeometry.liftingOSMshapes_from_groundTerrain(shapesL, groundBrep_singleBrepFace, height, valueMinHeight, bottomCrvControlPt_highestZcoord)
                        if (len(topCrvs) == 0):
                            # the shapesL is located outside of the "groundTerrain_" ("if groundTerrain_" inputted. If "groundTerrain_" not inputted, len(projectedShapeCrvs) will never be equal to 0)
                            height = 0
                            threeDeeShapeL = []
                            threeDeeValueL = []
                        elif (len(topCrvs) != 0):
                            threeDeeValueL = values_shiftedPaths_LL[branchIndex]
                            
                            planarBrep = Rhino.Geometry.Brep.CreatePlanarBreps(topCrvs)[0]
                            planarBrep.Flip()  # for some reason the upper planarBrep has always a normal pointed downwards
                            # extrude buildings
                            if (valueMinHeight != ""):
                                # there is a valid "min_height" value
                                extrusionVec = Rhino.Geometry.Vector3d(0,0,-(height-valueMinHeight))
                            elif (valueMinHeight == ""):
                                if (groundTerrain == None):
                                    extrusionVec = Rhino.Geometry.Vector3d(0,0,-height)
                                elif(groundTerrain != None):
                                    shapeExtrudeHeight = -(height + 2 * bb_height)  # "2" is due to safety
                                    extrusionVec = Rhino.Geometry.Vector3d(0,0,shapeExtrudeHeight)
                            
                            topCrvs_StartPt = topCrvs[0].PointAtStart  # if topCrvs has more shapes than 1, the others will also be on the same height
                            extrudeCrv = Rhino.Geometry.Line(topCrvs_StartPt, topCrvs_StartPt + extrusionVec).ToNurbsCurve()
                            planarBrepFace = planarBrep.Faces[0]
                            cap = True
                            extrudedShape = Rhino.Geometry.BrepFace.CreateExtrusion(planarBrepFace, extrudeCrv, cap)
                            if (groundTerrain == None):
                                # nothing inputted into the "groundTerrain_" input
                                threeDeeShapeL = [extrudedShape]
                            elif (groundTerrain != None):
                                if (valueMinHeight != ""):
                                    threeDeeShapeL = [extrudedShape]
                                elif (valueMinHeight == ""):
                                    # something inputted into the "groundTerrain_" input
                                    splittedBreps = Rhino.Geometry.Brep.Split(extrudedShape, groundBrep_singleBrepFace, tol)
                                    if len(splittedBreps) > 0:
                                        threeDeeShapeL = [splittedBreps[0]]
                                    del splittedBreps
                    
                    else:
                        # height is equal to 0
                        threeDeeShapeL = []
                        threeDeeValueL = []
                
                # 3) neither 3d tree nor 3d building could be created with the supplied _keys and _values
                else:
                    height = 0
                    threeDeeShapeL = []
                    threeDeeValueL = []
        
        threeDeeShapesDataTree.AddRange(threeDeeShapeL, shapes_shiftedPaths_Paths[branchIndex])
        threeDeeValuesDataTree.AddRange(threeDeeValueL, shapes_shiftedPaths_Paths[branchIndex])
        heightDataTree.AddRange([height], shapes_shiftedPaths_Paths[branchIndex])
    
    
    if (threeDeeShapesDataTree.DataCount == 0):
        if (len(osm_id_Only) != 0) or (len(osm_way_id_Only) != 0):
            # this may happen if ids supplied to the "osm_id_Only_" and/or "osm_way_id_Only_" inputs of "OSM ids" component can not be found in this _location and/or radius_ (they may correspond to other _location and/or radius_)
            valid_onlyRemove_Ids_or_shapes = False
            printMsg = "The ids you supplied through \"osm_id_Only_\" and/or \"osm_way_id_Only_\" inputs do not exist for this \"_location\" and/or \"radius_\" inputs.\nTry removing the ids from the \"osm_id_Only_\" and/or \"osm_way_id_Only_\" inputs of \"OSM ids\" component."
            
            return threeDeeShapesDataTree, threeDeeValuesDataTree, heightDataTree, valid_onlyRemove_Ids_or_shapes, printMsg
        elif (len(osm_id_Only) == 0) and (len(osm_way_id_Only) == 0):
            if (atleastOneThreeDeeShapeCanBeCreated == True):
                valid_onlyRemove_Ids_or_shapes = False
                printMsg = "Supplied _values and _keys do not contain neither \"height\" nor \"building:levels\" keys which are essential for creation of 3d buildings and/or 3d trees.\n" + \
                           " \n" + \
                           "You can allow the component to create them with random heights with the use of \"randomHeightRange_\" input. Supply some domain to this input (for example: \"20 to 30\") to generate the 3d shapes."
            elif (atleastOneThreeDeeShapeCanBeCreated == False):
                valid_onlyRemove_Ids_or_shapes = False
                printMsg = "No 3D shape (building or tree) could be created with the supplied _values of _keys"
            
            return threeDeeShapesDataTree, threeDeeValuesDataTree, heightDataTree, valid_onlyRemove_Ids_or_shapes, printMsg
    
    
    # baking
    if (groundTerrain != None):
        groundTerrainInputted = "yes"
    elif (groundTerrain == None):
        groundTerrainInputted = "no"
    
    if bakeIt_:
        layerName = "heightPerLevel=" + str(heightPerLevel) + "_randomHeightRange=" + str(randomHeightRangeStart) + "-" + str(randomHeightRangeEnd) + "_groundTerrain=" + groundTerrainInputted
        
        layParentName = "GISMO"; laySubName = "OSM"; layerCategoryName = "3D_SHAPES"
        newLayerCategory = False
        laySubName_color = System.Drawing.Color.FromArgb(100,191,70)  # green
        layerColor = System.Drawing.Color.FromArgb(0,0,0)  # black
        
        layerIndex, layerName_dummy = gismo_preparation.createLayer(layParentName, laySubName, layerCategoryName, newLayerCategory, layerName, laySubName_color, layerColor) 
        
        threeDeeShapesFlattened = [shape  for threeDeeShapeL in threeDeeShapesDataTree.Branches  for shape in threeDeeShapeL]
        geometryIds = gismo_preparation.bakeGeometry(threeDeeShapesFlattened, layerIndex)
        
        # grouping
        groupIndex = gismo_preparation.groupGeometry("3D_OSM_SHAPES" + "_" + layerName, geometryIds)
        del threeDeeShapesFlattened
        del geometryIds
    
    
    # deleting
    del shapesDataTree; del shapes_shiftedPaths_Paths; del shapes_shiftedPaths_LL; del valuesDataTree; del values_shiftedPaths_LL; del keys; del buildingShapes  # delete local variables
    gc.collect()
    
    valid_onlyRemove_Ids_or_shapes = True
    printMsg = "ok"
    
    return threeDeeShapesDataTree, threeDeeValuesDataTree, heightDataTree, valid_onlyRemove_Ids_or_shapes, printMsg


def printOutput(osm_id_Only, osm_way_id_Only, osm_id_Remove, osm_way_id_Remove, heightPerLevel, randomHeightRangeStart, randomHeightRangeEnd, treeType):
    if bakeIt_ == True:
        bakedOrNot = "and baked "
    elif bakeIt_ == False:
        bakedOrNot = ""
    
    if groundTerrain_:
        groundTerrainInputted = "yes"
    else:
        groundTerrainInputted = "no"
    
    resultsCompletedMsg = "OSM 3D component results successfully completed %s!" % bakedOrNot
    printOutputMsg = \
    """
Input data:

Only remove Ids: %s, %s, %s, %s

Height per level (rhino doc. units): %s
Random height range (rhino doc. units): %s - %s
Tree geometry type: %s
Ground terrain inputted: %s
    """ % (osm_id_Only, osm_way_id_Only, osm_id_Remove, osm_way_id_Remove, heightPerLevel, randomHeightRangeStart, randomHeightRangeEnd, treeType, groundTerrainInputted)
    print resultsCompletedMsg
    print printOutputMsg


level = Grasshopper.Kernel.GH_RuntimeMessageLevel.Warning
if sc.sticky.has_key("gismoGismo_released"):
    validVersionDate, printMsg = sc.sticky["gismo_check"].versionDate(ghenv.Component)
    if validVersionDate:
        gismo_preparation = sc.sticky["gismo_Preparation"]()
        gismo_createGeometry = sc.sticky["gismo_CreateGeometry"]()
        gismo_osm = sc.sticky["gismo_OSM"]()
        
        heightPerLevel, randomHeightRange, randomHeightRangeStart, randomHeightRangeEnd, treeType, osm_id_Only, osm_way_id_Only, osm_id_Remove, osm_way_id_Remove, shapeType, unitConversionFactor, validInputData, printMsg = checkInputData(_shapes, _keys, _values, heightPerLevel_, randomHeightRange_, treeType_, onlyRemove_Ids_)
        if validInputData:
            if _runIt:
                threeDeeShapes, threeDeeValues, height, valid_onlyRemove_Ids_or_shapes, printMsg = createThreeDeeShapes(_shapes, _keys, _values, heightPerLevel, randomHeightRange, randomHeightRangeStart, randomHeightRangeEnd, treeType, groundTerrain_, osm_id_Only, osm_way_id_Only, osm_id_Remove, osm_way_id_Remove, shapeType, unitConversionFactor)
                if valid_onlyRemove_Ids_or_shapes:
                    printOutput(osm_id_Only, osm_way_id_Only, osm_id_Remove, osm_way_id_Remove, heightPerLevel, randomHeightRangeStart, randomHeightRangeEnd, treeType)
                    threeDeeKeys = _keys
                else:
                    print printMsg
                    ghenv.Component.AddRuntimeMessage(level, printMsg)
            else:
                print "All inputs are ok. Please set \"_runIt\" to True, in order to run the OSM 3D component"
        else:
            print printMsg
            ghenv.Component.AddRuntimeMessage(level, printMsg)
    else:
        print printMsg
        ghenv.Component.AddRuntimeMessage(level, printMsg)
else:
    printMsg = "First please run the Gismo Gismo component."
    print printMsg
    ghenv.Component.AddRuntimeMessage(level, printMsg)
# ---------- end osm3d ----------
preview = CustomPreview(Geometry=osm3d.threeDeeShapes, Shader=ColourSwatch(SwatchColor=RGB(240, 190, 0)))

# ---- group: trees
# points (trees, bus stops...)
# 3d trees
osmobjects_2 = Gismo_OSMObjects({"Post office", "Office administrative", "Office government", "Residential building", "Hospital", "Ambulance station", "Pharmacy", "Police", "Fire station", "Museum"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}, selected="Tree")
osmkeys_2 = Gismo_OSMKeys(OSMobjectName=osmobjects_2)  # -> readMe, requiredKeys, OSMwebpage; same code as osmkeys
osmshapes_3 = Gismo_OSMShapes(
    location=createlocation,
    radius=panel_3,
    shapeType="2",
    requiredKeys=osmkeys_2.requiredKeys,
    bakeIt=False,
    runIt=Toggle(False))  # -> readMe, shapes, keys, values, port, titleOriginPt, title; inputs radius: Int32, origin: Point3d, shapeType: Int32, requiredKeys: list, onlyRemove_Ids: tree, bakeIt: Boolean, runIt: Boolean; same code as osmshapes
osm3d_2 = Gismo_OSM3D(
    shapes=osmshapes_3.shapes,
    keys=osmshapes_3.keys,
    values=osmshapes_3.values,
    randomHeightRange="4 to 10",
    treeType=2,
    groundTerrain=geo,
    bakeIt=False,
    runIt=Toggle(False))  # -> readMe, threeDeeShapes, threeDeeKeys, threeDeeValues, height; inputs shapes: tree of GeometryBase, keys: list, values: tree, onlyRemove_Ids: tree, treeType: Int32, groundTerrain: Brep, bakeIt: Boolean, runIt: Boolean; same code as osm3d
preview_2 = CustomPreview(Geometry=osm3d_2.threeDeeShapes, Shader=ColourSwatch(SwatchColor=RGB(0, 102, 0)))

# ---- group: parks
# 2d shapes
# found parks
osmobjects_3 = Gismo_OSMObjects({"Post office", "Office administrative", "Office government", "Residential building", "Hospital", "Ambulance station", "Pharmacy", "Police", "Fire station", "Museum"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}, selected="Park")
osmkeys_3 = Gismo_OSMKeys(OSMobjectName=osmobjects_3)  # -> readMe, requiredKeys, OSMwebpage; same code as osmkeys
osmshapes_4 = Gismo_OSMShapes(
    location=createlocation,
    radius=panel_3,
    shapeType="0",
    requiredKeys=osmkeys_3.requiredKeys,
    bakeIt=False,
    runIt=Toggle(False))  # -> readMe, shapes, keys, shortenedName_keys, values, port, titleOriginPt, title; inputs radius: Int32, origin: Point3d, shapeType: Int32, requiredKeys: list, onlyRemove_Ids: tree, bakeIt: Boolean, runIt: Boolean; same code as osmshapes
osmobjects_4 = Gismo_OSMObjects({"Post office", "Office administrative", "Office government", "Residential building", "Hospital", "Ambulance station", "Pharmacy", "Police", "Fire station", "Museum"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}, selected="Park")
osmtag = Gismo_OSMTag(OSMobjectName=osmobjects_4)  # -> readMe, requiredTag; inputs port_3: list
#   port port: A key for which "requiredTag" output will be created. For example: "leisure". If we also supply "park" to the "requiredValues_" below, then "requiredTag" would be: "leisure=park" which will be a prerequisite for finding all parks in "OSM search" component.
# ---------- osmtag: Python ----------
# OSM tag
#
# Gismo is a plugin for GIS environmental analysis (GPL) started by Djordje Spasic.
#
# This file is part of Gismo.
#
# Copyright (c) 2017, Djordje Spasic <djordjedspasic@gmail.com>
# Component icon based on free OSM icon from: <https://icons8.com/web-app/13398/osm>
#
# Gismo is free software: you can redistribute it and/or modify it under the terms of the GNU General Public License as published by the Free Software Foundation, either version 3 of the License, or (at your option) any later version.
#
# Gismo is distributed in the hope that it will be useful, but WITHOUT ANY WARRANTY; without even the implied warranty of MERCHANTABILITY or FITNESS FOR A PARTICULAR PURPOSE. See the GNU General Public License for more details.
#
# You should have received a copy of the GNU General Public License along with this program. If not, see http://www.gnu.org/licenses/.
#
# The GPL-3.0+ license <http://spdx.org/licenses/GPL-3.0+>

"""
Use this component to generate "requiredTag" output. This output is used as input for "OSM search" component. It represents a combination of a key and value(s) for which search at "OSM search" component will be performed.
-
Search for any OSM tag at: http://taginfo.openstreetmap.org/tags
-
Provided by Gismo 0.0.1
    
    input:
        _OSMobjectName: OSM object name.
                        Use "OSM Objects" dropdown list to generate it.
        _requiredKey: Required key for which "requiredTag" output will be created.
                      -
                      If you add data to upper "_OSMobjectName" input, you do not have to use this input.
                      -
                      This input (and "requiredValues_" below it) is used if one would like to create custom "requiredTag" output not based on "OSM Objects" drowdown list.
                      For example, if we supply "leisure" to this input, and "park" to the one below ("requiredValues_"), then "requiredTag" output will be created as: "leisure,park" which will be a prerequisite for finding all parks in "OSM search" component.
        requiredValues_: Required values for which "requiredTag" output will be created.
                         -
                         If you add data to upper "_OSMobjectName" input, you do not have to use this input.
                         -
                         This input (and "_requiredKey" above it) is used if one would like to create custom "requiredTag" output not based on "OSM Objects" drowdown list.
                         For example, if we supply "park" to this input, and "leisure" to "_requiredKey" above, then "requiredTag" output will be created as: "leisure,park" which will be a prerequisite for finding all parks in "OSM search" component.
                         -
                         This input can also be left blank. In that case "_requiredKey" input ("leisure") will only be taken into account when generating the "requiredTag" output.
    
    output:
        readMe!: ...
        requiredTag: A tag represents a combination between a key and value(s).
                     It is prerequisite for finding particular object in "OSM search" component:  so use this output as "_requiredTag" input for "OSM search" component.
"""

ghenv.Component.Name = "Gismo_OSM Tag"
ghenv.Component.NickName = "OSMtag"
ghenv.Component.Message = "VER 0.0.1\nJAN_29_2017"
ghenv.Component.IconDisplayMode = ghenv.Component.IconDisplayMode.application
ghenv.Component.Category = "Gismo"
ghenv.Component.SubCategory = "1 | OpenStreetMap"
#compatibleGismoVersion = VER 0.0.1\nJAN_29_2017
try: ghenv.Component.AdditionalHelpFromDocStrings = "2"
except: pass

import rhinoscriptsyntax as rs
import scriptcontext as sc
import Grasshopper
import System
import Rhino
import math


def changeInputNamesAndDescriptions(inputIndex, inputtedOrNot):
    
    inputNickNames = [["_OSMobjectName", "-"], [], ["_requiredKey", "-"], ["requiredValues_", "-"]]
    inputDescriptions = [ 
     ["Name of the OSM object for which \"requiredTag\" needs to be created. Use the \"OSM Objects\" dropdown list to create it.", 
      "This inputt is not necessary. If you would like to generate \"requiredTag\" output based on \"_OSMobjectName\" input (instead of \"_requiredKey\" and \"requiredValues_\") then the data you supplied to this input is enough."]
     ,
     []
     ,
     ["A key for which \"requiredTag\" output will be created.\n \nFor example: \"leisure\". If we also supply \"park\" to the \"requiredValues_\" below, then \"requiredTag\" would be: \"leisure,park\" which will be a prerequisite for finding all parks in \"OSM search\" component.",
      "This inputt is not necessary. If you would like to generate \"requiredTag\" output based on \"_requiredKey\" and \"requiredValues_\" inputs (instead of \"_OSMobjectName\") then the data you supplied to these inputs is enough."]
     ,
     ["Values for which \"requiredTag\" output will be created.\n \nFor example: if we supply \"leisure\" in the upper \"_requiredKey\" and we supply \"park\" to this input, then \"requiredTag\" would be: \"leisure,park\" which will be a prerequisite for finding all parks in \"OSM search\" component.\n \nThis input can also be left blank. In that case \"_requiredKey\" input will only be taken into account when generating the \"requiredTag\" output.",
      "This inputt is not necessary. If you would like to generate \"requiredTag\" output based on \"_requiredKey\" and \"requiredValues_\" inputs (instead of \"_OSMobjectName\") then the data you supplied to these inputs is enough."]
     ]
    
    ghenv.Component.Params.Input[inputIndex-1].Name = inputNickNames[inputIndex-1][inputtedOrNot]
    ghenv.Component.Params.Input[inputIndex-1].NickName = inputNickNames[inputIndex-1][inputtedOrNot]
    ghenv.Component.Params.Input[inputIndex-1].Description = inputDescriptions[inputIndex-1][inputtedOrNot]


def checkInputData(OSMobjectNameInput, requiredKeyInput, requiredValuesInput):
    
    if (OSMobjectNameInput == None)  and  ((requiredKeyInput == None) and (len(requiredValuesInput) == 0)):  # data NOT inputted into _OSMobjectName, NOT inputted into _requiredKey, and NOT inputted into requiredValues_
        # assign output names and descriptions to _OSMobjectName and _requiredKey, requiredValues_ inputs
        changeInputNamesAndDescriptions(1, 0)
        changeInputNamesAndDescriptions(3, 0)
        changeInputNamesAndDescriptions(4, 0)
        OSMobjectNameInput = requiredTag = None
        validInputData = False
        printMsg = "There are two ways to run this component:\n" + \
                   " \n" + \
                   "1) Add data only to \"_OSMobjectName\" input by using \"OSM Objects\" dropdown list.  Or,\n" +\
                   "2) Add data to \"_requiredKey\" and \"requiredValues_\" inputs, and disregard the upper \"_OSMobjectName\" input."
        return OSMobjectNameInput, requiredTag, validInputData, printMsg
    
    
    if (OSMobjectNameInput == None)  and  ((requiredKeyInput == None) and (len(requiredValuesInput) != 0)):  # data NOT inputted into _OSMobjectName, NOT inputted into _requiredKey, BUT INPUTTED into requiredValues_
        # assign output names and descriptions to _OSMobjectName and _requiredKey, requiredValues_ inputs
        changeInputNamesAndDescriptions(1, 0)
        changeInputNamesAndDescriptions(3, 0)
        changeInputNamesAndDescriptions(4, 0)
        OSMobjectNameInput = requiredTag = None
        validInputData = False
        printMsg = "Add a key to \"_requiredKey\" input.\n" + \
                   " \n" + \
                   "For example: if we supply \"leisure\" in the upper \"_requiredKey\" and we supply \"park\" to this input, then \"requiredTag\" would be: \"leisure,park\" which will be a prerequisite for finding all parks in \"OSM search\" component.\n \nThis input can also be left blank. In that case \"_requiredKey\" input (\"leisure\") will only be taken into account when generating the \"requiredTag\" output."
        return OSMobjectNameInput, requiredTag, validInputData, printMsg
    
    
    if (OSMobjectNameInput != None)  and  ((requiredKeyInput != None) or (len(requiredValuesInput) != 0)):  # data inputted into both _OSMobjectName  and  (_requiredKey or requiredValues_)
        # assign output names and descriptions to _OSMobjectName and _requiredKey, requiredValues_ inputs
        changeInputNamesAndDescriptions(1, 0)
        changeInputNamesAndDescriptions(3, 0)
        changeInputNamesAndDescriptions(4, 0)
        OSMobjectNameInput = requiredTag = None
        validInputData = False
        printMsg = "Do not input data to _OSMobjectName, along with _requiredKey or requiredValues_.\n \n" +\
                   "If you would like to generate \"requiredTag\" output based on \"_OSMobjectName\" input (instead of \"_requiredKey\" and \"requiredValues_\") then supply data to \"_OSMobjectName\" input only!\n" +\
                   "If you would like to generate \"requiredTag\" output based on \"_requiredKey\" and \"requiredValues_\" inputs (instead of \"_OSMobjectName\") then supply data to \"_requiredKey\",  or  \"_requiredKey\" and \"requiredValues_\" input(s) only!"
        return OSMobjectNameInput, requiredTag, validInputData, printMsg
    
    
    if (OSMobjectNameInput != None)  and  ((requiredKeyInput == None) and (len(requiredValuesInput) == 0)):  # data inputted to _OSMobjectName  and  NOT to _requiredKey and requiredValues_
        # assign output names and descriptions to _requiredKey, requiredValues_ inputs
        changeInputNamesAndDescriptions(3, 1)
        changeInputNamesAndDescriptions(4, 1)
    elif (OSMobjectNameInput == None)  and  ((requiredKeyInput != None) or (len(requiredValuesInput) != 0)):  # data NOT inputted into _OSMobjectName  and  inputted into either _requiredKey or requiredValues_
        # assign output names and descriptions to _OSMobjectName input
        changeInputNamesAndDescriptions(1, 1)
    
    
    
    if OSMobjectNameInput:
        # something inputted to "_OSMobjectName"
        requiredKeyRequiredValue_dict = gismo_osm.requiredTag_dictionary()
        if requiredKeyRequiredValue_dict.has_key(str(OSMobjectNameInput)):
            requiredKey, requiredValues = requiredKeyRequiredValue_dict[str(OSMobjectNameInput)]
            del requiredKeyRequiredValue_dict
        else:
            # inputted "_OSMobjectName" does not exist in "requiredKeyRequiredValue_dict"
            OSMobjectNameInput = requiredTag = None
            validInputData = False
            printMsg = "Supplied \"_OSMobjectName\" does not exist among this component's data.\n" + \
                       "Use \"OSM Objects\" dropdown list to generate it.\n" + \
                       " \n" + \
                       "Or instead of using \"_OSMobjectName\" input, use \"_requiredKey\" and \"requiredValues_\" inputs."
            return OSMobjectNameInput, requiredTag, validInputData, printMsg
    else:
        # nothing inputted to "_OSMobjectName"
        requiredKey = str(requiredKeyInput).strip()  # remove " " (empty spaces) from beginning and start
        requiredValues = [str(value).strip()  for value in requiredValuesInput]  # remove " " (empty spaces) from beginning and start
    
    if requiredValues == ("^",):  # "^" means there is no specific value for this key
        requiredValues = []  # this is to prevent confusion by looking at "requiredTag" outut. "^" will be returned back in "OSM search" component
    
    requiredTag = Grasshopper.DataTree[object]()
    requiredTag.AddRange([requiredKey], Grasshopper.Kernel.Data.GH_Path(0))
    requiredTag.AddRange(requiredValues, Grasshopper.Kernel.Data.GH_Path(1))
    
    validInputData = True
    printMsg = "ok"
    return OSMobjectNameInput, requiredTag, validInputData, printMsg


def printOutput(OSMobjectName, requiredKeyInput, requiredValueInput):
    requiredValueInput_python = [System.String(value)  for value in requiredValueInput]
    
    resultsCompletedMsg = "OSM tag component results successfully completed!"
    printOutputMsg = \
    """
Input data:

OSMobjectName: %s
requiredKey: %s
requiredValue: %s
    """ % (OSMobjectName, requiredKeyInput, requiredValueInput_python)
    print resultsCompletedMsg
    print printOutputMsg


level = Grasshopper.Kernel.GH_RuntimeMessageLevel.Warning
if sc.sticky.has_key("gismoGismo_released"):
    validVersionDate, printMsg = sc.sticky["gismo_check"].versionDate(ghenv.Component)
    if validVersionDate:
        gismo_osm = sc.sticky["gismo_OSM"]()
        
        changeInputNamesAndDescriptions(1, 0)
        changeInputNamesAndDescriptions(3, 0)
        changeInputNamesAndDescriptions(4, 0)
        
        try:
            OSMobjectNameInput = list(ghenv.Component.Params.Input[0].VolatileData[0])[0]
        except Exception, e:
            OSMobjectNameInput = None
        
        try:
            requiredKeyInput = list(ghenv.Component.Params.Input[2].VolatileData[0])[0]
        except Exception, e:
            requiredKeyInput = None
        
        try:
            requiredValuesInput = list(ghenv.Component.Params.Input[3].VolatileData[0])
        except Exception, e:
            requiredValuesInput = []
        
        OSMobjectName, requiredTag, validInputData, printMsg = checkInputData(OSMobjectNameInput, requiredKeyInput, requiredValuesInput)
        if validInputData:
            printOutput(OSMobjectName, requiredKeyInput, requiredValuesInput)
        else:
            print printMsg
            ghenv.Component.AddRuntimeMessage(level, printMsg)
    else:
        print printMsg
        ghenv.Component.AddRuntimeMessage(level, printMsg)
else:
    printMsg = "First please run the Gismo Gismo component."
    print printMsg
    ghenv.Component.AddRuntimeMessage(level, printMsg)
# ---------- end osmtag ----------
osmsearch = Gismo_OSMSearch(
    requiredTag=osmtag.requiredTag,
    shapes=osmshapes_4.shapes,
    keys=osmshapes_4.keys,
    values=osmshapes_4.values,
    createFootprints=Toggle(True),
    groundTerrain=geo,
    bakeIt=False,
    runIt=Toggle(False))  # -> readMe, foundShapes, foundKeys, foundValues, foundShapeOrNot, port, titleOriginPt, title; inputs requiredTag: tree, shapes: tree of GeometryBase, keys: list, values: tree, threeDeeShapes: tree of GeometryBase, threeDeeValues: tree, createFootprints: Boolean, groundTerrain: Brep, bakeIt: Boolean, runIt: Boolean
# ---------- osmsearch: Python ----------
# OSM search
#
# Gismo is a plugin for GIS environmental analysis (GPL) started by Djordje Spasic.
#
# This file is part of Gismo.
#
# Copyright (c) 2017, Djordje Spasic <djordjedspasic@gmail.com>
# Component icon based on free OSM icon from: <https://icons8.com/web-app/13398/osm>
#
# Gismo is free software: you can redistribute it and/or modify it under the terms of the GNU General Public License as published by the Free Software Foundation, either version 3 of the License, or (at your option) any later version.
#
# Gismo is distributed in the hope that it will be useful, but WITHOUT ANY WARRANTY; without even the implied warranty of MERCHANTABILITY or FITNESS FOR A PARTICULAR PURPOSE. See the GNU General Public License for more details.
#
# You should have received a copy of the GNU General Public License along with this program. If not, see http://www.gnu.org/licenses/.
#
# The GPL-3.0+ license <http://spdx.org/licenses/GPL-3.0+>

"""
Use this component to search through OSM 2D and 3D shapes. Shapes will be searched by the use of _requiredTag input. To generate _requiredTag input use "OSM tag" component.
-
1) If you would like to search OSM 2D shapes, add data to _shapes, _keys, _values inputs.  Or
2) If you would like to search OSM 3D shapes, then additionally add data to threeDeeShapes_, threeDeeValues_ inputs.
-
Provided by Gismo 0.0.1
    
    input:
        _requiredTag: Required tag represents a combination between a key and value(s) for which this component will perform the search.
                      Use "OSM tag" component to generate it.
        _shapes: Plug in the data from the Gismo OSM shapes "shapes" output
        _keys: Plug in the data from the Gismo OSM shapes "keys" output.
        _values: Plug in the data from the Gismo OSM shapes "values" output.
        threeDeeShapes_: This input is needed only if you are searching 3D shapes.
                         For example: you created 3d buildings with "OSM 3D" component, and now you would like to check which one of all those buildings is a residential building.
                         If this is the case, then plug in the data from the Gismo "OSM 3D" "threeDeeShapes" output.
                         -
                         If nothing supplied, then search of 2d OSM shapes (that's "_shapes" input) will be performed only.
        threeDeeValues_: This input is needed only if you are searching 3D shapes.
                         For example: you created 3d buildings with "OSM 3D" component, and now you would like to check which one of all those buildings is a residential building.
                         If this is the case, then plug in the data from the Gismo "OSM 3D" "threeDeeValues" output.
                         -
                         If nothing supplied, then search of 2d OSM shapes (that's "_shapes" input) will be performed only.
        createFootprints_: In case your shape is a polygon, this input will create a surface from it.
                           -
                           This input is irrelevant if you are performing search of 3D OSM shapes (if data is supplied to "threeDeeShapes_" and "threeDeeValues_" inputs).
                           -
                           If not supplied, default value "False" will be used.
        groundTerrain_: The ground terrain surface on which the "foundShapes" will be laid onto.
                        Supply it by using "terrain" output of the Ladybug "Terrain Generator" (type_ = 1) or Gismo "Terrain Generator" (type_ = 2 or type_ = 3) components.
                        -
                        If nothing supplied, the "foundShapes" will always be laid flat onto a horizontal plane, with plane origin being the "origin" input of the "OSM shapes" component.
        bakeIt_: Set to "True" to bake the extruded _shape geometry into the Rhino scene.
                 The geometry will be grouped. To ungroup it, select it and call the "Ungroup" Rhino command.
                 -
                 If not supplied default value "False" will be used.
        _runIt: ...
    
    output:
        readMe!: ...
        foundShapes: Inputted "_shapes" (for 2d search) or "threeDeeShapes_" (for 3d search) which correspond to the chosen _requiredTag input.
                     -
                     If upper "_shapes"/"threeDeeShapes_" do not satisfy the "_requiredTag", then that shape's branch will be empty.
                     Use "Clean Tree" component and set the "E" input to "True" to remove all these empty branches.
        foundKeys: A list of keys. This output is the same as "keys" output of "OSM shapes" component.
        foundValues: Values corresponding to each "foundShapes".
                     -
                     If upper "_shapes"/"threeDeeShapes_" do not satisfy the "_requiredTag", then that branch will not have any values (it will be empty).
                     Use "Clean Tree" component and set the "E" input to "True" to remove all these empty branches.
        foundShapeOrNot: If a shape corresponds to the chosen OSM object then the value will be True.
                         If it does not, then False is returned. So no empty branches will exist, as False value will be used in their place.
                         -
                         Boolean value (True or False).
        titleOriginPt: Title base point, which can be used to move the "title" geometry with grasshopper's "Move" component.
                       -
                       Connect this output to a Grasshopper's "Point" parameter in order to preview the point in the Rhino scene.
        title: Title geometry with information about "_requiredTag" inputs.
"""

ghenv.Component.Name = "Gismo_OSM Search"
ghenv.Component.NickName = "OSMsearch"
ghenv.Component.Message = "VER 0.0.1\nFEB_09_2017"
ghenv.Component.IconDisplayMode = ghenv.Component.IconDisplayMode.application
ghenv.Component.Category = "Gismo"
ghenv.Component.SubCategory = "1 | OpenStreetMap"
#compatibleGismoVersion = VER 0.0.1\nFEB_09_2017
try: ghenv.Component.AdditionalHelpFromDocStrings = "2"
except: pass

import scriptcontext as sc
import Grasshopper
import System
import random
import Rhino
import math
import time
import gc


def checkInputData(requiredTag, shapes, keys, values, threeDeeShapes, threeDeeValues, createFootprints):
    
    # check _requiredTag input, get requiredKey, requiredValues, OSMobjectName
    if (len(requiredTag.Branches) == 0)  or  (len(requiredTag.Branches) == 1) and (requiredTag.Branches[0][0] == None):
        # this happens when nothing is supplied to the "_requiredTag" input,  OR  when "requiredTag" ouput of "OSM tag" component is supplied to the "_requiredTag" input, but the "OSM tag" component has not been ran
        OSMobjectName = requiredKey = requiredValues = createFootprints = perform_searchThreeDeeShapes = shapeType = None
        validInputData = False
        printMsg = "There is no data supplied to the \"_requiredTag\" input.\n" + \
                   " \n" + \
                   "Use the \"OSM tag\" component to generate this input."
        return OSMobjectName, requiredKey, requiredValues, createFootprints, perform_searchThreeDeeShapes, shapeType, validInputData, printMsg
    else:
        # deconstruct "_requiredTag" input to requiredKey, requiredValues
        requiredKey = list(requiredTag.Branches[0])[0]
        requiredValues = list(requiredTag.Branches[1])
        if len(requiredValues) == 0:
            requiredValues = ["^"]  # returning changed "requiredValues = ["^"]" in "OSM tag" component
        
        # try finding "OSMobjectName" if _requiredTag has been generated with already defined requiredKey and requiredValues
        requiredKeyRequiredValue_dict = gismo_osm.requiredTag_dictionary()
        requiredKeyRequiredValue_dict_keys = requiredKeyRequiredValue_dict.keys()
        for potential_OSMobjectName in requiredKeyRequiredValue_dict_keys:
            potential_requiredKey, potential_requiredValues = requiredKeyRequiredValue_dict[potential_OSMobjectName]
            if (requiredKey == potential_requiredKey) and (requiredValues == list(potential_requiredValues)):
                OSMobjectName = potential_OSMobjectName
                break
        else:
            # "OSMobjectName" can not be found in gismo_osm.requiredTag_dictionary(). Create it from: requiredKey and requiredValues
            OSMobjectName = "requiredKey=" + requiredKey + "_requiredValues=" + requiredValues[0] + "..."
        del requiredKeyRequiredValue_dict
    #print "OSMobjectName: ", OSMobjectName
    #print "requiredKey: ", requiredKey
    #print "requiredValues: ", requiredValues
    
    
    # check _shapes, _keys, _values inputs
    if (shapes.DataCount == 0):
        OSMobjectName = requiredKey = requiredValues = createFootprints = perform_searchThreeDeeShapes = shapeType = None
        validInputData = False
        printMsg = "Please connect the \"shapes\" output from Gismo \"OSM shapes\" component to this component's \"_shapes\" input."
        return OSMobjectName, requiredKey, requiredValues, createFootprints, perform_searchThreeDeeShapes, shapeType, validInputData, printMsg
    
    elif (len(shapes.Branches) == 1) and (shapes.Branches[0][0] == None):
        # this happens when "OSM shapes" component's "_runIt" input is set to "False"
        OSMobjectName = requiredKey = requiredValues = createFootprints = perform_searchThreeDeeShapes = shapeType = None
        validInputData = False
        printMsg = "There is no data supplied to the \"_shapes\" input.\n" + \
                   " \n" + \
                   "Please connect the \"shapes\" output from Gismo \"OSM shapes\" component to this component's \"_shapes\" input.\n" + \
                   "And make sure that you set the \"OSM shapes\" \"_runIt\" input to \"True\"."
        return OSMobjectName, requiredKey, requiredValues, createFootprints, perform_searchThreeDeeShapes, shapeType, validInputData, printMsg
    
    
    if (len(keys) == 0):
        OSMobjectName = requiredKey = requiredValues = createFootprints = perform_searchThreeDeeShapes = shapeType = None
        validInputData = False
        printMsg = "Please connect the \"keys\" output from Gismo \"OSM shapes\" component to this component's \"_keys\" input."
        return OSMobjectName, requiredKey, requiredValues, createFootprints, perform_searchThreeDeeShapes, shapeType, validInputData, printMsg
    elif (len(keys) == 1) and (keys[0] == None):
        # this happens when "OSM shapes" component's "_runIt" input is set to "False"
        OSMobjectName = requiredKey = requiredValues = createFootprints = perform_searchThreeDeeShapes = shapeType = None
        validInputData = False
        printMsg = "There is no data supplied to the \"_keys\" input.\n" + \
                   " \n" + \
                   "Please connect the \"keys\" output from Gismo \"OSM shapes\" component to this component's \"_keys\" input.\n" + \
                   "And make sure that you set the \"OSM shapes\" \"_runIt\" input to \"True\"."
        return OSMobjectName, requiredKey, requiredValues, createFootprints, perform_searchThreeDeeShapes, shapeType, validInputData, printMsg
    
    
    if (values.DataCount == 0):
        OSMobjectName = requiredKey = requiredValues = createFootprints = perform_searchThreeDeeShapes = shapeType = None
        validInputData = False
        printMsg = "Please connect the \"values\" output from Gismo \"OSM shapes\" component to this component's \"_values\" input."
        return OSMobjectName, requiredKey, requiredValues, createFootprints, perform_searchThreeDeeShapes, shapeType, validInputData, printMsg
    
    elif (len(values.Branches) == 1) and (values.Branches[0][0] == None):
        # this happens when "OSM shapes" component's "_runIt" input is set to "False"
        OSMobjectName = requiredKey = requiredValues = createFootprints = perform_searchThreeDeeShapes = shapeType = None
        validInputData = False
        printMsg = "There is no data supplied to the \"_values\" input.\n" + \
                   " \n" + \
                   "Please connect the \"values\" output from Gismo \"OSM shapes\" component to this component's \"_values\" input.\n" + \
                   "And make sure that you set the \"OSM shapes\" \"_runIt\" input to \"True\"."
        return OSMobjectName, requiredKey, requiredValues, createFootprints, perform_searchThreeDeeShapes, shapeType, validInputData, printMsg
    
    
    if len(shapes.Paths) != len(values.Paths):
        OSMobjectName = requiredKey = requiredValues = createFootprints = perform_searchThreeDeeShapes = shapeType = None
        validInputData = False
        printMsg = "The number of tree branches inputted to the \"_shapes\" and \"_values\" inputs do not match.\n" + \
                   " \n" + \
                   "Make sure that you connected:\n" + \
                   "\"shapes\" output from Gismo \"OSM shapes\" component to this component's \"_shapes\" input. And:\n" + \
                   "\"values\" output from Gismo \"OSM shapes\" component to this component's \"_values\" input."
        return OSMobjectName, requiredKey, requiredValues, createFootprints, perform_searchThreeDeeShapes, shapeType, validInputData, printMsg
    
    
    
    # check threeDeeShapes_, threeDeeValues_ inputs
    validThreeDeeShapes = False  # initial value
    validThreeDeeValues = False  # initial value
    valid_threeDeeShapes_vs_threeDeeValues = False  # initial value
    perform_searchThreeDeeShapes = False  # initial value
    
    if (len(threeDeeShapes.Branches) == 1) and (threeDeeShapes.Branches[0][0] == None):
        # this happens when "OSM shapes" component's "_runIt" input is set to "False"
        OSMobjectName = requiredKey = requiredValues = createFootprints = perform_searchThreeDeeShapes = shapeType = None
        validInputData = False
        printMsg = "There is no data supplied to the \"_threeDeeShapes\" input.\n" + \
                   " \n" + \
                   "Please connect the \"threeDeeShapes\" output from Gismo \"OSM 3D\" component to this component's \"_threeDeeShapes\" input.\n" + \
                   "And make sure that you set the \"OSM 3D\" \"_runIt\" input to \"True\"."
        return OSMobjectName, requiredKey, requiredValues, createFootprints, perform_searchThreeDeeShapes, shapeType, validInputData, printMsg
    elif (threeDeeShapes.DataCount != 0):
        validThreeDeeShapes = True
    
    
    if (len(threeDeeValues.Branches) == 1) and (threeDeeValues.Branches[0][0] == None):
        # this happens when "OSM shapes" component's "_runIt" input is set to "False"
        OSMobjectName = requiredKey = requiredValues = createFootprints = perform_searchThreeDeeShapes = shapeType = None
        validInputData = False
        printMsg = "There is no data supplied to the \"_threeDeeValues\" input.\n" + \
                   " \n" + \
                   "Please connect the \"threeDeeValues\" output from Gismo \"OSM 3D\" component to this component's \"_threeDeeValues\" input.\n" + \
                   "And make sure that you set the \"OSM 3D\" \"_runIt\" input to \"True\"."
        return OSMobjectName, requiredKey, requiredValues, createFootprints, perform_searchThreeDeeShapes, shapeType, validInputData, printMsg
    elif (threeDeeValues.DataCount != 0):
        validThreeDeeValues = True
    
    
    if len(threeDeeShapes.Paths) != len(threeDeeValues.Paths):
        OSMobjectName = requiredKey = requiredValues = createFootprints = perform_searchThreeDeeShapes = shapeType = None
        validInputData = False
        printMsg = "The number of tree branches inputted to the \"threeDeeShapes_\" and \"threeDeeValues_\" inputs do not match.\n" + \
                   " \n" + \
                   "Make sure that you connected:\n" + \
                   "\"threeDeeShapes\" output from Gismo \"OSM 3D\" component to this component's \"threeDeeShapes_\" input. And:\n" + \
                   "\"threeDeeValues\" output from Gismo \"OSM 3D\" component to this component's \"threeDeeValues_\" input."
        return OSMobjectName, requiredKey, requiredValues, createFootprints, perform_searchThreeDeeShapes, shapeType, validInputData, printMsg
    else:
        valid_threeDeeShapes_vs_threeDeeValues = True
    
    if (validThreeDeeShapes == True) and (validThreeDeeValues == True) and (valid_threeDeeShapes_vs_threeDeeValues == True):
        perform_searchThreeDeeShapes = True
    
    
    if (createFootprints == None):
        createFootprints = True  # default
    
    
    # check the "shapeType_" input value set in the "OSM shapes" component.
    shapeType = gismo_preparation.checkShapeType(shapes.Branches)
    if (perform_searchThreeDeeShapes == True)  and  ((shapeType == 1) or (shapeType == 2)):
        OSMobjectName = requiredKey = requiredValues = createFootprints = perform_searchThreeDeeShapes = shapeType = None
        validInputData = False
        printMsg = "This component can be used to find only 3D shapes for \"shapeType_ == 0\" set in \"OSM shapes\" component.\n" + \
                   " \n" + \
                   "For any other \"shapeType_\" value (1 and 2), just unplug the data from the \"threeDeeShapes_\" and \"threeDeeValues_\" inputs of this component.\n" + \
                   "In this way, 2D shapes will be successfully searched."
        return OSMobjectName, requiredKey, requiredValues, createFootprints, perform_searchThreeDeeShapes, shapeType, validInputData, printMsg
    elif (perform_searchThreeDeeShapes == True)  and  (shapeType == 0):
        # everything is ok, as this component can be used to find only 3d shapes for shapeType == 0, which currently is the case.
        pass
    
    
    del shapes; del keys; del values; del threeDeeShapes; del threeDeeValues  # delete local variables
    validInputData = True
    printMsg = "ok"
    
    return OSMobjectName, requiredKey, requiredValues, createFootprints, perform_searchThreeDeeShapes, shapeType, validInputData, printMsg


def searchShapes(OSMobjectName, requiredKey, requiredValues, shapesDataTree, keys, valuesDataTree, threeDeeShapesDataTree, threeDeeValuesDataTree, createFootprints, groundTerrain, shapeType, perform_searchThreeDeeShapes):
    
    tol = Rhino.RhinoDoc.ActiveDoc.ModelAbsoluteTolerance
    projectionDirection = Rhino.Geometry.Vector3d(0,0,1)  # it can be projectionDirection = Rhino.Geometry.Vector3d(0,0,-1) as well, does not matter
    
    if groundTerrain:
        # something inputted to the "groundTerrain_"
        groundBrep_singleBrepFace = groundTerrain.Faces[0].DuplicateFace(False)  # in case inputted "groundTerrain_" has a thickness
        accurate = False
        bb_volume, bb_centroid, bb_length, bb_depth, bb_height, bb_bottomLeftCorner, bb_bottomRightCorner, bb_topRightCorner, bb_topLeftCorner = gismo_preparation.boundingBox_properties([groundTerrain], accurate)
        shapeExtrudeHeight = 3 * bb_height  # "3" is due to safety
        
        groundTerrain_edges = groundTerrain.DuplicateEdgeCurves()
        
        if len(groundTerrain_edges) == 1:
            # circular groundTerrain without NO "standThickness_" (Terrain Generator 2 component)
            groundTerrain_outterEdge = Rhino.Geometry.Curve.JoinCurves([groundTerrain_edges[0]], tol)[0]
        elif len(groundTerrain_edges) == 3:
            # circular groundTerrain_ with "standThickness_" (Terrain Generator 2 components)
            groundTerrain_outterEdge = Rhino.Geometry.Curve.JoinCurves([groundTerrain_edges[0]], tol)[0]
        elif len(groundTerrain_edges) == 4:
            # rectangular groundTerrain_ with NO "standThickness_" (Terrain Generator or Terrain Generator 2 component)
            groundTerrain_outterEdge = Rhino.Geometry.Curve.JoinCurves(groundTerrain_edges, tol)[0]
        elif len(groundTerrain_edges) == 12:
            # rectangular groundTerrain_ with "standThickness_" (Terrain Generator 2 component)
            groundTerrain_outterEdge = Rhino.Geometry.Curve.JoinCurves(groundTerrain_edges[:4], tol)[0]
        
        extrudeVector = Rhino.Geometry.Vector3d(0,0,bb_height)
        groundTerrain_outerEdge_extrusion = Rhino.Geometry.Surface.CreateExtrusion(groundTerrain_outterEdge, extrudeVector).ToBrep()
        
        
    else:
        # nothing inputted to the "groundTerrain_"
        groundBrep_singleBrepFace = None
        shapeExtrudeHeight = None  # dummy value
        bb_height = 30  # dummy value
    
    
    # compare "OSM shapes" and "Terrain Generator" component's "origin_" inputs. Their Z coordinate needs to be equal or 
    OSMshapesComp_origin = sc.sticky["gismo_OSMshapesComp_origin"]
    if sc.sticky.has_key("gismo_terrainGeneratorComp_origin"):
        #print "__Gismo Terrain Generator component ran !!"
        # groundTerrain_ inputted from Gismo "Terrain Generator"
        terrainGeneratorComp_origin = sc.sticky["gismo_terrainGeneratorComp_origin"]
        if OSMshapesComp_origin.Z >= terrainGeneratorComp_origin.Z:
            # if origin_ from "OSM shapes" component is on equal or above height than origin_ from "Terrain Generator" component
            liftingOSMshapesHeight = 30  # dummy value
        elif OSMshapesComp_origin.Z < terrainGeneratorComp_origin.Z:
            # if origin_ height from "OSM shapes" component is lower than origin_ height from "Terrain Generator" component.
            liftingOSMshapesHeight = abs((terrainGeneratorComp_origin.Z - OSMshapesComp_origin.Z) + 30)  # 30 is dummy value
    else:
        #print "__Ladybug Terrain Generator component ran !!"
        # groundTerrain_ inputted from Ladybug "Terrain Generator"
        liftingOSMshapesHeight = 8848  # dummy (high) value
    
    
    if (shapeType == 0):
        # shift the paths in "shapes" and "values" data trees by -1, to create closed surfaces with holes
        shapes_shiftedPaths_DataTree = gismo_preparation.datatree_shiftPaths(shapesDataTree)
        values_shiftedPaths_DataTree = gismo_preparation.datatree_shiftPaths(valuesDataTree)
    elif (shapeType != 0):
        # no shifting of paths should be done for shapeType == 1,2
        shapes_shiftedPaths_DataTree = shapesDataTree
        values_shiftedPaths_DataTree = valuesDataTree
    
    shapes_shiftedPaths_Paths = shapes_shiftedPaths_DataTree.Paths
    shapes_shiftedPaths_LL = shapes_shiftedPaths_DataTree.Branches
    values_shiftedPaths_LL = values_shiftedPaths_DataTree.Branches
    
    foundShapes_flattened = []
    foundShapesDataTree = Grasshopper.DataTree[object]()
    foundValuesDataTree = Grasshopper.DataTree[object]()
    foundShapeOrNotDataTree = Grasshopper.DataTree[object]()
    paths = shapes_shiftedPaths_DataTree.Paths
    
    for branchIndex,shapesL in enumerate(shapes_shiftedPaths_LL):
        if len(shapesL) == 0:
            # some shape may have been removed with the "OSM ids" component
            foundShapesL = []
            values = []
            foundShapeOrNotL = [False]
        else:
            value = ""  # dummy value in case requiredKey or requiredValues does not exist
            foundShapesSwitch = False  # initial value
            for keyIndex,key in enumerate(keys):
                if (key == requiredKey):
                    value = values_shiftedPaths_LL[branchIndex][keyIndex]
                    break  # if requiredKey is found, stop iterrating through other keys for that shapesL
            
            if (value in requiredValues) and (value != ""):
                foundShapesSwitch = True
            #elif (key == requiredKey) and (requiredValues == "^") and (value != ""):
            elif (key == requiredKey) and (requiredValues == ["^"]) and (value != ""):
                foundShapesSwitch = True
            
            if foundShapesSwitch == True:
                if (len(shapesL) == 0):
                    # for some unknown reason "shapesL" is empty
                    foundShapesL = []
                    values = []
                    foundShapeOrNotL = [False]
                elif (len(shapesL) > 0):
                    # set "values" and "foundShapeOrNotL" at the very start. Now find the "foundShapesL"
                    values = values_shiftedPaths_LL[branchIndex]
                    foundShapeOrNotL = [True]
                
                
                if (shapeType == 2):
                    # 1) shapeType_ == 2
                    if (groundBrep_singleBrepFace == None):
                        # 1) NOTHING inputted into "terrainGround_"
                        foundShapesL = shapesL
                    elif (groundBrep_singleBrepFace != None):
                        # b) terrain inputted into "terrainGround_"
                        shapesL_point3d = [shapesL[0].Location]  # converting the "Point" to "Point3d" type
                        foundShapesL = Rhino.Geometry.Intersect.Intersection.ProjectPointsToBreps([groundBrep_singleBrepFace], shapesL_point3d, projectionDirection, tol)  # foundShapesL will be empty is a point is out of the groundTerrain_ boundaries
                
                
                elif (shapeType != 2):
                    # 2) shapeType_ == 0 or 1
                    if (groundBrep_singleBrepFace == None):
                        # a) NOTHING inputted into "terrainGround_"
                        if (createFootprints == False):
                            foundShapesL = shapesL
                        elif (createFootprints == True):
                            try:
                                # closed shapesL (shapeType == 0)
                                foundShapesL = [Rhino.Geometry.Brep.CreatePlanarBreps(shapesL)[0]]
                            except:
                                # opened shapesL (shapeType == 1)
                                foundShapesL = shapesL
                    
                    elif (groundBrep_singleBrepFace != None):
                        # b) terrain inputted into "terrainGround_"
                        if (createFootprints == False):
                            projectedShapesL = Rhino.Geometry.Curve.ProjectToBrep(shapesL, [groundBrep_singleBrepFace], projectionDirection, 0.01)
                            if len(projectedShapesL) > 0:
                                foundShapesL = projectedShapesL
                            else:
                                foundShapesL = []
                                values = []
                                foundShapeOrNotL = [False]
                        
                        elif (createFootprints == True):
                            if (not shapesL[0].IsClosed):  # it is assumed that all shapes in "shapesL" are closed or open
                                # the shapesL[0] is not closed (this will happen with shapeType == 1)
                                projectedShapesL = Rhino.Geometry.Curve.ProjectToBrep(shapesL, [groundBrep_singleBrepFace], projectionDirection, 0.01)
                                if len(projectedShapesL) > 0:
                                    foundShapesL = projectedShapesL
                                elif len(projectedShapesL) == 0:
                                    # shapesL is outside of groundTerrain_ bounding box
                                    foundShapesL = []
                                    values = []
                                    foundShapeOrNotL = [False]
                            
                            elif (shapesL[0].IsClosed):
                                # move _shapes above so that intersection with groundTerrain_ is fullfiled successfully
                                moveMatrix = Rhino.Geometry.Transform.Translation(0,0,liftingOSMshapesHeight)
                                for shapeIndex, shape in enumerate(shapesL):
                                    shape.Transform(moveMatrix)
                                
                                planarBrep = Rhino.Geometry.Brep.CreatePlanarBreps(shapesL)[0]
                                shapeStartPt = shapesL[0].PointAtStart  # if there are more shapes in shapesL, they will all have the same Z coordinates (on the same height)
                                extrudePathCurve = Rhino.Geometry.Line(shapeStartPt, Rhino.Geometry.Point3d(shapeStartPt.X, shapeStartPt.Y, shapeStartPt.Z - (liftingOSMshapesHeight+(2 * bb_height)) )).ToNurbsCurve()
                                cap = True
                                extrudedShapeBrep = planarBrep.Faces[0].CreateExtrusion(extrudePathCurve, cap)
                                splittedBreps = Rhino.Geometry.Brep.Split(groundBrep_singleBrepFace, extrudedShapeBrep, tol)
                                
                                if len(splittedBreps) > 0:
                                    # the shapesL are inside of groundTerrain_ bounding box (a) or the interesect with it (b)
                                    # determine which one of these two is the case
                                    intersectionYes, intersectCrvs, intersectPts = Rhino.Geometry.Intersect.Intersection.BrepBrep(groundTerrain_outerEdge_extrusion, extrudedShapeBrep, tol)
                                    
                                    if (len(intersectCrvs) > 0):
                                        # shapeL planar srf intersects with groundTerrrain_
                                        foundShapesL = [splittedBreps[0]]
                                        foundShapesL[0].Faces.ShrinkFaces()  # shrink the cutted foundShapesL
                                    elif (len(intersectCrvs) == 0):
                                        # shapeL planar srf is inside groundTerrain_ and does not intersect it
                                        foundShapesL = [splittedBreps[len(splittedBreps)-1]]
                                        foundShapesL[0].Faces.ShrinkFaces()  # shrink the cutted foundShapesL
                                    
                                else:
                                    # shapesL is outside of groundTerrain_ bounding box
                                    foundShapesL = []
                                    values = []
                                    foundShapeOrNotL = [False]
                                
                                del splittedBreps
                                del extrudedShapeBrep
            
            
            else:
                # the required value is not found. There for the OSM object sought through "_requiredTag" is not found. Try changing the "shapeType_" at "OSM shapes" component
                foundShapesL = []
                values = []
                foundShapeOrNotL = [False]
        
        if (len(foundShapesL) != 0):
            foundShapes_flattened.extend(foundShapesL)  # for 3D foundShapes only
        foundShapesDataTree.AddRange(foundShapesL, shapes_shiftedPaths_Paths[branchIndex])
        foundValuesDataTree.AddRange(values, shapes_shiftedPaths_Paths[branchIndex])
        foundShapeOrNotDataTree.AddRange(foundShapeOrNotL, shapes_shiftedPaths_Paths[branchIndex])
    
    
    
    # 3D (foundThreeDeeShapesDataTree, foundThreeDeeValuesDataTree, foundThreeDeeShapeOrNotDataTree if "threeDeeShapes_" and "threeDeeValues_" are inputted)
    foundThreeDeeShapesDataTree = Grasshopper.DataTree[object]()
    foundThreeDeeValuesDataTree = Grasshopper.DataTree[object]()
    foundThreeDeeShapeOrNotDataTree = Grasshopper.DataTree[object]()
    if (perform_searchThreeDeeShapes == True):
        threeDeeShapes_LL = threeDeeShapesDataTree.Branches
        threeDeeValues_LL = threeDeeValuesDataTree.Branches
        threeDeePaths = threeDeeShapesDataTree.Paths
        for branchIndex,threeDeeShapesL in enumerate(threeDeeShapes_LL):
            if (len(threeDeeShapesL) != 0):
                upperFace = threeDeeShapesL[0].Faces[0]
                upperFaceCentroid = Rhino.Geometry.AreaMassProperties.Compute(upperFace).Centroid
                for foundShape in foundShapes_flattened:
                    upperFaceCentroid_projected = Rhino.Geometry.Intersect.Intersection.ProjectPointsToBreps([foundShape], [upperFaceCentroid], projectionDirection, tol)
                    if len(upperFaceCentroid_projected) == 0:
                        continue
                    else:
                        foundThreeDeeShapesL = threeDeeShapesL
                        foundThreeDeeValuesL = threeDeeValues_LL[branchIndex]
                        foundThreeDeeShapeOrNotL = [True]
                        break
                else:
                    foundThreeDeeShapesL = []
                    foundThreeDeeValuesL = []
                    foundThreeDeeShapeOrNotL = [False]
            else:
                # the 3d shape was not created from some particular shape
                foundThreeDeeShapesL = []
                foundThreeDeeValuesL = []
                foundThreeDeeShapeOrNotL = [False]
            
            foundThreeDeeShapesDataTree.AddRange(foundThreeDeeShapesL, threeDeePaths[branchIndex])
            foundThreeDeeValuesDataTree.AddRange(foundThreeDeeValuesL, threeDeePaths[branchIndex])
            foundThreeDeeShapeOrNotDataTree.AddRange(foundThreeDeeShapeOrNotL, threeDeePaths[branchIndex])
    
    
    # deleting
    del shapesDataTree; del shapes_shiftedPaths_Paths; del shapes_shiftedPaths_LL; del valuesDataTree; del values_shiftedPaths_LL; del keys  # delete local variables
    
    try:
        # terrainGround_ has been inputted
        del groundTerrain_outerEdge_extrusion
    except:
        pass
    gc.collect()
    
    
    if (foundShapesDataTree.DataCount == 0):
        # 2D OSM search
        foundShapesDataTree = foundValuesDataTree = foundShapeOrNotDataTree = OSMobjectName = None
        validInputs = False
        printMsg = "No OSM object can be found for given _keys and _values.\n" + \
                   "_keys and _values are affected by \"shapeType\" input of \"OSM shapes\" component. For example, trees will always be located (if they exist at that location) for shapeType_ = 2.\n" + \
                   "Try changing the value of the \"shapeType\" input of \"OSM shapes\" component."
        return foundShapesDataTree, foundValuesDataTree, foundShapeOrNotDataTree, OSMobjectName, validInputs, printMsg
    
    if (foundThreeDeeShapesDataTree.DataCount == 0) and (threeDeeShapes_.DataCount != 0) and (threeDeeValues_.DataCount != 0):
        # 3D OSM search
        foundThreeDeeShapesDataTree = foundThreeDeeValuesDataTree = foundThreeDeeShapeOrNotDataTree = OSMobjectName = None
        validInputs = False
        printMsg = "No 3D OSM object can be found through _requiredTag for the given _shapes, _keys, _values and threeDeeShapes_, threeDeeValues_ data."
        return foundThreeDeeShapesDataTree, foundThreeDeeValuesDataTree, foundThreeDeeShapeOrNotDataTree, OSMobjectName, validInputs, printMsg
    
    
    validInputs = True
    printMsg = "ok"
    if (perform_searchThreeDeeShapes == True):
        return foundThreeDeeShapesDataTree, foundThreeDeeValuesDataTree, foundThreeDeeShapeOrNotDataTree, OSMobjectName, validInputs, printMsg
    elif (perform_searchThreeDeeShapes == False):
        return foundShapesDataTree, foundValuesDataTree, foundShapeOrNotDataTree, OSMobjectName, validInputs, printMsg


def titleAndBaking(OSMobjectName, foundShapesDataTree, shapeType):
    
    # title
    
    # "groundTerrain_" NOT inputted:
    foundShapesFlattenedList = []
    ptcloud = Rhino.Geometry.PointCloud()  # use it for shapeType = 2 (because Point3d class does not contain the "GetBoundingBox" method)
    for subL in foundShapesDataTree.Branches:
        if len(subL) > 0:
            for shape in subL:
                if shapeType == 2:
                    # points (shapeType = 2)
                    ptcloud.Add(shape)
                else:
                    try:
                        # polygons, polyline (shapeType = 0, 1)
                        curve = shape.ToNurbsCurve()
                        foundShapesFlattenedList.append(curve)
                    except:
                        # 3d buildings (shapeType = 0)
                        foundShapesFlattenedList.append(shape)
    
    
    titleLabelText = "Found OSM shapes for:\n%s" % OSMobjectName
    if groundTerrain_:
        # "groundTerrain_" inputted:
        shrinkSuccess = groundTerrain_.Faces.ShrinkFaces()  # in case for some unknown reason created groundTerrain_ does not have at least one of its faces shrank
        titleLabelMesh, titleStartPt, titleTextSize = gismo_preparation.createTitle("mesh", [groundTerrain_], [titleLabelText])
    else:
        if shapeType == 2:
            titleLabelMesh, titleStartPt, titleTextSize = gismo_preparation.createTitle("mesh", [ptcloud], [titleLabelText])
        else:
            titleLabelMesh, titleStartPt, titleTextSize = gismo_preparation.createTitle("mesh", foundShapesFlattenedList, [titleLabelText])
    del ptcloud
    
    
    # baking
    if bakeIt_:
        
        layerName = OSMobjectName.upper()
        layParentName = "GISMO"; laySubName = "OSM"; layerCategoryName = "SEARCHED_SHAPES"
        newLayerCategory = False
        laySubName_color = System.Drawing.Color.FromArgb(100,191,70)  # green
        layerColor = System.Drawing.Color.FromArgb(0,0,0)  # black
        
        layerIndex, layerName_dummy = gismo_preparation.createLayer(layParentName, laySubName, layerCategoryName, newLayerCategory, layerName, laySubName_color, layerColor) 
        
        foundShapesFlattened = [shape  for foundShapesL in foundShapesDataTree.Branches  for shape in foundShapesL]
        geometryIds = gismo_preparation.bakeGeometry(foundShapesFlattened, layerIndex)
        geometryIds2 = gismo_preparation.bakeGeometry([titleLabelMesh], layerIndex)
        
        # grouping
        groupIndex = gismo_preparation.groupGeometry("OSM_FOUND_SHAPES" + "_" + layerName + "_shapesOnly", geometryIds)
        groupIndex2 = gismo_preparation.groupGeometry("OSM_FOUND_SHAPES" + "_" + layerName + "_shapesAndTitle", geometryIds2)
        del geometryIds; del geometryIds2
    
    
    # hide titleOriginPt
    ghenv.Component.Params.Output[6].Hidden = True
    
    # deleting
    del foundShapesDataTree; del foundShapesFlattenedList
    
    return titleLabelMesh, titleStartPt


def printOutput(requiredKey, requiredValues, createFootprints):
    
    #requiredTagLL = [list(item)  for item in requiredTag.Branches]
    #if requiredValues == ["^"]: requiredValues = []
    
    if bakeIt_ == True:
        bakedOrNot = "and baked "
    elif bakeIt_ == False:
        bakedOrNot = ""
    
    if groundTerrain_:
        groundTerrainInputted = "yes"
    else:
        groundTerrainInputted = "no"
    
    resultsCompletedMsg = "OSM search component results successfully completed %s!" % bakedOrNot
    printOutputMsg = \
    """
Input data:

requiredTag: %s, %s
Ground terrain inputted: %s
    """ % (requiredKey, requiredValues, groundTerrainInputted)
    print resultsCompletedMsg
    print printOutputMsg


level = Grasshopper.Kernel.GH_RuntimeMessageLevel.Warning
if sc.sticky.has_key("gismoGismo_released"):
    validVersionDate, printMsg = sc.sticky["gismo_check"].versionDate(ghenv.Component)
    if validVersionDate:
        gismo_preparation = sc.sticky["gismo_Preparation"]()
        gismo_createGeometry = sc.sticky["gismo_CreateGeometry"]()
        gismo_osm = sc.sticky["gismo_OSM"]()
        
        OSMobjectName, requiredKey, requiredValues, createFootprints, perform_searchThreeDeeShapes, shapeType, validInputData, printMsg = checkInputData(_requiredTag, _shapes, _keys, _values, threeDeeShapes_, threeDeeValues_, createFootprints_)
        if validInputData:
            if _runIt:
                if (not perform_searchThreeDeeShapes):
                    # 2D
                    foundShapes, foundValues, foundShapeOrNot, OSMobjectName, validInputs, printMsg = searchShapes(OSMobjectName, requiredKey, requiredValues, _shapes, _keys, _values, threeDeeShapes_, threeDeeValues_, createFootprints, groundTerrain_, shapeType, perform_searchThreeDeeShapes)
                elif perform_searchThreeDeeShapes:
                    # 3D
                    createFootprints = True
                    foundShapes, foundValues, foundShapeOrNot, OSMobjectName, validInputs, printMsg = searchShapes(OSMobjectName, requiredKey, requiredValues, _shapes, _keys, _values, threeDeeShapes_, threeDeeValues_, createFootprints, groundTerrain_, shapeType, perform_searchThreeDeeShapes)
                if validInputs:
                    title, titleOriginPt = titleAndBaking(OSMobjectName, foundShapes, shapeType)
                    printOutput(requiredKey, requiredValues, createFootprints)
                    foundKeys = _keys
                else:
                    print printMsg
                    ghenv.Component.AddRuntimeMessage(level, printMsg)
            else:
                print "All inputs are ok. Please set \"_runIt\" to True, in order to run the OSM search component"
        else:
            print printMsg
            ghenv.Component.AddRuntimeMessage(level, printMsg)
    else:
        print printMsg
        ghenv.Component.AddRuntimeMessage(level, printMsg)
else:
    printMsg = "First please run the Gismo Gismo component."
    print printMsg
    ghenv.Component.AddRuntimeMessage(level, printMsg)
# ---------- end osmsearch ----------
extr = Extrude(Base=osmsearch.foundShapes, Direction="0,0,0.1")
preview_3 = CustomPreview(Geometry=extr, Shader=ColourSwatch(SwatchColor=RGB(4, 133, 0)))

# ----
project = Project(Curve=osmshapes.shapes, Brep=geo, Direction=Vector(0, 0, 1))
preview_4 = CustomPreview(Geometry=project, Shader=ColourSwatch(SwatchColor=RGB(255, 255, 255)))
